# Grasshopper definition NWayStoneArch.gh (Grasshopper 1.0.8)

# ---- group: 几何输入｜保持原值
# 最新稿件对应版｜G3默认案例: 主流程：01－06 → 07A－07F；几何、自重、所选网络、分块与实际接缝逐候选对应。
# 当前G3：N=5，H=5.20 m，冠深0.75 m，网络冠高4.825 m，冠半径1.30 m，外侧顶坡1%。
# 12个内嵌脚本已同步论文对应源码；07E只报告滑移指标，07F终止于滑移缺额，不作销栓容量或强度认证。
# Valid=True只表示阶段数据/数值检查通过。核筛失败、张开、压力和滑移缺额必须分别解释。
# 04包含或平衡失败时按论文协议停止采用下游结果；图中连线本身不代表自动中止所有电池。
# 论文表2为原始保存运行，当前重算可能有微小再生成差异，不能覆盖或伪造历史数值。
# 表3解析检查、表4四组敏感性、方向与符号审计属于独立验证记录；本画布默认仅计算当前候选。
n_分支数 = Slider(5, range=0..10)
h_几何冠顶高_m = Slider(5.2, range=0..10)
footwidths_拱脚宽_m = Slider(1, range=0..10)
crowndepth_冠深_m = Slider(0.75, range=0..1)
crownfilletradius_圆角_m = Slider(0.3, range=0..1)
crownblockradius_冠半径_m = Slider(1.3, range=0..10)
topslopepercent_坡度 = Slider(1, range=0..10)
rotationangles_方位角 = Panel("""8.3
64.2
126
231
311.2""")
spans_跨度_m = Panel("""6.3
8.8
7.1
9.9
7.8""")

# ---- group: 荷载与摩擦场景｜保持原值
unitweight_25_5_kn_m³ = Panel("25.5")
kh_水平系数 = Panel("0.4")
粗扫角步长 = Panel("5")
细化角步长 = Panel("1")
初始细化半宽 = Panel("5")
μ_摩擦系数 = Panel("0.55")
γs_滑移系数 = Panel("1.5")

# ---- group: 01 参数化几何
_01_参数化几何_备注 = Panel("""输入分支数、几何顶高H、方位角、跨度及截面参数。
输出统一实体、几何中心线和支点。
H是冠顶高度；网络冠点为H－冠深/2。
CenterLines不是推力线。
顶坡与冠半径须与06保持相同。
对应论文2.2、3.1；Valid只表示本阶段检查通过。""")
_01_参数化几何 = Python3Script(
    N=n_分支数,
    H=h_几何冠顶高_m,
    RotationAngles=rotationangles_方位角,
    Spans=spans_跨度_m,
    FootWidths=footwidths_拱脚宽_m,
    CrownDepth=crowndepth_冠深_m,
    CrownFilletRadius=crownfilletradius_圆角_m,
    TopSlopePercent=topslopepercent_坡度,
    CrownBlockRadius=crownblockradius_冠半径_m)  # -> out, CenterLines, SupportPoints, WholeSolid, Valid, Report; inputs N: Int32, H: Double, RotationAngles: list, Spans: list, FootWidths: list of Double, CrownDepth: Double, TopSlopePercent: Double, CrownBlockRadius: Double
# ---------- _01_参数化几何: Python ----------
"""Stage 01 - deterministic parametric geometry for N radial half arches.

Grasshopper Python inputs:
    N                  int          Number of half arches / supports (>= 3)
    H                  float        Overall crown top height above Z=0
    RotationAngles     list[float]  One plan angle in degrees per half arch
    Spans              list[float]  One crown-to-support span per half arch
    FootWidths         list[float]  One transverse width per half arch
    CrownDepth         float        Minimum vertical depth at the crown
    CrownFilletRadius  float        Plan fillet radius at crown intersections
    TopSlopePercent    float        Optional outward top fall, 0 to 5 percent
    CrownBlockRadius   float        Shared crown-zone / first-joint control

Use Item Access for N, H, CrownDepth, CrownFilletRadius, TopSlopePercent and
CrownBlockRadius. Use List Access for RotationAngles, Spans and FootWidths.
Empty RotationAngles gives an even 360-degree distribution. One Span or
FootWidth is broadcast to all arches. Unconnected crown inputs use their
DEFAULT values. An unconnected TopSlopePercent preserves the historical
horizontal top (0 percent); an unconnected CrownBlockRadius uses the same
1.60 m default as Stage 06.

Outputs:
    WholeSolid, CenterLines, SupportPoints, Valid, Report

This component performs geometry generation only. It does not use Kangaroo and
does not claim structural equilibrium. Every half arch is a deterministic
radial wall with a quadratic lower arch edge, an exact support location and a
constant transverse FootWidth. At zero slope all branches retain the historical
common horizontal top plane at Z=H. The wall is deepest at the support and has
the internal CrownDepth at the common crown. CrownFilletRadius rounds the
actual plan intersections of the half arches; it never adds a sphere or
ellipsoid. Block segmentation belongs to a later stage. A positive
TopSlopePercent retains a horizontal central cap of CrownBlockRadius and then
lowers each branch top radially outward at the requested gradient; it does not
cut the later crown block. The same CrownBlockRadius value is intended to feed
Stage 06 in parallel; no Stage 06 output is fed back into Stage 01.
"""

import math
import Rhino
import Rhino.Geometry as rg


DEFAULT_SPAN = 10.0
DEFAULT_FOOT_WIDTH = 1.0
DEFAULT_CROWN_DEPTH = 0.75
DEFAULT_CROWN_FILLET_RADIUS = 0.30
DEFAULT_TOP_SLOPE_PERCENT = 0.0
MAX_TOP_SLOPE_PERCENT = 5.0
DEFAULT_CROWN_BLOCK_RADIUS = 1.60


def _as_list(value):
    if value is None:
        return []
    try:
        return list(value)
    except TypeError:
        return [value]


def _document_tolerances():
    document = Rhino.RhinoDoc.ActiveDoc
    if document is None:
        return 1.0e-3, math.radians(1.0)
    return (
        document.ModelAbsoluteTolerance,
        math.radians(document.ModelAngleToleranceDegrees),
    )


def _broadcast(values, count, default, name):
    prepared = _as_list(values)
    if not prepared:
        prepared = [default]
    if len(prepared) == 1:
        prepared *= count
    if len(prepared) != count:
        raise ValueError(
            "{0} must contain one value or exactly N values.".format(name)
        )
    prepared = [float(value) for value in prepared]
    if any(value <= 0.0 for value in prepared):
        raise ValueError("Every {0} value must be greater than zero.".format(
            name
        ))
    return prepared


def _top_slope_fraction(top_slope_percent):
    value = (
        DEFAULT_TOP_SLOPE_PERCENT
        if top_slope_percent is None
        else float(top_slope_percent)
    )
    if not math.isfinite(value):
        raise ValueError("TopSlopePercent must be finite.")
    if value < 0.0 or value > MAX_TOP_SLOPE_PERCENT:
        raise ValueError(
            "TopSlopePercent must be between 0 and {0:.6g}."
            .format(MAX_TOP_SLOPE_PERCENT)
        )
    return value / 100.0


def _crown_block_radius(crown_block_radius):
    value = (
        DEFAULT_CROWN_BLOCK_RADIUS
        if crown_block_radius is None
        else float(crown_block_radius)
    )
    if not math.isfinite(value) or value <= 0.0:
        raise ValueError("CrownBlockRadius must be a finite positive number.")
    return value


def _prepare_inputs(arch_count, height, rotation_angles, spans, foot_widths,
                    crown_depth, crown_fillet_radius):
    arch_count = int(arch_count)
    if arch_count < 3:
        raise ValueError("N must be at least 3.")

    height = float(height)
    crown_depth = (
        DEFAULT_CROWN_DEPTH
        if crown_depth is None
        else float(crown_depth)
    )
    if crown_depth <= 0.0:
        raise ValueError("CrownDepth must be greater than zero.")
    if height <= crown_depth:
        raise ValueError(
            "H must be greater than CrownDepth={0:.6g}."
            .format(crown_depth)
        )
    crown_fillet_radius = (
        DEFAULT_CROWN_FILLET_RADIUS
        if crown_fillet_radius is None
        else float(crown_fillet_radius)
    )
    if crown_fillet_radius < 0.0:
        raise ValueError("CrownFilletRadius cannot be negative.")

    angles = _as_list(rotation_angles)
    if not angles:
        angles = [
            360.0 * float(index) / float(arch_count)
            for index in range(arch_count)
        ]
    if len(angles) != arch_count:
        raise ValueError("RotationAngles must contain exactly N values.")
    angles = [float(angle) % 360.0 for angle in angles]

    rounded = [round(angle, 9) for angle in angles]
    if len(set(rounded)) != arch_count:
        raise ValueError("RotationAngles must be unique modulo 360 degrees.")

    span_values = _broadcast(
        spans, arch_count, DEFAULT_SPAN, "Spans"
    )
    width_values = _broadcast(
        foot_widths, arch_count, DEFAULT_FOOT_WIDTH, "FootWidths"
    )
    return (
        arch_count,
        height,
        angles,
        span_values,
        width_values,
        crown_depth,
        crown_fillet_radius,
    )


def _quadratic_curve(start, control, end):
    curve = rg.NurbsCurve.Create(False, 2, [start, control, end])
    if curve is None or not curve.IsValid:
        raise RuntimeError("Rhino could not create a quadratic arch curve.")
    return curve


def _arch_curves(angle_degrees, span, height, depth):
    angle = math.radians(angle_degrees)
    radial = rg.Vector3d(math.cos(angle), math.sin(angle), 0.0)
    transverse = rg.Vector3d(-radial.Y, radial.X, 0.0)

    bottom_start = rg.Point3d(
        radial.X * 0.0,
        radial.Y * 0.0,
        height - depth,
    )
    bottom_control = rg.Point3d(
        radial.X * (0.5 * span),
        radial.Y * (0.5 * span),
        height - depth,
    )
    bottom_end = rg.Point3d(
        radial.X * span,
        radial.Y * span,
        0.0,
    )
    bottom = _quadratic_curve(
        bottom_start, bottom_control, bottom_end
    )

    top_start = rg.Point3d(0.0, 0.0, height)
    top_end = rg.Point3d(
        radial.X * span,
        radial.Y * span,
        height,
    )
    top = rg.LineCurve(top_start, top_end)

    center_start = rg.Point3d(0.0, 0.0, height - 0.5 * depth)
    center_control = rg.Point3d(
        radial.X * (0.5 * span),
        radial.Y * (0.5 * span),
        height - 0.5 * depth,
    )
    center_end = rg.Point3d(
        radial.X * span,
        radial.Y * span,
        0.5 * height,
    )
    center = _quadratic_curve(
        center_start, center_control, center_end
    )
    return bottom, top, center, radial, transverse


def _top_elevation(height, slope, crown_block_radius, distance):
    return height - slope * max(
        0.0, distance - crown_block_radius
    )


def _sloped_top_curve(radial, span, height, slope, crown_block_radius):
    start = rg.Point3d(0.0, 0.0, height)
    transition = rg.Point3d(
        radial.X * crown_block_radius,
        radial.Y * crown_block_radius,
        height,
    )
    end = rg.Point3d(
        radial.X * span,
        radial.Y * span,
        _top_elevation(height, slope, crown_block_radius, span),
    )
    curve = rg.PolyCurve()
    if not curve.Append(rg.LineCurve(start, transition)):
        raise RuntimeError("Rhino could not append the horizontal crown cap.")
    if not curve.Append(rg.LineCurve(transition, end)):
        raise RuntimeError("Rhino could not append the sloped branch top.")
    if not curve.IsValid:
        raise RuntimeError("The sloped branch top is invalid.")
    return curve


def _sloped_center_line(radial, span, height, depth, slope,
                        crown_block_radius):
    points = []
    for index in range(65):
        distance = span * index / 64.0
        ratio = distance / span
        bottom_z = (height - depth) * (1.0 - ratio * ratio)
        top_z = _top_elevation(
            height, slope, crown_block_radius, distance
        )
        points.append(
            rg.Point3d(
                radial.X * distance,
                radial.Y * distance,
                0.5 * (top_z + bottom_z),
            )
        )
    curve = rg.PolylineCurve(points)
    if not curve.IsValid:
        raise RuntimeError("The sloped geometric centre line is invalid.")
    return curve


def _closed_profile(bottom, top):
    outer = rg.LineCurve(bottom.PointAtEnd, top.PointAtEnd)
    reversed_top = top.DuplicateCurve()
    if not reversed_top.Reverse():
        raise RuntimeError("Rhino could not reverse an arch top curve.")
    crown = rg.LineCurve(reversed_top.PointAtEnd, bottom.PointAtStart)

    profile = rg.PolyCurve()
    for segment in (bottom, outer, reversed_top, crown):
        if not profile.Append(segment):
            raise RuntimeError("Rhino could not join an arch profile.")
    if not profile.IsValid or not profile.IsClosed:
        raise RuntimeError("The generated arch profile is not closed.")
    return profile


def _extrude_profile(profile, transverse, width, tolerance):
    shifted = profile.DuplicateCurve()
    shifted.Transform(
        rg.Transform.Translation(transverse * (-0.5 * width))
    )
    surface = rg.Surface.CreateExtrusion(shifted, transverse * width)
    if surface is None:
        raise RuntimeError("Rhino could not extrude an arch profile.")
    solid = surface.ToBrep().CapPlanarHoles(tolerance)
    if solid is None or not solid.IsValid or not solid.IsSolid:
        raise RuntimeError("Rhino could not create a closed arch solid.")
    if solid.SolidOrientation == rg.BrepSolidOrientation.Inward:
        solid.Flip()
    if solid.SolidOrientation != rg.BrepSolidOrientation.Outward:
        raise RuntimeError("An arch solid has an invalid orientation.")
    return solid


def _valid_union(result):
    if result is None:
        return []
    return [
        brep for brep in result
        if (
            brep is not None
            and brep.IsValid
            and brep.IsSolid
        )
    ]


def _plan_rectangle(angle_degrees, width, start_distance, end_distance):
    angle = math.radians(angle_degrees)
    radial = rg.Vector3d(math.cos(angle), math.sin(angle), 0.0)
    transverse = rg.Vector3d(-radial.Y, radial.X, 0.0)
    half_width = 0.5 * width
    points = [
        rg.Point3d(
            start_distance * radial.X - half_width * transverse.X,
            start_distance * radial.Y - half_width * transverse.Y,
            0.0,
        ),
        rg.Point3d(
            end_distance * radial.X - half_width * transverse.X,
            end_distance * radial.Y - half_width * transverse.Y,
            0.0,
        ),
        rg.Point3d(
            end_distance * radial.X + half_width * transverse.X,
            end_distance * radial.Y + half_width * transverse.Y,
            0.0,
        ),
        rg.Point3d(
            start_distance * radial.X + half_width * transverse.X,
            start_distance * radial.Y + half_width * transverse.Y,
            0.0,
        ),
    ]
    points.append(points[0])
    return rg.PolylineCurve(points)


def _single_plan_union(curves, name):
    result = rg.Curve.CreateBooleanUnion(curves)
    if result is None or len(result) != 1:
        count = -1 if result is None else len(result)
        raise RuntimeError(
            "{0} produced {1} separate plan regions.".format(name, count)
        )
    curve = result[0]
    if not curve.IsValid or not curve.IsClosed:
        raise RuntimeError("{0} is not a valid closed curve.".format(name))
    return curve


def _rounded_full_plan(angles, widths, spans, fillet_radius, tolerance,
                       angle_tolerance):
    strips = [
        _plan_rectangle(angle, width, 0.0, span)
        for angle, width, span in zip(angles, widths, spans)
    ]
    sharp = _single_plan_union(strips, "The full arch footprint union")
    if fillet_radius <= tolerance:
        return sharp

    cleanup_length = 0.15 * min(widths)
    cleaned = sharp.DuplicateCurve()
    cleaned.RemoveShortSegments(cleanup_length)

    fully_filleted = rg.Curve.CreateFilletCornersCurve(
        cleaned,
        fillet_radius,
        tolerance,
        angle_tolerance,
    )
    if (
        fully_filleted is None
        or not fully_filleted.IsValid
        or not fully_filleted.IsClosed
    ):
        raise ValueError(
            "CrownFilletRadius={0:.6g} is too large for the current "
            "angles and FootWidths.".format(fillet_radius)
        )
    rounded = _single_plan_union(
        [cleaned, fully_filleted],
        "The selective concave fillet union",
    )
    curved_segments = sum(
        1 for segment in rounded.DuplicateSegments()
        if not segment.IsLinear(tolerance)
    )
    if curved_segments < len(angles):
        raise ValueError(
            "CrownFilletRadius created only {0} curved transitions for "
            "N={1}. Reduce the radius or revise the angle spacing."
            .format(curved_segments, len(angles))
        )
    return rounded


def _extrude_closed_plan_curve(plan_curve, base_z, extrusion_height):
    plan = plan_curve.DuplicateCurve()
    plan.Transform(rg.Transform.Translation(0.0, 0.0, base_z))
    extrusion = rg.Extrusion.Create(plan, extrusion_height, True)
    if extrusion is None:
        raise RuntimeError("Rhino could not extrude the crown plan.")
    solid = extrusion.ToBrep()
    if solid is None or not solid.IsValid or not solid.IsSolid:
        raise RuntimeError("The crown plan is not a valid closed solid.")
    if solid.SolidOrientation == rg.BrepSolidOrientation.Inward:
        solid.Flip()
    return solid


def _create_crown_geometry(angles, widths, spans, height, depth,
                           fillet_radius, tolerance, angle_tolerance):
    rounded_plan = _rounded_full_plan(
        angles,
        widths,
        spans,
        fillet_radius,
        tolerance,
        angle_tolerance,
    )
    overlap = max(20.0 * tolerance, 1.0e-5)
    connector = _extrude_closed_plan_curve(
        rounded_plan,
        height - depth - overlap,
        depth + 2.0 * overlap,
    )
    return connector


def _create_sloped_crown_geometry(angles, widths, spans, height, depth,
                                  fillet_radius, tolerance,
                                  angle_tolerance, crown_block_radius):
    rounded_plan = _rounded_full_plan(
        angles,
        widths,
        spans,
        fillet_radius,
        tolerance,
        angle_tolerance,
    )
    overlap = max(20.0 * tolerance, 1.0e-5)
    full_connector = _extrude_closed_plan_curve(
        rounded_plan,
        height - depth - overlap,
        depth + overlap,
    )
    cylinder_plane = rg.Plane(rg.Plane.WorldXY)
    cylinder_plane.Origin = rg.Point3d(
        0.0, 0.0, height - depth - overlap
    )
    cylinder = rg.Cylinder(
        rg.Circle(cylinder_plane, crown_block_radius),
        depth + overlap,
    ).ToBrep(True, True)
    results = _valid_union(
        rg.Brep.CreateBooleanIntersection(
            full_connector, cylinder, tolerance
        )
    )
    if len(results) != 1:
        raise RuntimeError(
            "The horizontal crown cap produced {0} solids."
            .format(len(results))
        )
    return results[0]


def _sequential_union(solids, tolerance):
    current = solids[0].DuplicateBrep()
    for solid in solids[1:]:
        result = _valid_union(
            rg.Brep.CreateBooleanUnion(
                [current, solid], tolerance
            )
        )
        if len(result) != 1:
            return None
        current = result[0]
    return current


def _trim_to_height(solid, height, extent, tolerance):
    clipping_box = rg.Box(
        rg.Plane.WorldXY,
        rg.Interval(-extent, extent),
        rg.Interval(-extent, extent),
        rg.Interval(-extent, height),
    ).ToBrep()
    result = _valid_union(
        rg.Brep.CreateBooleanIntersection(
            solid, clipping_box, tolerance
        )
    )
    return result[0] if len(result) == 1 else None


def create_parametric_geometry(arch_count, height, rotation_angles,
                               spans, foot_widths, crown_depth=None,
                               crown_fillet_radius=None,
                               top_slope_percent=None,
                               crown_block_radius=None):
    top_slope = _top_slope_fraction(top_slope_percent)
    crown_block_radius = _crown_block_radius(crown_block_radius)
    (
        arch_count,
        height,
        angles,
        span_values,
        width_values,
        crown_depth,
        crown_fillet_radius,
    ) = _prepare_inputs(
        arch_count,
        height,
        rotation_angles,
        spans,
        foot_widths,
        crown_depth,
        crown_fillet_radius,
    )
    if (
        top_slope > 0.0
        and min(span_values) <= crown_block_radius
    ):
        raise ValueError(
            "Every Span must exceed CrownBlockRadius."
        )
    tolerance, angle_tolerance = _document_tolerances()

    center_lines = []
    support_points = []
    solids = []
    drops = []
    minimum_sampled_thickness = float("inf")

    for angle, span, width in zip(
        angles, span_values, width_values
    ):
        bottom, horizontal_top, horizontal_center, radial, transverse = _arch_curves(
            angle, span, height, crown_depth
        )
        if top_slope > 0.0:
            top = _sloped_top_curve(
                radial, span, height, top_slope, crown_block_radius
            )
            center = _sloped_center_line(
                radial, span, height, crown_depth, top_slope,
                crown_block_radius
            )
            drop = top_slope * (
                span - crown_block_radius
            )
            drops.append(drop)
            for sample_index in range(65):
                distance = span * sample_index / 64.0
                ratio = distance / span
                bottom_z = (
                    (height - crown_depth) * (1.0 - ratio * ratio)
                )
                thickness = (
                    _top_elevation(
                        height, top_slope, crown_block_radius, distance
                    )
                    - bottom_z
                )
                minimum_sampled_thickness = min(
                    minimum_sampled_thickness, thickness
                )
        else:
            top = horizontal_top
            center = horizontal_center
        profile = _closed_profile(bottom, top)
        solid = _extrude_profile(
            profile, transverse, width, tolerance
        )
        center_lines.append(center)
        support_points.append(
            rg.Point3d(radial.X * span, radial.Y * span, 0.0)
        )
        solids.append(solid)

    if top_slope > 0.0:
        crown_connector = _create_sloped_crown_geometry(
            angles,
            width_values,
            span_values,
            height,
            crown_depth,
            crown_fillet_radius,
            tolerance,
            angle_tolerance,
            crown_block_radius,
        )
        union_results = _valid_union(
            rg.Brep.CreateBooleanUnion(
                [crown_connector] + solids, tolerance
            )
        )
        whole_solid = union_results[0] if len(union_results) == 1 else None
    else:
        crown_connector = _create_crown_geometry(
            angles,
            width_values,
            span_values,
            height,
            crown_depth,
            crown_fillet_radius,
            tolerance,
            angle_tolerance,
        )
        raw_union = _sequential_union(
            [crown_connector] + solids, tolerance
        )
        extent = max(span_values) + 3.0 * max(width_values)
        whole_solid = (
            _trim_to_height(raw_union, height, extent, tolerance)
            if raw_union is not None
            else None
        )

    height_error = 0.0
    for solid in solids:
        height_error = max(
            height_error,
            abs(solid.GetBoundingBox(True).Max.Z - height),
        )

    all_solids_valid = (
        len(solids) == arch_count
        and all(solid.IsValid and solid.IsSolid for solid in solids)
    )
    valid = (
        all_solids_valid
        and whole_solid is not None
        and height_error <= max(10.0 * tolerance, 1.0e-8)
        and (
            top_slope <= 0.0
            or minimum_sampled_thickness > tolerance
        )
    )
    if top_slope > 0.0:
        report = (
            f"N={arch_count}; geometry_mode=deterministic; H={height:.6g}; "
            "top_mode=horizontal_cap_then_radial_outward_fall; "
            f"top_slope_percent={100.0 * top_slope:.6g}; "
            f"crown_block_radius={crown_block_radius:.6g}; "
            f"top_drops_m={[round(value, 6) for value in drops]}; "
            f"minimum_sampled_thickness={minimum_sampled_thickness:.6g}; "
            f"crown_depth={crown_depth:.6g}; "
            f"crown_fillet_radius={crown_fillet_radius:.6g}; "
            "fillet_mode=selective_concave_union; "
            f"center_lines={len(center_lines)}; "
            f"supports={len(support_points)}; "
            f"height_error={height_error:.6g}; valid={valid}"
        )
    else:
        report = (
            f"N={arch_count}; geometry_mode=deterministic; H={height:.6g}; "
            "top_mode=common_horizontal; "
            f"crown_depth={crown_depth:.6g}; "
            f"crown_fillet_radius={crown_fillet_radius:.6g}; "
            "fillet_mode=selective_concave_union; "
            f"center_lines={len(center_lines)}; "
            f"supports={len(support_points)}; "
            f"height_error={height_error:.6g}; valid={valid}"
        )
    return (
        whole_solid,
        center_lines,
        support_points,
        valid,
        report,
    )


try:
    _top_slope_component_input = TopSlopePercent
except NameError:
    _top_slope_component_input = None

try:
    _crown_block_radius_component_input = CrownBlockRadius
except NameError:
    _crown_block_radius_component_input = None

try:
    _component_inputs = (
        N,
        H,
        RotationAngles,
        Spans,
        FootWidths,
        CrownDepth,
        CrownFilletRadius,
        _top_slope_component_input,
        _crown_block_radius_component_input,
    )
except NameError:
    _component_inputs = None

if _component_inputs is not None:
    (
        WholeSolid,
        CenterLines,
        SupportPoints,
        Valid,
        Report,
    ) = create_parametric_geometry(*_component_inputs)
# ---------- end _01_参数化几何 ----------

# ---- group: 02 实际自重
_02_实际自重_备注 = Panel("""统一实体采样，按最近节点分配体积并按精确体积缩放。
共享冠部只计一次，输出节点、边与自重荷载。
基准12段/分支、约70000目标采样；单位重25.5 kN/m³。
强签名一致时复用缓存；无效输入明确报错。
修改几何必须重新计算自重。
总质量守恒不等于逐节点荷载精确或结构安全。""")
_02_实际自重 = Python3Script(WholeSolid=_01_参数化几何.WholeSolid, CenterLines=_01_参数化几何.CenterLines, UnitWeight=unitweight_25_5_kn_m³)  # -> out, Nodes, Edges, NodalLoads, Valid, Report; inputs WholeSolid: Brep, CenterLines: list of Curve, UnitWeight: Double
# ---------- _02_实际自重: Python ----------
"""Stage 02 - lump the real solid self-weight onto a radial thrust network.

Grasshopper Python inputs:
    WholeSolid    Brep         Closed union from 01_ParametricGeometry
    CenterLines   list[Curve]  N crown-to-support centre lines
    UnitWeight    float        Stone unit weight in kN/m3 (Item, optional)

Use Item Access for WholeSolid and UnitWeight, and List Access for CenterLines.

Outputs:
    Nodes, Edges, NodalLoads, Valid, Report

The solid is sampled only once, after all crown overlaps and fillets have been
unified. Every occupied sample is assigned to its nearest network node, so the
shared crown volume cannot be counted once per arch. The sampled tributary
volumes are scaled to the exact Brep volume before loads are produced.

The expensive exact Brep classification is cached only when a strong geometry
signature can be built. Unchanged Grasshopper solutions reuse numeric tributary
volumes; any geometry, network, tolerance or sampling change invalidates the
cache. A missing signature disables caching rather than using a weak fallback.

UnitWeight defaults to the current research value when its optional input is
empty. The geometry is assumed to use metres, and loads are returned in kN.
"""

import math

import Rhino
import Rhino.Geometry as rg
import numpy as np

try:
    import scriptcontext as sc
except ImportError:
    sc = None


DEFAULT_SEGMENTS_PER_ARCH = 12
DEFAULT_UNIT_WEIGHT = 25.5  # kN/m3; current medium/high-density limestone study.
DEFAULT_TARGET_SAMPLES = 70000
DEFAULT_MIN_GRID_AXIS = 8
DEFAULT_MAX_GRID_AXIS = 72
NEAREST_NODE_CHUNK_SIZE = 2048
CACHE_ENTRY_LIMIT = 4
CACHE_VERSION = "stage02_exact_brep_v2"
CACHE_STICKY_KEY = "kangaroo2_grasshopper_stage02_exact_selfweight_cache_v2"


try:
    _MODULE_CACHE
except NameError:
    _MODULE_CACHE = {}


def _as_list(value):
    if value is None:
        return []
    try:
        return list(value)
    except TypeError:
        return [value]


def _positive_number(value, default, name):
    if value is None:
        return default
    try:
        number = float(value)
    except (TypeError, ValueError):
        raise ValueError("{0} must be a finite positive number.".format(name))
    if not math.isfinite(number) or number <= 0.0:
        raise ValueError("{0} must be a finite positive number.".format(name))
    return number


def _tolerance():
    document = Rhino.RhinoDoc.ActiveDoc
    if document is None:
        return 1.0e-3
    return document.ModelAbsoluteTolerance


def _network_from_curves(curves, segments, tolerance):
    nodes = []
    edges = []
    crown = None

    for arch_index, curve in enumerate(curves):
        if curve is None or not curve.IsValid:
            raise ValueError(
                "CenterLines contains an invalid curve at index {0}."
                .format(arch_index)
            )
        parameters = curve.DivideByCount(segments, True)
        if parameters is None or len(parameters) != segments + 1:
            raise RuntimeError(
                "Could not divide CenterLines[{0}] into {1} segments."
                .format(arch_index, segments)
            )
        points = [curve.PointAt(parameter) for parameter in parameters]

        if crown is None:
            crown = points[0]
            nodes.append(rg.Point3d(crown))
        elif points[0].DistanceTo(crown) > max(
            10.0 * tolerance, 1.0e-7
        ):
            raise ValueError(
                "All CenterLines must start at one shared crown point."
            )

        previous = 0
        for point in points[1:]:
            current = len(nodes)
            nodes.append(rg.Point3d(point))
            edges.append(rg.Line(nodes[previous], nodes[current]))
            previous = current

    return nodes, edges


def _grid_counts(box, target_samples):
    dx = max(box.Max.X - box.Min.X, 1.0e-9)
    dy = max(box.Max.Y - box.Min.Y, 1.0e-9)
    dz = max(box.Max.Z - box.Min.Z, 1.0e-9)
    base = (float(target_samples) / (dx * dy * dz)) ** (1.0 / 3.0)

    counts = []
    for length in (dx, dy, dz):
        count = int(round(length * base))
        count = max(DEFAULT_MIN_GRID_AXIS, count)
        count = min(DEFAULT_MAX_GRID_AXIS, count)
        counts.append(count)
    return counts


def _nearest_node_index(point, nodes):
    nearest_index = 0
    nearest_distance = float("inf")
    for index, node in enumerate(nodes):
        dx = point.X - node.X
        dy = point.Y - node.Y
        dz = point.Z - node.Z
        distance = dx * dx + dy * dy + dz * dz
        if distance < nearest_distance:
            nearest_distance = distance
            nearest_index = index
    return nearest_index


def _geometry_crc(geometry):
    try:
        return int(geometry.DataCRC(0))
    except Exception:
        return None


def _cache_key(solid, nodes, target_samples, tolerance):
    crc = _geometry_crc(solid)
    if crc is None:
        return None
    box = solid.GetBoundingBox(True)
    try:
        topology = (
            int(solid.Faces.Count),
            int(solid.Edges.Count),
            int(solid.Vertices.Count),
        )
    except Exception:
        return None
    volume = solid.GetVolume()
    if volume <= 0.0:
        return None
    return (
        CACHE_VERSION,
        crc,
        topology,
        (
            float(box.Min.X), float(box.Min.Y), float(box.Min.Z),
            float(box.Max.X), float(box.Max.Y), float(box.Max.Z),
        ),
        float(volume),
        tuple(
            (float(node.X), float(node.Y), float(node.Z))
            for node in nodes
        ),
        int(target_samples),
        float(tolerance),
        int(DEFAULT_MIN_GRID_AXIS),
        int(DEFAULT_MAX_GRID_AXIS),
    )


def _cache_store():
    if sc is not None:
        return sc.sticky
    return _MODULE_CACHE


def _cached_tributary_result(key):
    if key is None:
        return None
    store = _cache_store()
    bucket = store.get(CACHE_STICKY_KEY)
    if not isinstance(bucket, dict):
        return None
    entries = bucket.get("entries")
    if not isinstance(entries, list):
        return None
    for index, entry in enumerate(entries):
        if not isinstance(entry, dict) or entry.get("key") != key:
            continue
        payload = entry.get("payload")
        if not isinstance(payload, tuple) or len(payload) != 5:
            return None
        if index:
            entries.insert(0, entries.pop(index))
        volumes, grid, inside_count, exact_volume, sampled_volume = payload
        return (
            list(volumes),
            tuple(grid),
            int(inside_count),
            float(exact_volume),
            float(sampled_volume),
        )
    return None


def _store_tributary_result(key, result):
    if key is None:
        return
    volumes, grid, inside_count, exact_volume, sampled_volume = result
    store = _cache_store()
    bucket = store.get(CACHE_STICKY_KEY)
    if not isinstance(bucket, dict) or not isinstance(
        bucket.get("entries"), list
    ):
        bucket = {"entries": []}
    entries = [
        entry for entry in bucket["entries"]
        if isinstance(entry, dict) and entry.get("key") != key
    ]
    entry = {
        "key": key,
        "payload": (
            tuple(float(value) for value in volumes),
            tuple(int(value) for value in grid),
            int(inside_count),
            float(exact_volume),
            float(sampled_volume),
        ),
    }
    entries.insert(0, entry)
    bucket["entries"] = entries[:CACHE_ENTRY_LIMIT]
    store[CACHE_STICKY_KEY] = bucket


def _nearest_node_indices(coordinates, nodes):
    node_coordinates = np.asarray(
        [(node.X, node.Y, node.Z) for node in nodes], dtype=float
    )
    sample_coordinates = np.asarray(coordinates, dtype=float)
    nearest = []
    for start in range(0, len(sample_coordinates), NEAREST_NODE_CHUNK_SIZE):
        chunk = sample_coordinates[start:start + NEAREST_NODE_CHUNK_SIZE]
        delta_x = chunk[:, None, 0] - node_coordinates[None, :, 0]
        delta_y = chunk[:, None, 1] - node_coordinates[None, :, 1]
        delta_z = chunk[:, None, 2] - node_coordinates[None, :, 2]
        distances = (
            delta_x * delta_x + delta_y * delta_y + delta_z * delta_z
        )
        nearest.extend(np.argmin(distances, axis=1).tolist())
    return nearest


def _sample_tributary_volumes(solid, nodes, target_samples, tolerance):
    key = _cache_key(solid, nodes, target_samples, tolerance)
    cached = _cached_tributary_result(key)
    if cached is not None:
        return cached + (True, key is not None)

    box = solid.GetBoundingBox(True)
    nx, ny, nz = _grid_counts(box, target_samples)
    dx = (box.Max.X - box.Min.X) / float(nx)
    dy = (box.Max.Y - box.Min.Y) / float(ny)
    dz = (box.Max.Z - box.Min.Z) / float(nz)
    voxel_volume = dx * dy * dz

    inside_coordinates = []
    for ix in range(nx):
        x = box.Min.X + (ix + 0.5) * dx
        for iy in range(ny):
            y = box.Min.Y + (iy + 0.5) * dy
            for iz in range(nz):
                z = box.Min.Z + (iz + 0.5) * dz
                point = rg.Point3d(x, y, z)
                if not solid.IsPointInside(point, tolerance, False):
                    continue
                inside_coordinates.append((x, y, z))

    inside_count = len(inside_coordinates)

    if inside_count == 0:
        raise RuntimeError(
            "No interior volume samples were found. Check model units and "
            "whether WholeSolid is a closed solid."
        )

    volumes = [0.0 for node in nodes]
    for node_index in _nearest_node_indices(inside_coordinates, nodes):
        volumes[node_index] += voxel_volume

    exact_volume = solid.GetVolume()
    sampled_volume = sum(volumes)
    if exact_volume <= 0.0 or sampled_volume <= 0.0:
        raise RuntimeError("WholeSolid has no positive volume.")
    scale = exact_volume / sampled_volume
    volumes = [volume * scale for volume in volumes]
    result = (
        volumes, (nx, ny, nz), inside_count, exact_volume, sampled_volume
    )
    _store_tributary_result(key, result)
    return result + (False, key is not None)


def create_real_selfweight(whole_solid, center_lines, unit_weight=None):
    curves = _as_list(center_lines)
    if whole_solid is None:
        raise ValueError("WholeSolid is required.")
    if not whole_solid.IsValid or not whole_solid.IsSolid:
        raise ValueError("WholeSolid must be one valid closed Brep.")
    if len(curves) < 3:
        raise ValueError("CenterLines must contain at least three curves.")

    weight_density = _positive_number(
        unit_weight, DEFAULT_UNIT_WEIGHT, "UnitWeight"
    )
    segments = DEFAULT_SEGMENTS_PER_ARCH
    tolerance = _tolerance()
    nodes, edges = _network_from_curves(
        curves, segments, tolerance
    )
    (
        tributary_volumes,
        grid,
        inside_count,
        exact_volume,
        sampled_volume,
        cache_hit,
        cache_available,
    ) = _sample_tributary_volumes(
        whole_solid,
        nodes,
        DEFAULT_TARGET_SAMPLES,
        tolerance,
    )

    nodal_weights = [
        weight_density * volume for volume in tributary_volumes
    ]
    nodal_loads = [
        rg.Vector3d(0.0, 0.0, -weight) for weight in nodal_weights
    ]
    total_weight = sum(nodal_weights)
    expected_weight = weight_density * exact_volume
    weight_error = abs(total_weight - expected_weight)

    crown_weight = nodal_weights[0]
    valid = (
        len(nodes) == 1 + len(curves) * segments
        and len(edges) == len(curves) * segments
        and len(nodal_loads) == len(nodes)
        and all(weight >= 0.0 for weight in nodal_weights)
        and weight_error <= max(1.0e-9, expected_weight * 1.0e-10)
    )

    report = (
        "arches={0}; segments_per_arch={1}; nodes={2}; edges={3}; "
        "grid={4}x{5}x{6}; inside_samples={7}; "
        "exact_volume={8:.6g}m3; sampled_volume={9:.6g}m3; "
        "unit_weight={10:.6g}kN/m3; total_weight={11:.6g}kN; "
        "crown_weight_once={12:.6g}kN; "
        "weight_error={13:.6g}kN; cache_available={14}; cache_hit={15}; "
        "cache_entry_limit={16}; "
        "nearest_assignment=chunked_numpy_first_argmin; valid={17}"
    ).format(
        len(curves),
        segments,
        len(nodes),
        len(edges),
        grid[0],
        grid[1],
        grid[2],
        inside_count,
        exact_volume,
        sampled_volume,
        weight_density,
        total_weight,
        crown_weight,
        weight_error,
        cache_available,
        cache_hit,
        CACHE_ENTRY_LIMIT,
        valid,
    )
    return nodes, edges, nodal_loads, valid, report


try:
    _component_inputs = (WholeSolid, CenterLines, UnitWeight)
except NameError:
    try:
        _component_inputs = (WholeSolid, CenterLines, None)
    except NameError:
        _component_inputs = None

if _component_inputs is not None:
    Nodes, Edges, NodalLoads, Valid, Report = create_real_selfweight(
        *_component_inputs
    )
# ---------- end _02_实际自重 ----------

# ---- group: 03 Kangaroo初始形态
_03_kangaroo初始形态_备注 = Panel("""使用02的拓扑与非均匀自重进行初始松弛。
反转、缩放后保持源几何的网络冠点高度。
ThrustEdges仅作为04的初始输入。
Converged不等于压缩平衡或结构安全。
对应论文2.3；不直接用于最终结论。""")
_03_kangaroo初始形态 = Python3Script(Nodes=_02_实际自重.Nodes, Edges=_02_实际自重.Edges, NodalLoads=_02_实际自重.NodalLoads)  # -> out, ThrustEdges, ThrustLines, Converged, Report; inputs Nodes: list of Point3d, Edges: list of Line, NodalLoads: list of Vector3d
# ---------- _03_kangaroo初始形态: Python ----------
"""Stage 03 - Kangaroo initial thrust form under real nonuniform self-weight.

Grasshopper Python inputs:
    Nodes         list[Point3d]  From 02_RealSelfWeight
    Edges         list[Line]     From 02_RealSelfWeight
    NodalLoads    list[Vector3d] From 02_RealSelfWeight

Use List Access for all three inputs.

Outputs:
    ThrustEdges, ThrustLines, Converged, Report

This is an initial form-finding result, not the final masonry proof. It uses
the actual nonuniform nodal loads and one coupled crown particle. The outer
leaf nodes are supports. The hanging network is solved in Kangaroo, inverted,
and scaled so the shared crown reaches the crown-centre height supplied by
Nodes. COMPAS TNA/TNO will perform the later compression-only and envelope
checks.
"""

import clr

clr.AddReference("KangarooSolver")

import Rhino.Geometry as rg
from System.Collections.Generic import List
from KangarooSolver import IGoal, PhysicalSystem
from KangarooSolver.Goals import Anchor, Spring, Unary


DEFAULT_REST_LENGTH_FACTOR = 0.94
DEFAULT_STIFFNESS_RATIO = 200.0
DEFAULT_MAX_ITERATIONS = 5000
DEFAULT_MAX_STIFFNESS_RUNS = 12
DEFAULT_SOLVER_TOLERANCE = 1.0e-10


def _as_list(value):
    if value is None:
        return []
    try:
        return list(value)
    except TypeError:
        return [value]


def _nearest_index(point, points, tolerance):
    best = -1
    best_distance = float("inf")
    for index, candidate in enumerate(points):
        distance = point.DistanceTo(candidate)
        if distance < best_distance:
            best = index
            best_distance = distance
    if best_distance > tolerance:
        raise ValueError(
            "An Edges endpoint does not match a Nodes point; "
            "distance={0:.6g}.".format(best_distance)
        )
    return best


def _topology(points, edge_lines):
    tolerance = 1.0e-7
    indexed_edges = []
    adjacency = [[] for _ in points]
    seen = set()
    for edge_index, line in enumerate(edge_lines):
        if not line.IsValid or line.Length <= tolerance:
            raise ValueError(
                "Edges contains an invalid line at index {0}."
                .format(edge_index)
            )
        a = _nearest_index(line.From, points, tolerance)
        b = _nearest_index(line.To, points, tolerance)
        if a == b:
            raise ValueError("Edges contains a zero-topology edge.")
        key = (min(a, b), max(a, b))
        if key in seen:
            raise ValueError("Edges contains a duplicate edge.")
        seen.add(key)
        indexed_edges.append(key)
        adjacency[a].append((b, edge_index))
        adjacency[b].append((a, edge_index))

    supports = [
        index for index, neighbours in enumerate(adjacency)
        if len(neighbours) == 1
    ]
    crowns = [
        index for index, neighbours in enumerate(adjacency)
        if len(neighbours) > 2
    ]
    if len(crowns) != 1:
        raise ValueError(
            "The network must contain exactly one shared crown node."
        )
    crown = crowns[0]
    if len(supports) < 3:
        raise ValueError("The network must contain at least three supports.")
    if len(indexed_edges) != len(points) - 1:
        raise ValueError("The radial network must be one connected tree.")

    branches = []
    for first, _ in adjacency[crown]:
        branch = [crown, first]
        previous = crown
        current = first
        while current not in supports:
            following = [
                item for item in adjacency[current]
                if item[0] != previous
            ]
            if len(following) != 1:
                raise ValueError(
                    "Each crown-to-support branch must be a simple chain."
                )
            next_node, _ = following[0]
            branch.append(next_node)
            previous, current = current, next_node
        branches.append(branch)

    if len(branches) != len(supports):
        raise ValueError("Every crown branch must end at one support.")
    return indexed_edges, crown, supports, branches


def _initial_hanging_points(source_points, crown, branches):
    target_rise = source_points[crown].Z
    result = [
        rg.Point3d(point.X, point.Y, 0.0)
        for point in source_points
    ]
    for branch in branches:
        denominator = float(len(branch) - 1)
        for position, node_index in enumerate(branch):
            fraction = float(position) / denominator
            result[node_index].Z = -target_rise * (1.0 - fraction)
    return result


def _solve(points, indexed_edges, anchors, loads, spring_strength):
    goals = List[IGoal]()
    for a, b in indexed_edges:
        line = rg.Line(points[a], points[b])
        goals.Add(
            Spring(
                line,
                line.Length * DEFAULT_REST_LENGTH_FACTOR,
                spring_strength,
            )
        )

    for point, load in zip(points, loads):
        goals.Add(Unary(point, load, 1.0))
    for anchor in anchors:
        goals.Add(Anchor(points[anchor], 1.0e9))

    system = PhysicalSystem()
    for goal in goals:
        system.AssignPIndex(goal, 1.0e-8)
    particle_indices = [
        system.FindParticleIndex(point, 1.0e-8, False)
        for point in points
    ]
    if any(index < 0 for index in particle_indices):
        raise RuntimeError("Kangaroo could not map the network particles.")

    residual = float("inf")
    iterations = 0
    for iterations in range(1, DEFAULT_MAX_ITERATIONS + 1):
        system.Step(goals, True, 1.0e-12)
        residual = system.GetvSum()
        if residual <= DEFAULT_SOLVER_TOLERANCE:
            break
    positions = [
        system.GetPosition(index) for index in particle_indices
    ]
    for anchor in anchors:
        positions[anchor] = points[anchor]
    return positions, iterations, residual


def _coupled_hanging_form(points, indexed_edges, crown, supports,
                          branches, loads):
    mean_load = (
        sum(abs(load.Z) for load in loads) / float(len(loads))
    )
    spring_strength = max(1.0, mean_load * DEFAULT_STIFFNESS_RATIO)
    anchors = list(supports) + [crown]
    total_iterations = 0
    residual = float("inf")
    hanging = None
    apex_clearance = -float("inf")
    monotone = False
    stiffness_runs = 0
    for stiffness_runs in range(1, DEFAULT_MAX_STIFFNESS_RUNS + 1):
        hanging, iterations, residual = _solve(
            points,
            indexed_edges,
            anchors,
            loads,
            spring_strength,
        )
        total_iterations += iterations
        apex_clearance = min(
            point.Z - hanging[crown].Z
            for index, point in enumerate(hanging)
            if index != crown
        )
        monotone = True
        for branch in branches:
            previous_z = hanging[branch[0]].Z
            for index in branch[1:]:
                current_z = hanging[index].Z
                if current_z < previous_z - 1.0e-8:
                    monotone = False
                previous_z = current_z
        if apex_clearance >= -1.0e-8 and monotone:
            break
        spring_strength *= 2.0

    support_z = (
        sum(hanging[index].Z for index in supports)
        / float(len(supports))
    )
    natural_rise = support_z - hanging[crown].Z
    if natural_rise <= 1.0e-9:
        raise RuntimeError("Kangaroo produced no positive hanging rise.")

    return (
        hanging,
        total_iterations,
        residual,
        stiffness_runs,
        natural_rise,
        apex_clearance,
        spring_strength,
        monotone,
    )


def _invert_and_scale(hanging, source_points, crown, supports,
                      natural_rise):
    target_rise = source_points[crown].Z
    if target_rise <= 0.0:
        raise ValueError(
            "The crown node from Stage 02 must be above Z=0."
        )
    support_z = (
        sum(hanging[index].Z for index in supports)
        / float(len(supports))
    )
    scale = target_rise / natural_rise
    thrust = [
        rg.Point3d(
            point.X,
            point.Y,
            (support_z - point.Z) * scale,
        )
        for point in hanging
    ]
    for support in supports:
        thrust[support] = rg.Point3d(
            source_points[support].X,
            source_points[support].Y,
            0.0,
        )
    thrust[crown] = rg.Point3d(
        source_points[crown].X,
        source_points[crown].Y,
        target_rise,
    )
    return thrust, scale


def _branch_polylines(points, branches):
    return [
        rg.PolylineCurve([points[index] for index in branch])
        for branch in branches
    ]


def create_kangaroo_initial_form(nodes, edges, nodal_loads):
    source_points = [rg.Point3d(point) for point in _as_list(nodes)]
    edge_lines = _as_list(edges)
    loads = [rg.Vector3d(load) for load in _as_list(nodal_loads)]
    if len(source_points) < 4:
        raise ValueError("Nodes must contain a radial network.")
    if len(loads) != len(source_points):
        raise ValueError("NodalLoads must contain one vector per node.")
    if any(
        abs(load.X) > 1.0e-9
        or abs(load.Y) > 1.0e-9
        or load.Z > 1.0e-9
        for load in loads
    ):
        raise ValueError(
            "NodalLoads must be downward vertical self-weight vectors."
        )

    (
        indexed_edges,
        crown,
        supports,
        branches,
    ) = _topology(source_points, edge_lines)
    planar = _initial_hanging_points(
        source_points, crown, branches
    )
    (
        hanging,
        iterations,
        residual,
        stiffness_runs,
        natural_rise,
        apex_clearance,
        spring_strength,
        hanging_monotone,
    ) = _coupled_hanging_form(
        planar,
        indexed_edges,
        crown,
        supports,
        branches,
        loads,
    )
    thrust_points, vertical_scale = _invert_and_scale(
        hanging,
        source_points,
        crown,
        supports,
        natural_rise,
    )
    thrust_edges = [
        rg.Line(thrust_points[a], thrust_points[b])
        for a, b in indexed_edges
    ]
    thrust_lines = _branch_polylines(thrust_points, branches)

    monotone = True
    for branch in branches:
        previous_z = thrust_points[branch[0]].Z
        for index in branch[1:]:
            current_z = thrust_points[index].Z
            if current_z > previous_z + 1.0e-7:
                monotone = False
            previous_z = current_z

    total_weight = -sum(load.Z for load in loads)
    converged = (
        residual <= max(DEFAULT_SOLVER_TOLERANCE * 10.0, 1.0e-9)
        and apex_clearance >= -1.0e-8
        and hanging_monotone
        and monotone
    )
    report = (
        "mode=kangaroo_real_selfweight_initial; nodes={0}; edges={1}; "
        "arches={2}; supports={3}; total_weight={4:.6g}kN; "
        "load_distribution=nonuniform; crown_load_applied_once=True; "
        "crown_constraint=geometric_initial_only; "
        "spring_strength={5:.6g}; iterations={6}; residual={7:.6g}; "
        "stiffness_runs={8}; natural_hanging_rise={9:.6g}; "
        "vertical_scale={10:.6g}; apex_clearance={11:.6g}; "
        "crown_is_highest={12}; monotone={13}; converged={14}; "
        "status=initial_form_only_TNA_TNO_required"
    ).format(
        len(source_points),
        len(indexed_edges),
        len(branches),
        supports,
        total_weight,
        spring_strength,
        iterations,
        residual,
        stiffness_runs,
        natural_rise,
        vertical_scale,
        apex_clearance * vertical_scale,
        apex_clearance >= -1.0e-8,
        monotone,
        converged,
    )
    return thrust_edges, thrust_lines, converged, report


try:
    _component_inputs = (Nodes, Edges, NodalLoads)
except NameError:
    _component_inputs = None

if _component_inputs is not None:
    ThrustEdges, ThrustLines, Converged, Report = (
        create_kangaroo_initial_form(*_component_inputs)
    )
# ---------- end _03_kangaroo初始形态 ----------

# ----
表1案例参数_手动切换参考 = Panel("""论文案例输入｜其余共用：冠深0.75、圆角0.30、脚宽1.00、目标长1.40 m；顶坡1%；单位重25.5 kN/m³。
G0：N=5；H=6.5 m；冠半径=1.3 m；角度=8.3,64.2,126.0,231.0,311.2；跨度=6.3,8.8,7.1,9.9,7.8 m
G1：N=5；H=5.75 m；冠半径=1.3 m；角度=8.3,64.2,126.0,231.0,311.2；跨度=6.3,8.8,7.1,9.9,7.8 m
G2：N=5；H=5.4 m；冠半径=1.3 m；角度=8.3,64.2,126.0,231.0,311.2；跨度=6.3,8.8,7.1,9.9,7.8 m
G3：N=5；H=5.2 m；冠半径=1.3 m；角度=8.3,64.2,126.0,231.0,311.2；跨度=6.3,8.8,7.1,9.9,7.8 m
D3：N=3；H=4.4 m；冠半径=1.3 m；角度=0.0,75.0,205.0；跨度=9.4,6.3,8.0 m
D4：N=4；H=4.7 m；冠半径=1.6 m；角度=0.0,48.0,148.0,278.0；跨度=8.8,6.5,9.8,7.2 m
D5：N=5；H=5.03 m；冠半径=1.3 m；角度=8.3,64.2,126.0,231.0,311.2；跨度=6.3,8.8,7.1,9.9,7.8 m
切换须同时更新N、H、角度、跨度及冠半径；G0用于展示所选网络的包含失败。""")

# ---- group: 04 压缩平衡与包含
_04_压缩平衡与包含_备注 = Panel("""保持XY投影与网络冠高H－冠深/2，求选定径向TNA网络。
检查仅受压、自由节点平衡及每条边离散采样包含。
G3网络冠高4.825 m；第二阶段失败保留第一阶段平衡权重。
TNAEdges为05、06、07B共同来源，不是完整推力族。
包含失败先返回设计者，论文不采用该候选的下游结果。
此报告协议不等于画布已实现自动中止门控。""")
_04_压缩平衡与包含 = Python3Script(WholeSolid=_01_参数化几何.WholeSolid, InitialEdges=_03_kangaroo初始形态.ThrustEdges, NodalLoads=_02_实际自重.NodalLoads)  # -> out, TNAEdges, ThrustLines, OutsidePoints, Valid, Report, Advice; inputs WholeSolid: Brep, InitialEdges: list of Line, NodalLoads: list of Vector3d
# ---------- _04_压缩平衡与包含: Python ----------
#! python 3
"""Stage 04 - compression-only TNA equilibrium and solid containment check.

Grasshopper Python inputs:
    WholeSolid    Brep          From 01_ParametricGeometry
    InitialEdges  list[Line]    ThrustEdges from 03_KangarooInitialForm
    NodalLoads    list[Vector3d] From 02_RealSelfWeight

Use Item Access for WholeSolid and List Access for the other two inputs.

Outputs:
    TNAEdges, ThrustLines, OutsidePoints, Valid, Report, Advice

COMPAS TNA's force-density formulation is adapted to the project's radial
tree topology. Standard FormDiagram objects require faces, whereas this
structure is N one-dimensional half arches meeting at one node. Horizontal
compression magnitudes are optimised subject to exact crown equilibrium.
Vertical equilibrium is then solved for the real nonuniform nodal loads.
The crown is a free internal equilibrium node; only the outer leaves are
supports. The resulting network is sampled against the actual Rhino Brep.
"""

import math

import compas
import compas_tna
import numpy as np
import Rhino
import Rhino.Geometry as rg
from compas.matrices import connectivity_matrix
from scipy.optimize import minimize
from scipy.sparse import diags
from scipy.sparse.linalg import spsolve


DEFAULT_EDGE_SAMPLES = 12
DEFAULT_EQUILIBRIUM_TOLERANCE = 1.0e-6
DEFAULT_COMPRESSION_EPSILON = 1.0e-8
DEFAULT_MIN_HORIZONTAL_WEIGHT = 1.0e-4
DEFAULT_MAX_HORIZONTAL_WEIGHT = 100.0


def _as_list(value):
    if value is None:
        return []
    try:
        return list(value)
    except TypeError:
        return [value]


def _document_tolerance():
    document = Rhino.RhinoDoc.ActiveDoc
    if document is None:
        return 1.0e-3
    return document.ModelAbsoluteTolerance


def _point_key(point, tolerance):
    scale = 1.0 / max(tolerance, 1.0e-9)
    return (
        int(round(point.X * scale)),
        int(round(point.Y * scale)),
        int(round(point.Z * scale)),
    )


def _ordered_network(lines, tolerance):
    points = []
    key_to_index = {}
    indexed_edges = []
    seen_edges = set()

    def vertex_index(point):
        key = _point_key(point, tolerance)
        if key not in key_to_index:
            key_to_index[key] = len(points)
            points.append(rg.Point3d(point))
        return key_to_index[key]

    for line_index, line in enumerate(lines):
        if not line.IsValid or line.Length <= tolerance:
            raise ValueError(
                "InitialEdges contains an invalid line at index {0}."
                .format(line_index)
            )
        a = vertex_index(line.From)
        b = vertex_index(line.To)
        key = (min(a, b), max(a, b))
        if key in seen_edges:
            raise ValueError("InitialEdges contains a duplicate edge.")
        seen_edges.add(key)
        indexed_edges.append(key)
    return points, indexed_edges


def _radial_topology(points, edges):
    adjacency = [[] for _ in points]
    for edge_index, (a, b) in enumerate(edges):
        adjacency[a].append((b, edge_index))
        adjacency[b].append((a, edge_index))

    supports = [
        index for index, neighbours in enumerate(adjacency)
        if len(neighbours) == 1
    ]
    crowns = [
        index for index, neighbours in enumerate(adjacency)
        if len(neighbours) > 2
    ]
    if len(crowns) != 1:
        raise ValueError("Exactly one shared crown node is required.")
    if len(supports) < 3:
        raise ValueError("At least three support leaves are required.")
    if len(edges) != len(points) - 1:
        raise ValueError("The TNA network must be one radial tree.")

    crown = crowns[0]
    branches = []
    branch_edges = []
    for first, first_edge in adjacency[crown]:
        nodes = [crown, first]
        edge_indices = [first_edge]
        previous = crown
        current = first
        while current not in supports:
            following = [
                item for item in adjacency[current]
                if item[0] != previous
            ]
            if len(following) != 1:
                raise ValueError(
                    "Every crown-to-support path must be a simple chain."
                )
            next_node, next_edge = following[0]
            nodes.append(next_node)
            edge_indices.append(next_edge)
            previous, current = current, next_node
        branches.append(nodes)
        branch_edges.append(edge_indices)
    return crown, supports, branches, branch_edges


def _branch_directions(points, crown, branches):
    directions = []
    for branch in branches:
        point = points[branch[1]]
        dx = point.X - points[crown].X
        dy = point.Y - points[crown].Y
        length = math.sqrt(dx * dx + dy * dy)
        if length <= 1.0e-9:
            raise ValueError("A crown edge has zero plan length.")
        directions.append((dx / length, dy / length))
    return np.asarray(directions, dtype=float)


def _balanced_start(directions):
    count = len(directions)
    constraints = [
        {
            "type": "eq",
            "fun": lambda h: float(np.dot(h, directions[:, 0])),
        },
        {
            "type": "eq",
            "fun": lambda h: float(np.dot(h, directions[:, 1])),
        },
        {
            "type": "eq",
            "fun": lambda h: float(np.mean(h) - 1.0),
        },
    ]
    result = minimize(
        lambda h: float(np.sum((h - 1.0) ** 2)),
        np.ones(count),
        method="SLSQP",
        bounds=[
            (
                DEFAULT_MIN_HORIZONTAL_WEIGHT,
                DEFAULT_MAX_HORIZONTAL_WEIGHT,
            )
            for _ in range(count)
        ],
        constraints=constraints,
        options={"maxiter": 500, "ftol": 1.0e-12, "disp": False},
    )
    if not result.success:
        raise RuntimeError(
            "No positive horizontal crown equilibrium was found: {0}"
            .format(result.message)
        )
    return np.asarray(result.x, dtype=float), constraints


def _edge_force_densities(points, edges, branch_edges, weights):
    q = np.zeros(len(edges), dtype=float)
    for branch_index, edge_indices in enumerate(branch_edges):
        horizontal_force = weights[branch_index]
        for edge_index in edge_indices:
            a, b = edges[edge_index]
            dx = points[b].X - points[a].X
            dy = points[b].Y - points[a].Y
            plan_length = math.sqrt(dx * dx + dy * dy)
            if plan_length <= 1.0e-9:
                raise ValueError("A TNA edge has zero plan length.")
            q[edge_index] = -horizontal_force / plan_length
    return q


def _solve_vertical(points, edges, supports, crown, loads,
                    branch_edges, weights, target_crown):
    vertex_count = len(points)
    fixed = sorted(supports)
    fixed_set = set(fixed)
    free = [
        index for index in range(vertex_count)
        if index not in fixed_set
    ]
    C = connectivity_matrix(edges, rtype="csr")
    q0 = _edge_force_densities(
        points, edges, branch_edges, weights
    )
    Q0 = diags(q0)
    K0 = C.transpose().dot(Q0).dot(C)
    pz = np.asarray([load.Z for load in loads], dtype=float)
    Kff0 = K0[free, :][:, free]
    Kfc0 = K0[free, :][:, fixed]
    fixed_z = np.zeros(len(fixed), dtype=float)
    z0 = np.zeros(vertex_count, dtype=float)
    z0[free] = spsolve(
        Kff0, pz[free] - Kfc0.dot(fixed_z)
    )

    if z0[crown] <= 1.0e-9 or target_crown <= 1.0e-9:
        raise RuntimeError(
            "The compression solution produced no positive crown height."
        )
    scale = z0[crown] / target_crown
    q = q0 * scale
    Q = diags(q)
    K = C.transpose().dot(Q).dot(C)
    Kff = K[free, :][:, free]
    Kfc = K[free, :][:, fixed]
    z = np.zeros(vertex_count, dtype=float)
    z[free] = spsolve(Kff, pz[free] - Kfc.dot(fixed_z))
    return z, q, K, free, fixed, scale


def _optimise_shape(points, edges, supports, crown, branch_edges,
                    loads, initial_z, directions):
    start, constraints = _balanced_start(directions)
    target_crown = initial_z[crown]
    height_scale = max(target_crown, 1.0)

    def objective(weights):
        try:
            z = _solve_vertical(
                points,
                edges,
                supports,
                crown,
                loads,
                branch_edges,
                weights,
                target_crown,
            )[0]
        except Exception:
            return 1.0e12
        shape_error = np.mean(
            ((z - initial_z) / height_scale) ** 2
        )
        regularisation = 1.0e-4 * np.mean((weights - start) ** 2)
        return float(shape_error + regularisation)

    result = minimize(
        objective,
        start,
        method="SLSQP",
        bounds=[
            (
                DEFAULT_MIN_HORIZONTAL_WEIGHT,
                DEFAULT_MAX_HORIZONTAL_WEIGHT,
            )
            for _ in range(len(start))
        ],
        constraints=constraints,
        options={"maxiter": 600, "ftol": 1.0e-12, "disp": False},
    )
    weights = (
        np.asarray(result.x, dtype=float)
        if result.success
        else start
    )
    solution = _solve_vertical(
        points,
        edges,
        supports,
        crown,
        loads,
        branch_edges,
        weights,
        target_crown,
    )
    return weights, result, solution


def _containment(solid, points, edges, tolerance):
    outside = []
    outside_edge_indices = []
    for edge_index, (a, b) in enumerate(edges):
        start = points[a]
        end = points[b]
        for sample_index in range(DEFAULT_EDGE_SAMPLES + 1):
            fraction = (
                float(sample_index) / float(DEFAULT_EDGE_SAMPLES)
            )
            point = rg.Point3d(
                start.X + (end.X - start.X) * fraction,
                start.Y + (end.Y - start.Y) * fraction,
                start.Z + (end.Z - start.Z) * fraction,
            )
            if not solid.IsPointInside(point, tolerance, False):
                outside.append(point)
                outside_edge_indices.append(edge_index)
    sample_count = len(edges) * (DEFAULT_EDGE_SAMPLES + 1)
    return outside, outside_edge_indices, sample_count


def _make_baseline_advice(valid, compression_only, equilibrium,
                          outside_edge_indices, branch_edges):
    """Explain selected-network equilibrium and sampled containment only."""
    if valid:
        return (
            "SELECTED-NETWORK PASS: compression-only equilibrium is satisfied; "
            "the sampled points of every discrete TNA edge lie inside WholeSolid. "
            "This is sampled evidence, not continuous containment or structural safety. "
            "Actual joint pressure and sliding deficit require separate assessment."
        )

    messages = []
    if not equilibrium:
        messages.append(
            "STOP: the current network does not satisfy free-node "
            "equilibrium. Do not use it for segmentation. Revise the "
            "support layout, RotationAngles or network topology and rerun "
            "Stages 01-04."
        )
    if not compression_only:
        messages.append(
            "SELECTED-NETWORK COMPRESSION FAILURE: the current network "
            "contains tensile force. Omit downstream assessment for this candidate "
            "and return to designer revision. This does not rule out other networks."
        )
    if outside_edge_indices:
        edge_to_branch = {}
        for branch_index, edge_indices in enumerate(branch_edges):
            for edge_index in edge_indices:
                edge_to_branch[edge_index] = branch_index
        branch_counts = {}
        for edge_index in outside_edge_indices:
            branch_index = edge_to_branch.get(edge_index, -1)
            branch_counts[branch_index] = (
                branch_counts.get(branch_index, 0) + 1
            )
        affected = [
            branch_index + 1
            for branch_index, count in sorted(
                branch_counts.items(),
                key=lambda item: item[1],
                reverse=True,
            )
            if branch_index >= 0
        ]
        messages.append(
            "BASELINE CONTAINMENT WARNING: {0} sampled points leave "
            "WholeSolid; affected arch indices={1}. The equilibrium "
            "solution exists, but sampled containment of this selected network "
            "fails. Omit downstream results; the designer may revise H, Spans "
            "or CrownDepth and regenerate the complete candidate. This "
            "does not prove that no other admissible network exists.".format(
                len(outside_edge_indices), affected
            )
        )
    return " ".join(messages)


def _branch_polylines(points, branches):
    return [
        rg.PolylineCurve([points[index] for index in branch])
        for branch in branches
    ]


def create_tna_envelope_check(whole_solid, initial_edges, nodal_loads):
    lines = _as_list(initial_edges)
    loads = [rg.Vector3d(load) for load in _as_list(nodal_loads)]
    if whole_solid is None:
        raise ValueError("WholeSolid is required.")
    if not whole_solid.IsValid or not whole_solid.IsSolid:
        raise ValueError("WholeSolid must be one valid closed Brep.")
    if len(lines) < 3:
        raise ValueError("InitialEdges must contain a radial network.")

    tolerance = _document_tolerance()
    initial_points, indexed_edges = _ordered_network(
        lines, max(tolerance * 0.1, 1.0e-7)
    )
    if len(loads) != len(initial_points):
        raise ValueError(
            "NodalLoads count must match the unique InitialEdges nodes."
        )
    (
        crown,
        supports,
        branches,
        branch_edges,
    ) = _radial_topology(initial_points, indexed_edges)
    directions = _branch_directions(
        initial_points, crown, branches
    )
    initial_z = np.asarray(
        [point.Z for point in initial_points], dtype=float
    )
    weights, optimisation, solution = _optimise_shape(
        initial_points,
        indexed_edges,
        supports,
        crown,
        branch_edges,
        loads,
        initial_z,
        directions,
    )
    z, q, K, free, fixed, force_scale = solution

    xyz = np.asarray(
        [[point.X, point.Y, z[index]]
         for index, point in enumerate(initial_points)],
        dtype=float,
    )
    p = np.zeros((len(initial_points), 3), dtype=float)
    p[:, 2] = np.asarray([load.Z for load in loads], dtype=float)
    residuals = K.dot(xyz) - p
    free_residual = float(np.linalg.norm(residuals[free, :]))
    crown_residual = float(np.linalg.norm(residuals[crown, :]))
    tna_points = [
        rg.Point3d(row[0], row[1], row[2]) for row in xyz
    ]
    tna_edges = [
        rg.Line(tna_points[a], tna_points[b])
        for a, b in indexed_edges
    ]
    thrust_lines = _branch_polylines(tna_points, branches)
    (
        outside_points,
        outside_edge_indices,
        containment_samples,
    ) = _containment(
        whole_solid, tna_points, indexed_edges, tolerance
    )

    edge_forces = []
    for edge_index, (a, b) in enumerate(indexed_edges):
        length = tna_points[a].DistanceTo(tna_points[b])
        edge_forces.append(-q[edge_index] * length)
    compression_only = (
        all(value > DEFAULT_COMPRESSION_EPSILON for value in edge_forces)
        and all(value < -DEFAULT_COMPRESSION_EPSILON for value in q)
    )
    horizontal_balance = math.sqrt(
        float(np.dot(weights, directions[:, 0])) ** 2
        + float(np.dot(weights, directions[:, 1])) ** 2
    )
    inside = len(outside_points) == 0
    total_weight = -sum(load.Z for load in loads)
    residual_tolerance = max(
        DEFAULT_EQUILIBRIUM_TOLERANCE,
        total_weight * 1.0e-6,
    )
    equilibrium = (
        free_residual <= residual_tolerance
        and crown_residual <= residual_tolerance
        and horizontal_balance <= DEFAULT_EQUILIBRIUM_TOLERANCE
    )
    valid = compression_only and equilibrium and inside
    advice = _make_baseline_advice(
        valid,
        compression_only,
        equilibrium,
        outside_edge_indices,
        branch_edges,
    )
    reactions = [
        (
            round(float(residuals[index, 0]), 6),
            round(float(residuals[index, 1]), 6),
            round(float(residuals[index, 2]), 6),
        )
        for index in fixed
    ]
    report = (
        "engine=COMPAS_TNA_{0}_radial_graph_adapter; "
        "compas={1}; nodes={2}; edges={3}; arches={4}; "
        "supports={5}; crown={6}; real_nodal_loads=True; "
        "total_weight={7:.6g}kN; optimisation_success={8}; "
        "optimisation_iterations={9}; horizontal_weights={10}; "
        "force_scale={11:.6g}; min_compression={12:.6g}kN; "
        "max_compression={13:.6g}kN; compression_only={14}; "
        "horizontal_balance={15:.6g}; free_residual={16:.6g}; "
        "crown_residual={17:.6g}; centre_is_free=True; "
        "containment_samples={18}; outside_samples={19}; "
        "inside_whole_solid={20}; support_reactions_kN={21}; "
        "valid={22}"
    ).format(
        compas_tna.__version__,
        compas.__version__,
        len(tna_points),
        len(tna_edges),
        len(branches),
        supports,
        crown,
        total_weight,
        bool(optimisation.success),
        int(getattr(optimisation, "nit", 0)),
        [round(float(value), 6) for value in weights],
        force_scale,
        min(edge_forces),
        max(edge_forces),
        compression_only,
        horizontal_balance,
        free_residual,
        crown_residual,
        containment_samples,
        len(outside_points),
        inside,
        reactions,
        valid,
    )
    return (
        tna_edges,
        thrust_lines,
        outside_points,
        valid,
        report,
        advice,
    )


try:
    _component_inputs = (WholeSolid, InitialEdges, NodalLoads)
except NameError:
    _component_inputs = None

if _component_inputs is not None:
    TNAEdges, ThrustLines, OutsidePoints, Valid, Report, Advice = (
        create_tna_envelope_check(*_component_inputs)
    )
# ---------- end _04_压缩平衡与包含 ----------
_04_包含检查建议 = Panel(_04_压缩平衡与包含.Advice)

# ---- group: 05 实截面无拉核筛
_05_实截面无拉核筛_备注 = Panel("""在TNA边中点求真实截面及无拉核心SectionKerns。
输出逐边利用率，供06指导分块。
矩形单轴情况对应中三分之一规则。
ScreeningPass=False针对所选网络和全截面线性压力假设。
可继续部分接触/滑移诊断，但不证明先前核筛失败被修复。
不作销栓需求判断。""")
_05_实截面无拉核筛 = Python3Script(WholeSolid=_01_参数化几何.WholeSolid, TNAEdges=_04_压缩平衡与包含.TNAEdges)  # -> out, SectionKerns, CriticalPoints, Utilisations, ScreeningPass, Report, Advice; inputs WholeSolid: Brep, TNAEdges: list of Line
# ---------- _05_实截面无拉核筛: Python ----------
#! python 3
"""Stage 05 - no-tension section-kern check for the TNA network.

Grasshopper Python inputs:
    WholeSolid  Brep        WholeSolid from 01_ParametricGeometry (Item)
    TNAEdges    list[Line]  TNAEdges from 04_TNAEnvelopeCheck (List)

Outputs:
    SectionKerns, CriticalPoints, Utilisations, ScreeningPass, Report, Advice

At the midpoint of every TNA edge, the actual solid is cut by a plane normal
to that edge. The planar section containing the thrust point is sampled and
its exact linear-elastic no-tension kern is constructed numerically. For a
rectangular section under one-axis eccentricity this reduces to the familiar
middle-third rule. In 3D it is intentionally not replaced by an arbitrary
pipe radius.

This is a pre-segmentation screening check, not a final structural pass/fail.
Utilisations correspond one-to-one with TNAEdges. Values above 1 identify
locations that should not be treated as unreinforced dry joints. Stone
strength, exact block weights, joint friction, local crushing, pins and
construction sequence are checked only after the cutting planes exist.
"""

import math

import Rhino
import Rhino.Geometry as rg


BOUNDARY_SAMPLES = 96
MOMENT_EPSILON = 1.0e-12
STRESS_TOLERANCE = 1.0e-7


def _as_list(value):
    if value is None:
        return []
    try:
        return list(value)
    except TypeError:
        return [value]


def _document_tolerance():
    document = Rhino.RhinoDoc.ActiveDoc
    if document is None:
        return 1.0e-3
    return document.ModelAbsoluteTolerance


def _coerce_brep(value):
    if isinstance(value, rg.Brep):
        return value
    if hasattr(value, "Value") and isinstance(value.Value, rg.Brep):
        return value.Value
    return None


def _coerce_line(value):
    if isinstance(value, rg.Line):
        return rg.Line(value.From, value.To)
    if isinstance(value, rg.LineCurve):
        return rg.Line(value.PointAtStart, value.PointAtEnd)
    if hasattr(value, "Value"):
        return _coerce_line(value.Value)
    return None


def _point_key(point, tolerance):
    scale = 1.0 / max(tolerance, 1.0e-9)
    return (
        int(round(point.X * scale)),
        int(round(point.Y * scale)),
        int(round(point.Z * scale)),
    )


def _edge_branch_indices(lines, tolerance):
    key_to_index = {}
    indexed_edges = []
    for line in lines:
        indices = []
        for point in (line.From, line.To):
            key = _point_key(point, tolerance)
            if key not in key_to_index:
                key_to_index[key] = len(key_to_index)
            indices.append(key_to_index[key])
        indexed_edges.append(tuple(indices))

    adjacency = [[] for _ in range(len(key_to_index))]
    for edge_index, (a, b) in enumerate(indexed_edges):
        adjacency[a].append((b, edge_index))
        adjacency[b].append((a, edge_index))
    crown = max(
        range(len(adjacency)),
        key=lambda index: len(adjacency[index]),
    )
    edge_to_branch = {}
    for branch_index, (neighbour, first_edge) in enumerate(
        adjacency[crown]
    ):
        previous = crown
        current = neighbour
        edge_to_branch[first_edge] = branch_index
        while current != crown and len(adjacency[current]) == 2:
            next_items = [
                item for item in adjacency[current]
                if item[0] != previous
            ]
            if not next_items:
                break
            next_node, next_edge = next_items[0]
            edge_to_branch[next_edge] = branch_index
            previous, current = current, next_node
    return [
        edge_to_branch.get(edge_index, -1)
        for edge_index in range(len(lines))
    ]


def _section_plane(line):
    midpoint = line.PointAt(0.5)
    normal = rg.Vector3d(line.Direction)
    if not normal.Unitize():
        raise RuntimeError("A TNA edge has zero length.")
    reference = rg.Vector3d.ZAxis
    if abs(rg.Vector3d.Multiply(normal, reference)) > 0.92:
        reference = rg.Vector3d.XAxis
    x_axis = rg.Vector3d.CrossProduct(reference, normal)
    if not x_axis.Unitize():
        raise RuntimeError("Could not construct a section plane.")
    y_axis = rg.Vector3d.CrossProduct(normal, x_axis)
    if not y_axis.Unitize():
        raise RuntimeError("Could not construct a section plane.")
    return midpoint, rg.Plane(midpoint, x_axis, y_axis)


def _joined_section_curves(solid, plane, tolerance):
    result = rg.Intersect.Intersection.BrepPlane(
        solid, plane, tolerance
    )
    if not result or not result[0]:
        return []
    raw_curves = list(result[1]) if result[1] else []
    joined = list(rg.Curve.JoinCurves(raw_curves, tolerance))
    return [
        curve for curve in joined
        if curve is not None and curve.IsValid and curve.IsClosed
    ]


def _curve_area(curve):
    properties = rg.AreaMassProperties.Compute(curve)
    if properties is None:
        return 0.0
    area = abs(properties.Area)
    properties.Dispose()
    return area


def _containing_section(curves, point, plane, tolerance):
    containing = []
    for curve in curves:
        status = curve.Contains(point, plane, tolerance)
        if status in (
            rg.PointContainment.Inside,
            rg.PointContainment.Coincident,
        ):
            containing.append(curve)
    if not containing:
        for curve in curves:
            curve.Dispose()
        raise RuntimeError(
            "No section containing the thrust point was found."
        )
    section = max(containing, key=_curve_area)
    for curve in curves:
        if curve is not section:
            curve.Dispose()
    return section


def _plane_coordinates(point, plane):
    vector = point - plane.Origin
    return (
        rg.Vector3d.Multiply(vector, plane.XAxis),
        rg.Vector3d.Multiply(vector, plane.YAxis),
    )


def _world_point(plane, x, y):
    return (
        plane.Origin
        + plane.XAxis * x
        + plane.YAxis * y
    )


def _sample_closed_curve(curve):
    parameters = curve.DivideByCount(BOUNDARY_SAMPLES, False)
    if not parameters:
        return []
    return [curve.PointAt(parameter) for parameter in parameters]


def _signed_area_and_centroid(points):
    twice_area = 0.0
    centroid_x = 0.0
    centroid_y = 0.0
    for index, point in enumerate(points):
        next_point = points[(index + 1) % len(points)]
        cross = (
            point[0] * next_point[1]
            - next_point[0] * point[1]
        )
        twice_area += cross
        centroid_x += (point[0] + next_point[0]) * cross
        centroid_y += (point[1] + next_point[1]) * cross
    area = 0.5 * twice_area
    if abs(area) <= MOMENT_EPSILON:
        raise RuntimeError("A sampled section has zero area.")
    centroid_x /= 6.0 * area
    centroid_y /= 6.0 * area
    return area, (centroid_x, centroid_y)


def _section_moments(points):
    area, centroid = _signed_area_and_centroid(points)
    if area < 0.0:
        points = list(reversed(points))
        area, centroid = _signed_area_and_centroid(points)
    centered = [
        (point[0] - centroid[0], point[1] - centroid[1])
        for point in points
    ]
    second_x = 0.0
    second_y = 0.0
    product = 0.0
    for index, point in enumerate(centered):
        next_point = centered[(index + 1) % len(centered)]
        cross = (
            point[0] * next_point[1]
            - next_point[0] * point[1]
        )
        second_x += (
            point[0] * point[0]
            + point[0] * next_point[0]
            + next_point[0] * next_point[0]
        ) * cross
        second_y += (
            point[1] * point[1]
            + point[1] * next_point[1]
            + next_point[1] * next_point[1]
        ) * cross
        product += (
            2.0 * point[0] * point[1]
            + point[0] * next_point[1]
            + next_point[0] * point[1]
            + 2.0 * next_point[0] * next_point[1]
        ) * cross
    second_x /= 12.0
    second_y /= 12.0
    product /= 24.0
    determinant = second_x * second_y - product * product
    if determinant <= MOMENT_EPSILON:
        raise RuntimeError("A sampled section has singular area moments.")
    return area, centroid, centered, second_x, second_y, product


def _inverse_moment_action(x, y, second_x, second_y, product):
    determinant = second_x * second_y - product * product
    return (
        (second_y * x - product * y) / determinant,
        (-product * x + second_x * y) / determinant,
    )


def _clip_half_plane(polygon, normal_x, normal_y, limit):
    if not polygon:
        return []
    clipped = []
    for index, start in enumerate(polygon):
        end = polygon[(index + 1) % len(polygon)]
        start_value = normal_x * start[0] + normal_y * start[1]
        end_value = normal_x * end[0] + normal_y * end[1]
        start_inside = start_value >= limit - 1.0e-12
        end_inside = end_value >= limit - 1.0e-12
        if start_inside:
            clipped.append(start)
        if start_inside != end_inside:
            denominator = end_value - start_value
            if abs(denominator) > 1.0e-15:
                factor = (limit - start_value) / denominator
                clipped.append(
                    (
                        start[0] + factor * (end[0] - start[0]),
                        start[1] + factor * (end[1] - start[1]),
                    )
                )
    return clipped


def _clean_polygon(polygon, tolerance):
    """Remove repeated and collinear vertices created by repeated clipping."""
    if not polygon:
        return []
    cleaned = []
    for point in polygon:
        if not cleaned:
            cleaned.append(point)
            continue
        distance = math.hypot(
            point[0] - cleaned[-1][0],
            point[1] - cleaned[-1][1],
        )
        if distance > tolerance:
            cleaned.append(point)
    if (
        len(cleaned) > 1
        and math.hypot(
            cleaned[0][0] - cleaned[-1][0],
            cleaned[0][1] - cleaned[-1][1],
        ) <= tolerance
    ):
        cleaned.pop()

    changed = True
    while changed and len(cleaned) >= 3:
        changed = False
        reduced = []
        count = len(cleaned)
        for index, point in enumerate(cleaned):
            previous = cleaned[(index - 1) % count]
            following = cleaned[(index + 1) % count]
            first_x = point[0] - previous[0]
            first_y = point[1] - previous[1]
            second_x = following[0] - point[0]
            second_y = following[1] - point[1]
            first_length = math.hypot(first_x, first_y)
            second_length = math.hypot(second_x, second_y)
            if first_length <= tolerance or second_length <= tolerance:
                changed = True
                continue
            cross = abs(first_x * second_y - first_y * second_x)
            if cross <= tolerance * (first_length + second_length):
                changed = True
                continue
            reduced.append(point)
        if len(reduced) < 3:
            break
        cleaned = reduced
    return cleaned


def _kern_polygon(area, boundary, second_x, second_y, product):
    extent = max(
        max(math.hypot(point[0], point[1]) for point in boundary),
        1.0e-6,
    )
    polygon = [
        (-2.0 * extent, -2.0 * extent),
        (2.0 * extent, -2.0 * extent),
        (2.0 * extent, 2.0 * extent),
        (-2.0 * extent, 2.0 * extent),
    ]
    limit = -1.0 / area
    cleanup_tolerance = max(extent * 1.0e-9, 1.0e-12)
    for point in boundary:
        normal_x, normal_y = _inverse_moment_action(
            point[0],
            point[1],
            second_x,
            second_y,
            product,
        )
        polygon = _clip_half_plane(
            polygon, normal_x, normal_y, limit
        )
        polygon = _clean_polygon(polygon, cleanup_tolerance)
        if len(polygon) < 3:
            return []
    return _clean_polygon(polygon, cleanup_tolerance)


def _section_check(solid, line, tolerance):
    thrust_point, plane = _section_plane(line)
    section_curves = _joined_section_curves(
        solid, plane, tolerance
    )
    section = _containing_section(
        section_curves, thrust_point, plane, tolerance
    )
    world_boundary = _sample_closed_curve(section)
    if len(world_boundary) < 8:
        raise RuntimeError("The solid section could not be sampled.")
    local_boundary = [
        _plane_coordinates(point, plane)
        for point in world_boundary
    ]
    (
        area,
        centroid,
        centered_boundary,
        second_x,
        second_y,
        product,
    ) = _section_moments(local_boundary)
    thrust_local = _plane_coordinates(thrust_point, plane)
    eccentricity = (
        thrust_local[0] - centroid[0],
        thrust_local[1] - centroid[1],
    )
    coefficient = _inverse_moment_action(
        eccentricity[0],
        eccentricity[1],
        second_x,
        second_y,
        product,
    )
    minimum_term = min(
        coefficient[0] * point[0] + coefficient[1] * point[1]
        for point in centered_boundary
    )
    utilisation = max(0.0, -area * minimum_term)
    passed = utilisation <= 1.0 + STRESS_TOLERANCE
    kern = _kern_polygon(
        area,
        centered_boundary,
        second_x,
        second_y,
        product,
    )
    if len(kern) < 3:
        section.Dispose()
        raise RuntimeError(
            "The calculated section kern polygon is empty."
        )
    kern_points = [
        _world_point(
            plane,
            centroid[0] + point[0],
            centroid[1] + point[1],
        )
        for point in kern
    ]
    kern_points.append(kern_points[0])
    kern_curve = rg.PolylineCurve(kern_points)
    if not kern_curve.IsValid or not kern_curve.IsClosed:
        section.Dispose()
        raise RuntimeError(
            "The calculated section kern curve is invalid."
        )
    section.Dispose()
    return passed, utilisation, kern_curve, thrust_point, area


def create_section_kern_check(whole_solid, tna_edges):
    solid = _coerce_brep(whole_solid)
    lines = []
    for edge_index, value in enumerate(_as_list(tna_edges)):
        line = _coerce_line(value)
        if line is None or not line.IsValid or line.Length <= 0.0:
            raise ValueError(
                "TNAEdges contains an invalid line at index {0}."
                .format(edge_index)
            )
        lines.append(line)
    if solid is None or not solid.IsValid or not solid.IsSolid:
        raise ValueError("WholeSolid must be one valid closed Brep.")
    if not lines:
        raise ValueError("TNAEdges must contain valid lines.")

    tolerance = _document_tolerance()
    branches = _edge_branch_indices(
        lines, max(tolerance * 0.1, 1.0e-7)
    )
    safety_zones = []
    critical_points = []
    failures = []
    missing_sections = []
    utilisations = [None for line in lines]
    areas = []

    for edge_index, line in enumerate(lines):
        try:
            (
                passed,
                utilisation,
                kern_curve,
                thrust_point,
                area,
            ) = _section_check(solid, line, tolerance)
            if kern_curve is not None:
                safety_zones.append(kern_curve)
            utilisations[edge_index] = utilisation
            areas.append(area)
            if not passed:
                critical_points.append(thrust_point)
                failures.append(
                    (edge_index, branches[edge_index], utilisation)
                )
        except Exception as error:
            missing_sections.append((edge_index, str(error)))
            critical_points.append(line.PointAt(0.5))

    screening_pass = (
        len(safety_zones) == len(lines)
        and not failures
        and not missing_sections
    )
    evaluated_utilisations = [
        value for value in utilisations if value is not None
    ]
    worst_utilisation = (
        max(evaluated_utilisations)
        if evaluated_utilisations
        else float("inf")
    )
    branch_worst = {}
    for edge_index, branch_index, utilisation in failures:
        branch_worst[branch_index] = max(
            branch_worst.get(branch_index, 0.0), utilisation
        )
    ranked_branches = [
        branch + 1 for branch, value in sorted(
            branch_worst.items(),
            key=lambda item: item[1],
            reverse=True,
        )
        if branch >= 0
    ]

    if screening_pass:
        advice = (
            "PRE-SEGMENTATION PASS: every sampled baseline thrust "
            "resultant lies inside the actual section kern. Joints may be "
            "placed near these stations, but actual-joint pressure and sliding "
            "require separate assessment; block equilibrium is not established."
        )
    elif missing_sections:
        advice = (
            "PRE-SEGMENTATION DATA ERROR: section construction failed at "
            "{0} stations. Confirm that "
            "WholeSolid is one closed union and TNAEdges comes directly "
            "from Stage 04.".format(len(missing_sections))
        )
    else:
        advice = (
            "PRE-SEGMENTATION WARNING: {0} sampled stations lie outside "
            "the no-tension kern; affected arch indices={1}. This does "
            "not reject all networks or force states. The failed screen concerns "
            "this selected network under the linear full-section pressure assumption. "
            "Stage 06 selects cutting planes; partial-contact and sliding-deficit "
            "assessment may proceed without claiming to repair this screen failure.".format(
                len(failures), ranked_branches
            )
        )

    report = (
        "stage=pre_segmentation_screening; "
        "criterion=actual_section_no_tension_kern; "
        "rectangular_uniaxial_equivalent=middle_third; edges={0}; "
        "sections_evaluated={1}; safety_zones={2}; failed_sections={3}; "
        "missing_sections={4}; worst_utilisation={5:.6g}; "
        "limit=1; min_section_area={6:.6g}; max_section_area={7:.6g}; "
        "affected_arches={8}; screening_pass={9}; "
        "final_structural_validity=not_evaluated"
    ).format(
        len(lines),
        len(evaluated_utilisations),
        len(safety_zones),
        len(failures),
        len(missing_sections),
        worst_utilisation,
        min(areas) if areas else 0.0,
        max(areas) if areas else 0.0,
        ranked_branches,
        screening_pass,
    )
    return (
        safety_zones,
        critical_points,
        utilisations,
        screening_pass,
        report,
        advice,
    )


try:
    _component_inputs = (WholeSolid, TNAEdges)
except NameError:
    _component_inputs = None

if _component_inputs is not None:
    (
        SectionKerns,
        CriticalPoints,
        Utilisations,
        ScreeningPass,
        Report,
        Advice,
    ) = (
        create_section_kern_check(*_component_inputs)
    )
# ---------- end _05_实截面无拉核筛 ----------
_05_核筛建议 = Panel(_05_实截面无拉核筛.Advice)

# ---- group: 06 引导径向分块
# 06 引导径向分块｜备注: 根据截面利用率布置TNA法向切割面。
# 保留一个连通冠块，检查闭合实体与体积守恒。
# 近冠总体较小、外段总体较大，可局部非单调。
# 目标块长用于估计数量，不是块长上限。
# 输出块体、实际接缝及ID，供07A－07F使用。
# 失败应报告，不以放宽检查强行生成。
targetblocklength_目标长_m = Slider(1.4, range=0..10)
_06_引导径向分块 = Python3Script(
    WholeSolid=_01_参数化几何.WholeSolid,
    TNAEdges=_04_压缩平衡与包含.TNAEdges,
    Utilisations=_05_实截面无拉核筛.Utilisations,
    TargetBlockLength=targetblocklength_目标长_m,
    CrownBlockRadius=crownblockradius_冠半径_m,
    TopSlopePercent=topslopepercent_坡度)  # -> out, Blocks, JointPlanes, JointProfiles, BlockIDs, BlockVolumes, Valid, Report; inputs WholeSolid: Brep, TNAEdges: list of Line, Utilisations: list of Double, TargetBlockLength: Double, CrownBlockRadius: Double, TopSlopePercent: Double
# ---------- _06_引导径向分块: Python ----------
#! python 3
"""Stage 06 - utilisation-guided radially graded stone segmentation.

Grasshopper Python inputs:
    WholeSolid         Brep         WholeSolid from Stage 01 (Item)
    TNAEdges           list[Line]   TNAEdges from Stage 04 (List)
    Utilisations       list[float]  Utilisations from Stage 05 (List)
    TargetBlockLength  float        Desired block length (Item)
    CrownBlockRadius   float        Minimum crown-block plan radius (Item)
    TopSlopePercent    float        Optional Stage 01 top slope (Item)

Unconnected numeric inputs use their defaults.

Outputs:
    Blocks, JointPlanes, JointProfiles, BlockIDs, Valid, Report

The radial TNA graph is reconstructed from TNAEdges. TargetBlockLength controls
only the approximate number of blocks. Integrated section volume is then
distributed with increasing crown-to-support weights, so blocks near the
centre are generally smaller and blocks toward the supports are generally
larger. Internal stations may shift locally toward lower Stage-05 utilisation.
Every cutting plane is normal to the local thrust direction. One connected
central crown block is retained; all remaining pieces are ordered by arch and
crown-to-support position. At zero or empty TopSlopePercent the historical
CrownBlockRadius branch-length rule is retained. At a positive slope, the
first TNA-normal joint is moved inward until its trace on the highest horizontal
top plane reaches, or conservatively stays just inside, that plan radius. This
keeps the whole centre block under the Stage 01 horizontal cap while retaining
a local discrete-TNA-normal joint; no downstream output is fed back to Stage 01.

This stage creates geometry only. Exact block weights, contact resultants,
joint opening, partial-contact pressure and sliding deficit are evaluated after
segmentation. No connector sizing or engineering strength verdict is reported.
"""

import math

import Rhino
import Rhino.Geometry as rg


DEFAULT_TARGET_BLOCK_LENGTH = 1.40
DEFAULT_CROWN_BLOCK_RADIUS = 1.60
DEFAULT_TOP_SLOPE_PERCENT = 0.0
MAX_TOP_SLOPE_PERCENT = 5.0
MAX_BLOCKS_PER_ARCH = 30
STATION_SEARCH_SAMPLES = 17
DISTANCE_PENALTY = 0.20
INNER_VOLUME_WEIGHT = 0.60
OUTER_VOLUME_WEIGHT = 1.40
JOINT_PROFILE_MATCH_SAMPLES = 24


def _as_list(value):
    if value is None:
        return []
    try:
        return list(value)
    except TypeError:
        return [value]


def _document_tolerance():
    document = Rhino.RhinoDoc.ActiveDoc
    if document is None:
        return 1.0e-3
    return document.ModelAbsoluteTolerance


def _coerce_brep(value):
    if isinstance(value, rg.Brep):
        return value
    if hasattr(value, "Value") and isinstance(value.Value, rg.Brep):
        return value.Value
    return None


def _coerce_line(value):
    if isinstance(value, rg.Line):
        return rg.Line(value.From, value.To)
    if isinstance(value, rg.LineCurve):
        return rg.Line(value.PointAtStart, value.PointAtEnd)
    if hasattr(value, "Value"):
        return _coerce_line(value.Value)
    return None


def _optional_positive(value, default, name):
    if value is None:
        return default
    try:
        number = float(value)
    except (TypeError, ValueError):
        return default
    if number <= 0.0:
        raise ValueError("{0} must be positive.".format(name))
    return number


def _point_key(point, tolerance):
    scale = 1.0 / max(tolerance, 1.0e-9)
    return (
        int(round(point.X * scale)),
        int(round(point.Y * scale)),
        int(round(point.Z * scale)),
    )


def _radial_network(lines, tolerance):
    points = []
    key_to_index = {}
    edge_count = 0
    adjacency = []

    for line in lines:
        indices = []
        for point in (line.From, line.To):
            key = _point_key(point, tolerance)
            if key not in key_to_index:
                key_to_index[key] = len(points)
                points.append(rg.Point3d(point))
                adjacency.append([])
            indices.append(key_to_index[key])
        edge_index = edge_count
        a, b = indices
        adjacency[a].append((b, edge_index))
        adjacency[b].append((a, edge_index))
        edge_count += 1

    crown_candidates = [
        index for index, neighbours in enumerate(adjacency)
        if len(neighbours) > 2
    ]
    if len(crown_candidates) != 1:
        raise ValueError(
            "TNAEdges must contain one radial crown node."
        )
    crown = crown_candidates[0]
    branches = []
    branch_edges = []
    for neighbour, first_edge in adjacency[crown]:
        nodes = [crown, neighbour]
        edges = [first_edge]
        previous = crown
        current = neighbour
        visited = {first_edge}
        while len(adjacency[current]) == 2:
            next_items = [
                item for item in adjacency[current]
                if item[0] != previous
                and item[1] not in visited
            ]
            if not next_items:
                break
            next_node, next_edge = next_items[0]
            nodes.append(next_node)
            edges.append(next_edge)
            visited.add(next_edge)
            previous, current = current, next_node
        if len(adjacency[current]) != 1:
            raise ValueError(
                "Every radial branch must terminate at one leaf support."
            )
        branches.append(nodes)
        branch_edges.append(edges)

    if sum(len(edges) for edges in branch_edges) != edge_count:
        raise ValueError("Some TNAEdges do not belong to a radial branch.")
    return points, crown, branches, branch_edges


def _branch_data(points, branch_nodes, branch_edge_indices,
                 utilisations):
    branch_points = [points[index] for index in branch_nodes]
    lengths = []
    cumulative = [0.0]
    for start, end in zip(branch_points[:-1], branch_points[1:]):
        length = start.DistanceTo(end)
        if length <= 1.0e-9:
            raise ValueError("A branch contains a zero-length edge.")
        lengths.append(length)
        cumulative.append(cumulative[-1] + length)
    branch_utilisations = [
        utilisations[index] for index in branch_edge_indices
    ]
    return (
        branch_points,
        lengths,
        cumulative,
        branch_utilisations,
    )


def _edge_at_distance(cumulative, distance):
    if distance <= cumulative[0]:
        return 0
    for index in range(len(cumulative) - 1):
        if distance <= cumulative[index + 1] + 1.0e-12:
            return index
    return len(cumulative) - 2


def _point_tangent_at_distance(branch_points, lengths, cumulative,
                               distance):
    total = cumulative[-1]
    distance = min(max(distance, 0.0), total)
    edge_index = _edge_at_distance(cumulative, distance)
    local = (
        (distance - cumulative[edge_index]) / lengths[edge_index]
    )
    start = branch_points[edge_index]
    end = branch_points[edge_index + 1]
    point = rg.Point3d(
        start.X + (end.X - start.X) * local,
        start.Y + (end.Y - start.Y) * local,
        start.Z + (end.Z - start.Z) * local,
    )
    tangent = rg.Vector3d(
        end.X - start.X,
        end.Y - start.Y,
        end.Z - start.Z,
    )
    if not tangent.Unitize():
        raise RuntimeError("Could not evaluate a branch tangent.")
    return point, tangent


def _utilisation_at_distance(cumulative, branch_utilisations, distance):
    edge_index = _edge_at_distance(cumulative, distance)
    return branch_utilisations[edge_index]


def _desired_stations(total_length, target_length, first_station,
                      apply_target_floor):
    minimum_tail = max(0.35 * target_length, 1.0e-3)
    first = (
        max(first_station, 0.45 * target_length)
        if apply_target_floor
        else first_station
    )
    if first <= 0.0 or first >= total_length - minimum_tail:
        raise ValueError(
            "CrownBlockRadius leaves no length for outer stone blocks."
        )
    outer_length = total_length - first
    block_count = max(
        1,
        int(math.floor(outer_length / target_length + 0.5)),
    )
    block_count = min(block_count, MAX_BLOCKS_PER_ARCH)
    return first, block_count


def _optimised_stations(desired, total_length, target_length,
                        cumulative, branch_utilisations,
                        minimum_first_station):
    selected = []
    for index, target in enumerate(desired):
        if index == 0:
            selected.append(target)
            continue
        previous_target = desired[index - 1]
        next_target = (
            total_length
            if index == len(desired) - 1
            else desired[index + 1]
        )
        local_gap = min(
            target - previous_target,
            next_target - target,
        )
        search_radius = max(0.0, 0.22 * local_gap)
        lower = max(
            target - search_radius,
            minimum_first_station,
        )
        upper = min(target + search_radius, total_length)
        best = None
        for sample_index in range(STATION_SEARCH_SAMPLES):
            fraction = (
                float(sample_index)
                / float(STATION_SEARCH_SAMPLES - 1)
            )
            distance = lower + (upper - lower) * fraction
            utilisation = _utilisation_at_distance(
                cumulative, branch_utilisations, distance
            )
            score = (
                utilisation
                + DISTANCE_PENALTY
                * abs(distance - target)
                / max(target_length, 1.0e-9)
            )
            candidate = (score, distance)
            if best is None or candidate < best:
                best = candidate
        selected.append(best[1])
    return selected


def _section_plane(origin, tangent, crown, support):
    radial = rg.Vector3d(
        support.X - crown.X,
        support.Y - crown.Y,
        0.0,
    )
    if not radial.Unitize():
        raise RuntimeError("A branch has no plan direction.")
    transverse = rg.Vector3d(-radial.Y, radial.X, 0.0)
    normal = rg.Vector3d(tangent)
    normal -= transverse * rg.Vector3d.Multiply(normal, transverse)
    if not normal.Unitize():
        raise RuntimeError("A joint normal could not be evaluated.")
    in_plane = rg.Vector3d.CrossProduct(normal, transverse)
    if not in_plane.Unitize():
        raise RuntimeError("A joint plane could not be constructed.")
    plane = rg.Plane(origin, transverse, in_plane)
    if not plane.IsValid:
        raise RuntimeError("A generated joint plane is invalid.")
    angle = rg.Vector3d.VectorAngle(plane.ZAxis, tangent)
    angle = min(angle, abs(math.pi - angle))
    return plane, math.degrees(angle)


def _plan_radial_coordinate(point, crown, support):
    radial = rg.Vector3d(
        support.X - crown.X,
        support.Y - crown.Y,
        0.0,
    )
    if not radial.Unitize():
        raise RuntimeError("A branch has no plan direction.")
    offset = rg.Vector3d(
        point.X - crown.X,
        point.Y - crown.Y,
        0.0,
    )
    return rg.Vector3d.Multiply(offset, radial)


def _joint_top_trace_radius(point, tangent, crown, support,
                            top_elevation):
    plane, _ = _section_plane(point, tangent, crown, support)
    radial = rg.Vector3d(
        support.X - crown.X,
        support.Y - crown.Y,
        0.0,
    )
    if not radial.Unitize():
        raise RuntimeError("A branch has no plan direction.")
    radial_normal = rg.Vector3d.Multiply(plane.Normal, radial)
    if abs(radial_normal) <= 1.0e-12:
        raise RuntimeError(
            "A TNA-normal joint does not intersect the crown top in a "
            "stable radial direction."
        )
    axis_radius = _plan_radial_coordinate(point, crown, support)
    return (
        axis_radius
        - plane.Normal.Z
        * (top_elevation - point.Z)
        / radial_normal
    )


def _first_station_for_top_trace(
    branch_points,
    lengths,
    cumulative,
    crown_radius,
    top_elevation,
    tolerance,
):
    crown = branch_points[0]
    support = branch_points[-1]
    radial_support = _plan_radial_coordinate(support, crown, support)
    if crown_radius >= radial_support - tolerance:
        raise ValueError(
            "CrownBlockRadius must be smaller than every support plan radius."
        )

    root_tolerance = max(tolerance * 0.25, 1.0e-8)
    edge_nudge = max(tolerance * 0.05, 1.0e-8)
    best_inside = None
    for edge_index, edge_length in enumerate(lengths):
        lower = cumulative[edge_index]
        upper = cumulative[edge_index + 1]
        if edge_index > 0:
            lower = min(upper, lower + edge_nudge)
        lower_point, lower_tangent = _point_tangent_at_distance(
            branch_points, lengths, cumulative, lower
        )
        upper_point, upper_tangent = _point_tangent_at_distance(
            branch_points, lengths, cumulative, upper
        )
        lower_value = _joint_top_trace_radius(
            lower_point,
            lower_tangent,
            crown,
            support,
            top_elevation,
        ) - crown_radius
        upper_value = _joint_top_trace_radius(
            upper_point,
            upper_tangent,
            crown,
            support,
            top_elevation,
        ) - crown_radius

        for candidate_distance, candidate_value in (
            (lower, lower_value),
            (upper, upper_value),
        ):
            if candidate_value <= root_tolerance:
                candidate = (
                    abs(candidate_value),
                    -candidate_distance,
                    candidate_distance,
                )
                if best_inside is None or candidate < best_inside:
                    best_inside = candidate

        if abs(lower_value) <= root_tolerance:
            station = lower
        elif abs(upper_value) <= root_tolerance:
            station = upper
        elif lower_value * upper_value > 0.0:
            continue
        else:
            left = lower
            right = upper
            left_value = lower_value
            for _iteration in range(64):
                middle = 0.5 * (left + right)
                point, tangent = _point_tangent_at_distance(
                    branch_points, lengths, cumulative, middle
                )
                middle_value = _joint_top_trace_radius(
                    point,
                    tangent,
                    crown,
                    support,
                    top_elevation,
                ) - crown_radius
                if abs(middle_value) <= root_tolerance:
                    left = right = middle
                    break
                if left_value * middle_value <= 0.0:
                    right = middle
                else:
                    left = middle
                    left_value = middle_value
            station = 0.5 * (left + right)

        if station <= max(tolerance * 10.0, 1.0e-6):
            raise ValueError(
                "CrownBlockRadius leaves no positive TNA-normal crown joint."
            )
        point, tangent = _point_tangent_at_distance(
            branch_points, lengths, cumulative, station
        )
        achieved = _joint_top_trace_radius(
            point,
            tangent,
            crown,
            support,
            top_elevation,
        )
        if abs(achieved - crown_radius) <= max(tolerance, 1.0e-7):
            return station

    if best_inside is not None:
        station = best_inside[2]
        if station > max(tolerance * 10.0, 1.0e-6):
            return station

    raise ValueError(
        "No TNA-normal first joint can keep its crown-top trace at or "
        "inside CrownBlockRadius for this branch."
    )


def _section_curves(solid, plane, tolerance):
    result = rg.Intersect.Intersection.BrepPlane(
        solid, plane, tolerance
    )
    if not result or not result[0]:
        return []
    raw_curves = list(result[1]) if result[1] else []
    return [
        curve for curve in rg.Curve.JoinCurves(raw_curves, tolerance)
        if curve is not None and curve.IsValid and curve.IsClosed
    ]


def _curve_area(curve):
    properties = rg.AreaMassProperties.Compute(curve)
    if properties is None:
        return 0.0
    area = abs(properties.Area)
    properties.Dispose()
    return area


def _containing_profile(curves, point, plane, tolerance):
    containing = []
    for curve in curves:
        status = curve.Contains(point, plane, tolerance)
        if status in (
            rg.PointContainment.Inside,
            rg.PointContainment.Coincident,
        ):
            containing.append(curve)
    if not containing:
        for curve in curves:
            curve.Dispose()
        raise RuntimeError(
            "No joint profile containing the TNA station was found."
        )
    profile = max(containing, key=_curve_area)
    for curve in curves:
        if curve is not profile:
            curve.Dispose()
    return profile


def _distance_at_accumulated_value(distances, accumulated, target):
    if target <= accumulated[0]:
        return distances[0]
    for index in range(len(accumulated) - 1):
        upper = accumulated[index + 1]
        if target <= upper + 1.0e-12:
            lower = accumulated[index]
            interval = upper - lower
            if interval <= 1.0e-12:
                return distances[index]
            fraction = (target - lower) / interval
            return (
                distances[index]
                + (distances[index + 1] - distances[index])
                * fraction
            )
    return distances[-1]


def _graded_volume_stations(
    solid,
    branch_points,
    lengths,
    cumulative,
    target_length,
    crown_radius,
    top_elevation,
    tolerance,
    align_plan_radius,
):
    crown = branch_points[0]
    plan_radii = [
        math.hypot(point.X - crown.X, point.Y - crown.Y)
        for point in branch_points
    ]
    if any(
        plan_radii[index + 1] <= plan_radii[index] + tolerance
        for index in range(len(plan_radii) - 1)
    ):
        raise ValueError(
            "A branch must move monotonically outward in plan."
        )
    if align_plan_radius:
        first_station = _first_station_for_top_trace(
            branch_points,
            lengths,
            cumulative,
            crown_radius,
            top_elevation,
            tolerance,
        )
    else:
        first_station = crown_radius
    first, block_count = _desired_stations(
        cumulative[-1], target_length, first_station,
        not align_plan_radius,
    )
    outer_length = cumulative[-1] - first
    evaluation_end = cumulative[-1] - max(
        tolerance * 10.0,
        outer_length * 1.0e-5,
    )
    if evaluation_end <= first:
        raise ValueError(
            "The outer branch is too short for volume integration."
        )
    sample_count = max(49, min(161, 8 * len(lengths) + 1))
    distances = [
        first
        + (evaluation_end - first)
        * index
        / float(sample_count - 1)
        for index in range(sample_count)
    ]
    areas = []
    for distance in distances:
        point, tangent = _point_tangent_at_distance(
            branch_points, lengths, cumulative, distance
        )
        plane, _ = _section_plane(
            point,
            tangent,
            branch_points[0],
            branch_points[-1],
        )
        profile = _containing_profile(
            _section_curves(solid, plane, tolerance),
            point,
            plane,
            tolerance,
        )
        areas.append(_curve_area(profile))
        profile.Dispose()

    accumulated = [0.0]
    for index in range(len(distances) - 1):
        step = distances[index + 1] - distances[index]
        increment = 0.5 * (areas[index] + areas[index + 1]) * step
        accumulated.append(accumulated[-1] + increment)
    estimated_volume = accumulated[-1]
    if block_count == 1:
        volume_weights = [1.0]
    else:
        volume_weights = [
            INNER_VOLUME_WEIGHT
            + (OUTER_VOLUME_WEIGHT - INNER_VOLUME_WEIGHT)
            * block_index
            / float(block_count - 1)
            for block_index in range(block_count)
        ]
    weight_total = sum(volume_weights)
    stations = [first]
    accumulated_weight = 0.0
    for block_index in range(1, block_count):
        accumulated_weight += volume_weights[block_index - 1]
        target_volume = (
            estimated_volume * accumulated_weight / weight_total
        )
        stations.append(
            _distance_at_accumulated_value(
                distances, accumulated, target_volume
            )
        )
    return stations, block_count


def _plane_coordinates(point, plane):
    vector = rg.Vector3d(
        point.X - plane.Origin.X,
        point.Y - plane.Origin.Y,
        point.Z - plane.Origin.Z,
    )
    return (
        rg.Vector3d.Multiply(vector, plane.XAxis),
        rg.Vector3d.Multiply(vector, plane.YAxis),
    )


def _local_cutter(profile, plane, tolerance):
    parameters = profile.DivideByCount(96, True)
    if not parameters:
        raise RuntimeError("A joint profile could not be sampled.")
    coordinates = [
        _plane_coordinates(profile.PointAt(parameter), plane)
        for parameter in parameters
    ]
    minimum_x = min(point[0] for point in coordinates)
    maximum_x = max(point[0] for point in coordinates)
    minimum_y = min(point[1] for point in coordinates)
    maximum_y = max(point[1] for point in coordinates)
    size = max(
        maximum_x - minimum_x,
        maximum_y - minimum_y,
        tolerance * 10.0,
    )
    margin = max(size * 0.25, tolerance * 20.0)
    surface = rg.PlaneSurface(
        plane,
        rg.Interval(minimum_x - margin, maximum_x + margin),
        rg.Interval(minimum_y - margin, maximum_y + margin),
    )
    cutter = surface.ToBrep()
    surface.Dispose()
    if cutter is None or not cutter.IsValid:
        raise RuntimeError("A local joint cutter is invalid.")
    return cutter


def _normalise_solid(brep):
    if brep.SolidOrientation == rg.BrepSolidOrientation.Inward:
        brep.Flip()
    return brep.IsValid and brep.IsSolid


def _close_split_piece(brep, tolerance):
    if brep is None or not brep.IsValid:
        return None
    candidate = brep
    if not candidate.IsSolid:
        capped = candidate.CapPlanarHoles(tolerance)
        if capped is not None:
            candidate = capped
    return candidate if _normalise_solid(candidate) else None


def _split_all(solid, cutters, tolerance):
    pieces = [solid.DuplicateBrep()]
    for cutter_index, cutter in enumerate(cutters):
        next_pieces = []
        split_count = 0
        for piece in pieces:
            result = piece.Split(cutter, tolerance)
            candidates = list(result) if result is not None else []
            valid = []
            for candidate in candidates:
                closed = _close_split_piece(candidate, tolerance)
                if closed is not None:
                    valid.append(closed)
            if len(valid) >= 2:
                next_pieces.extend(valid)
                split_count += 1
            else:
                next_pieces.append(piece)
        if split_count != 1:
            raise RuntimeError(
                "Joint cutter {0} split {1} pieces; expected exactly one."
                .format(cutter_index, split_count)
            )
        pieces = next_pieces
    return pieces


def _volume_centroid(solid):
    properties = rg.VolumeMassProperties.Compute(solid)
    if properties is None:
        raise RuntimeError("Could not evaluate a block volume.")
    volume = abs(properties.Volume)
    centroid = properties.Centroid
    properties.Dispose()
    return volume, centroid


def _connected_component_count(brep):
    result = brep.GetConnectedComponents()
    components = list(result) if result else []
    if not components:
        return 1
    count = len(components)
    for component in components:
        component.Dispose()
    return count


def _area_centroid(geometry, description):
    properties = rg.AreaMassProperties.Compute(geometry)
    if properties is None:
        raise RuntimeError(
            "Could not evaluate {0} area properties.".format(description)
        )
    area = abs(properties.Area)
    centroid = rg.Point3d(properties.Centroid)
    properties.Dispose()
    if area <= 0.0 or not centroid.IsValid:
        raise RuntimeError(
            "{0} has invalid area properties.".format(description)
        )
    return area, centroid


def _center_top_flatness(block, source_solid, top_elevation, tolerance):
    upward_face_count = 0
    minimum_top_vertex_z = top_elevation
    maximum_top_drop = 0.0
    face_tolerance = max(5.0 * tolerance, 1.0e-7)
    minimum_top_normal_z = (
        1.0 / math.sqrt(
            1.0 + (MAX_TOP_SLOPE_PERCENT / 100.0) ** 2
        )
        - 1.0e-6
    )
    boundary_probe = max(10.0 * tolerance, 1.0e-4)
    for face in block.Faces:
        domain_u = face.Domain(0)
        domain_v = face.Domain(1)
        normal = face.NormalAt(
            0.5 * (domain_u.T0 + domain_u.T1),
            0.5 * (domain_v.T0 + domain_v.T1),
        )
        if not normal.Unitize() or abs(normal.Z) < minimum_top_normal_z:
            continue
        face_brep = face.DuplicateFace(False)
        if face_brep is None or not face_brep.IsValid:
            if face_brep is not None:
                face_brep.Dispose()
            raise RuntimeError(
                "Could not inspect an upward-facing crown-block face."
            )
        try:
            elevations = [
                vertex.Location.Z for vertex in face_brep.Vertices
            ]
            _face_area, face_centroid = _area_centroid(
                face_brep, "an upward crown-block face"
            )
        finally:
            face_brep.Dispose()
        if not elevations:
            raise RuntimeError(
                "An upward-facing crown-block face has no vertices."
            )
        if max(elevations) < top_elevation - face_tolerance:
            continue
        plus_point = rg.Point3d(
            face_centroid.X + normal.X * boundary_probe,
            face_centroid.Y + normal.Y * boundary_probe,
            face_centroid.Z + normal.Z * boundary_probe,
        )
        minus_point = rg.Point3d(
            face_centroid.X - normal.X * boundary_probe,
            face_centroid.Y - normal.Y * boundary_probe,
            face_centroid.Z - normal.Z * boundary_probe,
        )
        plus_inside = source_solid.IsPointInside(
            plus_point, tolerance, True
        )
        minus_inside = source_solid.IsPointInside(
            minus_point, tolerance, True
        )
        if plus_inside == minus_inside:
            continue
        upward_face_count += 1
        face_minimum = min(elevations)
        minimum_top_vertex_z = min(
            minimum_top_vertex_z, face_minimum
        )
        maximum_top_drop = max(
            maximum_top_drop,
            top_elevation - face_minimum,
        )
    return {
        "horizontal": (
            upward_face_count > 0
            and maximum_top_drop <= face_tolerance
        ),
        "upward_face_count": upward_face_count,
        "minimum_top_vertex_z": minimum_top_vertex_z,
        "maximum_top_drop": maximum_top_drop,
        "tolerance": face_tolerance,
    }


def _planar_block_faces(blocks, tolerance):
    records = []
    for block_index, block in enumerate(blocks):
        for face_index, face in enumerate(block.Faces):
            if not face.IsPlanar(tolerance):
                continue
            face_brep = face.DuplicateFace(False)
            if face_brep is None or not face_brep.IsValid:
                if face_brep is not None:
                    face_brep.Dispose()
                continue
            try:
                area, centroid = _area_centroid(
                    face_brep, "a planar block face"
                )
                domain_u = face.Domain(0)
                domain_v = face.Domain(1)
                normal = face.NormalAt(
                    0.5 * (domain_u.T0 + domain_u.T1),
                    0.5 * (domain_v.T0 + domain_v.T1),
                )
                if not normal.Unitize():
                    raise RuntimeError(
                        "A planar block face has no valid normal."
                    )
            except Exception:
                face_brep.Dispose()
                raise
            records.append(
                (
                    block_index,
                    face_index,
                    face_brep,
                    area,
                    centroid,
                    normal,
                )
            )
    return records


def _profile_sample_points(profile):
    parameters = profile.DivideByCount(
        JOINT_PROFILE_MATCH_SAMPLES, True
    )
    if not parameters:
        raise RuntimeError("A joint profile could not be sampled.")
    return [profile.PointAt(parameter) for parameter in parameters]


def _joint_profile_data(profile, tolerance):
    profile_area, profile_centroid = _area_centroid(
        profile, "a joint profile"
    )
    characteristic_length = max(math.sqrt(profile_area), tolerance)
    return (
        profile_area,
        profile_centroid,
        _profile_sample_points(profile),
        max(5.0 * tolerance, characteristic_length * 1.0e-6),
        max(5.0 * tolerance, characteristic_length * 1.0e-5),
        max(5.0 * tolerance, characteristic_length * 1.0e-5),
        max(
            profile_area * 1.0e-4,
            25.0 * tolerance * tolerance,
        ),
    )


def _profile_face_match(profile_data, plane, face_record):
    (
        block_index,
        face_index,
        face_brep,
        face_area,
        face_centroid,
        face_normal,
    ) = face_record
    (
        profile_area,
        profile_centroid,
        sample_points,
        plane_tolerance,
        centroid_tolerance,
        boundary_tolerance,
        area_tolerance,
    ) = profile_data
    normal_alignment = abs(
        rg.Vector3d.Multiply(face_normal, plane.Normal)
    )
    if normal_alignment < math.cos(math.radians(0.01)):
        return None
    plane_error = abs(plane.DistanceTo(face_centroid))
    if plane_error > plane_tolerance:
        return None
    area_error = abs(face_area - profile_area)
    if area_error > area_tolerance:
        return None
    centroid_error = face_centroid.DistanceTo(profile_centroid)
    if centroid_error > centroid_tolerance:
        return None
    boundary_error = 0.0
    for point in sample_points:
        closest = face_brep.ClosestPoint(point)
        if closest is None or not closest.IsValid:
            return None
        boundary_error = max(boundary_error, point.DistanceTo(closest))
    if boundary_error > boundary_tolerance:
        return None
    return (
        block_index,
        face_index,
        area_error,
        centroid_error,
        boundary_error,
        plane_error,
        face_normal,
    )


def _validate_joint_profiles_against_blocks(
    blocks, joint_planes, joint_profiles, tolerance
):
    face_records = _planar_block_faces(blocks, tolerance)
    failures = []
    used_faces = set()
    reused_faces = []
    maximum_area_error = 0.0
    maximum_centroid_error = 0.0
    maximum_boundary_error = 0.0
    maximum_plane_error = 0.0
    matched_profiles = 0
    try:
        for joint_index, (plane, profile) in enumerate(
            zip(joint_planes, joint_profiles)
        ):
            profile_data = _joint_profile_data(profile, tolerance)
            matches = []
            for record in face_records:
                match = _profile_face_match(
                    profile_data, plane, record
                )
                if match is not None:
                    matches.append(match)
            matched_blocks = sorted(
                set(match[0] for match in matches)
            )
            opposite_normals = False
            if len(matches) == 2 and len(matched_blocks) == 2:
                opposite_normals = (
                    rg.Vector3d.Multiply(
                        matches[0][6], matches[1][6]
                    )
                    <= -math.cos(math.radians(0.01))
                )
            if (
                len(matches) != 2
                or len(matched_blocks) != 2
                or not opposite_normals
            ):
                failures.append(
                    (
                        joint_index,
                        len(matches),
                        matched_blocks,
                        opposite_normals,
                    )
                )
                continue
            face_keys = [
                (match[0], match[1]) for match in matches
            ]
            repeated = [
                key for key in face_keys if key in used_faces
            ]
            if repeated:
                reused_faces.extend(
                    (joint_index, key) for key in repeated
                )
                failures.append(
                    (
                        joint_index,
                        len(matches),
                        matched_blocks,
                        "reused_face",
                    )
                )
                continue
            used_faces.update(face_keys)
            matched_profiles += 1
            maximum_area_error = max(
                maximum_area_error,
                max(match[2] for match in matches),
            )
            maximum_centroid_error = max(
                maximum_centroid_error,
                max(match[3] for match in matches),
            )
            maximum_boundary_error = max(
                maximum_boundary_error,
                max(match[4] for match in matches),
            )
            maximum_plane_error = max(
                maximum_plane_error,
                max(match[5] for match in matches),
            )
    finally:
        for record in face_records:
            record[2].Dispose()
    return {
        "valid": (
            matched_profiles == len(joint_profiles)
            and not failures
            and not reused_faces
        ),
        "matched_profiles": matched_profiles,
        "failures": failures,
        "reused_faces": reused_faces,
        "maximum_area_error": maximum_area_error,
        "maximum_centroid_error": maximum_centroid_error,
        "maximum_boundary_error": maximum_boundary_error,
        "maximum_plane_error": maximum_plane_error,
    }


def _closest_branch(point, branch_curves):
    best = None
    for branch_index, curve in enumerate(branch_curves):
        result = curve.ClosestPoint(point)
        if not result or not result[0]:
            continue
        parameter = result[1]
        closest = curve.PointAt(parameter)
        distance = closest.DistanceTo(point)
        candidate = (distance, branch_index, parameter)
        if best is None or candidate < best:
            best = candidate
    if best is None:
        raise RuntimeError("A block could not be assigned to a branch.")
    return best[1], best[2]


def _order_and_label_blocks(pieces, crown_point, branch_curves,
                            tolerance):
    records = []
    center_candidates = []
    for piece_index, piece in enumerate(pieces):
        volume, centroid = _volume_centroid(piece)
        if volume <= 0.0:
            raise RuntimeError("A split block has non-positive volume.")
        if piece.IsPointInside(crown_point, tolerance, False):
            center_candidates.append(piece_index)
        branch_index, parameter = _closest_branch(
            centroid, branch_curves
        )
        records.append(
            (piece_index, piece, centroid, branch_index, parameter)
        )
    if len(center_candidates) == 1:
        center_index = center_candidates[0]
    else:
        center_index = min(
            records,
            key=lambda item: math.hypot(
                item[2].X - crown_point.X,
                item[2].Y - crown_point.Y,
            ),
        )[0]

    ordered_blocks = []
    block_ids = []
    center_record = next(
        record for record in records if record[0] == center_index
    )
    ordered_blocks.append(center_record[1])
    block_ids.append("center/block[0]")

    for branch_index in range(len(branch_curves)):
        branch_records = [
            record for record in records
            if record[0] != center_index
            and record[3] == branch_index
        ]
        branch_records.sort(key=lambda item: item[4])
        for local_index, record in enumerate(branch_records):
            ordered_blocks.append(record[1])
            block_ids.append(
                "arch[{0}]/block[{1}]".format(
                    branch_index + 1, local_index + 1
                )
            )
    if len(ordered_blocks) != len(pieces):
        raise RuntimeError("Not every split block received a stable ID.")
    return (
        ordered_blocks,
        block_ids,
        len(center_candidates),
    )


def _radial_volume_trends(block_ids, block_volumes):
    """Summarise the overall inner-to-outer volume trend per branch."""
    grouped = {}
    for block_id, volume in zip(block_ids, block_volumes):
        if not block_id.startswith("arch["):
            continue
        arch_index = int(block_id.split("[", 1)[1].split("]", 1)[0])
        grouped.setdefault(arch_index, []).append(float(volume))

    records = []
    for arch_index in sorted(grouped):
        volumes = grouped[arch_index]
        if len(volumes) == 1:
            records.append(
                (
                    arch_index,
                    1,
                    volumes[0],
                    volumes[0],
                    1.0,
                    False,
                )
            )
            continue
        bin_count = max(1, int(math.ceil(len(volumes) / 3.0)))
        inner_mean = sum(volumes[:bin_count]) / float(bin_count)
        outer_mean = sum(volumes[-bin_count:]) / float(bin_count)
        outer_inner_ratio = outer_mean / max(inner_mean, 1.0e-12)
        records.append(
            (
                arch_index,
                len(volumes),
                inner_mean,
                outer_mean,
                outer_inner_ratio,
                outer_mean > inner_mean,
            )
        )
    return records


def create_utilisation_guided_segmentation(
    whole_solid,
    tna_edges,
    utilisations,
    target_block_length=None,
    crown_block_radius=None,
    top_slope_percent=None,
):
    solid = _coerce_brep(whole_solid)
    if solid is None or not solid.IsValid or not solid.IsSolid:
        raise ValueError("WholeSolid must be one valid closed Brep.")
    lines = []
    for edge_index, value in enumerate(_as_list(tna_edges)):
        line = _coerce_line(value)
        if line is None or not line.IsValid or line.Length <= 0.0:
            raise ValueError(
                "TNAEdges contains an invalid line at index {0}."
                .format(edge_index)
            )
        lines.append(line)
    if not lines:
        raise ValueError("TNAEdges must contain valid lines.")
    utilisation_values = [
        float(value) for value in _as_list(utilisations)
    ]
    if len(utilisation_values) != len(lines):
        raise ValueError(
            "Utilisations must correspond one-to-one with TNAEdges."
        )
    if any(
        not math.isfinite(value) or value < 0.0
        for value in utilisation_values
    ):
        raise ValueError(
            "Utilisations must contain finite non-negative numbers."
        )
    target_length = _optional_positive(
        target_block_length,
        DEFAULT_TARGET_BLOCK_LENGTH,
        "TargetBlockLength",
    )
    crown_radius = _optional_positive(
        crown_block_radius,
        DEFAULT_CROWN_BLOCK_RADIUS,
        "CrownBlockRadius",
    )
    top_slope_percent = (
        DEFAULT_TOP_SLOPE_PERCENT
        if top_slope_percent is None
        else float(top_slope_percent)
    )
    if (
        not math.isfinite(top_slope_percent)
        or top_slope_percent < 0.0
        or top_slope_percent > MAX_TOP_SLOPE_PERCENT
    ):
        raise ValueError(
            "TopSlopePercent must be finite and between 0 and 5."
        )
    align_plan_radius = top_slope_percent > 0.0
    tolerance = _document_tolerance()
    (
        points,
        crown,
        branches,
        branch_edges,
    ) = _radial_network(
        lines, max(tolerance * 0.1, 1.0e-7)
    )

    joint_planes = []
    joint_profiles = []
    cutters = []
    first_station_distances = []
    first_station_plan_radii = []
    per_arch_blocks = []
    high_risk_joints = 0
    shifted_joint_count = 0
    maximum_station_shift = 0.0
    maximum_angle_error = 0.0
    branch_curves = []
    first_station_top_trace_radii = []
    first_station_top_trace_gaps = []
    top_elevation = solid.GetBoundingBox(True).Max.Z

    for branch_nodes, edge_indices in zip(branches, branch_edges):
        (
            branch_points,
            lengths,
            cumulative,
            branch_utilisations,
        ) = _branch_data(
            points,
            branch_nodes,
            edge_indices,
            utilisation_values,
        )
        branch_curves.append(rg.PolylineCurve(branch_points))
        desired, outer_block_count = _graded_volume_stations(
            solid,
            branch_points,
            lengths,
            cumulative,
            target_length,
            crown_radius,
            top_elevation,
            tolerance,
            align_plan_radius,
        )
        selected = _optimised_stations(
            desired,
            cumulative[-1],
            target_length,
            cumulative,
            branch_utilisations,
            desired[0],
        )
        first_station_distances.append(selected[0])
        first_point, first_tangent = _point_tangent_at_distance(
            branch_points, lengths, cumulative, selected[0]
        )
        first_station_plan_radii.append(
            math.hypot(
                first_point.X - branch_points[0].X,
                first_point.Y - branch_points[0].Y,
            )
        )
        first_station_top_trace_radii.append(
            _joint_top_trace_radius(
                first_point,
                first_tangent,
                branch_points[0],
                branch_points[-1],
                top_elevation,
            )
        )
        first_station_top_trace_gaps.append(
            crown_radius - first_station_top_trace_radii[-1]
        )
        per_arch_blocks.append(outer_block_count)
        high_risk_joints += sum(
            _utilisation_at_distance(
                cumulative, branch_utilisations, distance
            ) > 1.0
            for distance in selected
        )
        for desired_distance, selected_distance in zip(
            desired, selected
        ):
            shift = abs(selected_distance - desired_distance)
            shifted_joint_count += shift > tolerance
            maximum_station_shift = max(
                maximum_station_shift, shift
            )

        for distance in selected:
            point, tangent = _point_tangent_at_distance(
                branch_points, lengths, cumulative, distance
            )
            plane, angle_error = _section_plane(
                point,
                tangent,
                branch_points[0],
                branch_points[-1],
            )
            profile = _containing_profile(
                _section_curves(solid, plane, tolerance),
                point,
                plane,
                tolerance,
            )
            cutter = _local_cutter(profile, plane, tolerance)
            joint_planes.append(plane)
            joint_profiles.append(profile)
            cutters.append(cutter)
            maximum_angle_error = max(
                maximum_angle_error, angle_error
            )

    try:
        pieces = _split_all(solid, cutters, tolerance)
    finally:
        for cutter in cutters:
            cutter.Dispose()
    expected_blocks = 1 + sum(per_arch_blocks)
    if len(pieces) != expected_blocks:
        raise RuntimeError(
            "Segmentation produced {0} blocks; expected {1}."
            .format(len(pieces), expected_blocks)
        )
    crown_point = points[crown]
    try:
        (
            blocks,
            block_ids,
            center_candidate_count,
        ) = _order_and_label_blocks(
            pieces, crown_point, branch_curves, tolerance
        )
    finally:
        for branch_curve in branch_curves:
            branch_curve.Dispose()
    center_selection_exact = center_candidate_count == 1
    center_top_flatness = (
        _center_top_flatness(
            blocks[0], solid, top_elevation, tolerance
        )
        if align_plan_radius
        else {
            "horizontal": True,
            "upward_face_count": 0,
            "minimum_top_vertex_z": top_elevation,
            "maximum_top_drop": 0.0,
            "tolerance": max(5.0 * tolerance, 1.0e-7),
        }
    )
    if align_plan_radius and not center_top_flatness["horizontal"]:
        raise RuntimeError(
            "The centre crown block exposes a sloped top face; no valid "
            "horizontal crown top was produced: {0}."
            .format(center_top_flatness)
        )

    source_volume, _ = _volume_centroid(solid)
    block_volumes = [
        _volume_centroid(block)[0] for block in blocks
    ]
    split_volume = sum(block_volumes)
    volume_error = abs(split_volume - source_volume)
    allowed_volume_error = max(
        source_volume * 2.0e-5,
        100.0 * tolerance ** 3,
    )
    radial_volume_trends = _radial_volume_trends(
        block_ids, block_volumes
    )
    radial_gradient_pass = (
        len(radial_volume_trends) == len(branches)
        and all(
            record[0] == branch_index + 1
            and record[1] == per_arch_blocks[branch_index]
            and record[5]
            for branch_index, record in enumerate(radial_volume_trends)
        )
    )
    disconnected_block_ids = [
        block_id
        for block_id, block in zip(block_ids, blocks)
        if _connected_component_count(block) != 1
    ]
    block_ids_unique = len(set(block_ids)) == len(block_ids)
    joint_face_validation = _validate_joint_profiles_against_blocks(
        blocks, joint_planes, joint_profiles, tolerance
    )
    valid = (
        len(blocks) == expected_blocks
        and len(block_ids) == expected_blocks
        and len(joint_planes) == sum(per_arch_blocks)
        and len(joint_profiles) == len(joint_planes)
        and all(block.IsValid and block.IsSolid for block in blocks)
        and all(
            profile.IsValid and profile.IsClosed
            for profile in joint_profiles
        )
        and maximum_angle_error <= 1.0e-5
        and volume_error <= allowed_volume_error
        and (
            all(
                radius <= crown_radius + tolerance
                for radius in first_station_top_trace_radii
            )
            if align_plan_radius
            else all(
                distance >= crown_radius - tolerance
                for distance in first_station_distances
            )
        )
        and radial_gradient_pass
        and center_selection_exact
        and center_top_flatness["horizontal"]
        and not disconnected_block_ids
        and block_ids_unique
        and joint_face_validation["valid"]
    )
    reported_trends = [
        (
            record[0],
            record[1],
            round(record[2], 6),
            round(record[3], 6),
            round(record[4], 6),
            record[5],
        )
        for record in radial_volume_trends
    ]
    report = (
        f"stage=utilisation_guided_segmentation; arches={len(branches)}; "
        f"target_block_length={target_length:.6g}; "
        f"crown_block_radius={crown_radius:.6g}; "
        f"top_slope_percent={top_slope_percent:.6g}; "
        "crown_radius_mode="
        f"{'joint_top_trace_at_or_inside_slope_break' if align_plan_radius else 'branch_length_legacy'}; "
        f"outer_blocks_per_arch={per_arch_blocks}; "
        f"center_block_output=1; blocks={len(blocks)}; "
        f"joints={len(joint_planes)}; "
        f"high_risk_joints={high_risk_joints}; "
        f"shifted_joints={shifted_joint_count}; "
        f"max_station_shift={maximum_station_shift:.6g}; "
        "radial_volume_trends="
        "(arch,count,inner_mean,outer_mean,outer_inner_ratio,"
        f"pass){reported_trends}; "
        f"radial_gradient_pass={radial_gradient_pass}; "
        "first_station_distances="
        f"{[round(value, 6) for value in first_station_distances]}; "
        "first_station_plan_radii="
        f"{[round(value, 6) for value in first_station_plan_radii]}; "
        "first_station_top_trace_radii="
        f"{[round(value, 6) for value in first_station_top_trace_radii]}; "
        "first_station_top_trace_gaps="
        f"{[round(value, 6) for value in first_station_top_trace_gaps]}; "
        f"center_top_horizontal={center_top_flatness['horizontal']}; "
        "center_top_upward_faces="
        f"{center_top_flatness['upward_face_count']}; "
        "center_top_maximum_drop="
        f"{center_top_flatness['maximum_top_drop']:.6g}; "
        f"max_normal_alignment_error_deg={maximum_angle_error:.6g}; "
        f"source_volume={source_volume:.6g}; "
        f"split_volume={split_volume:.6g}; "
        f"volume_error={volume_error:.6g}; tolerance={tolerance:.6g}; "
        f"center_candidate_count={center_candidate_count}; "
        f"center_selection_exact={center_selection_exact}; "
        f"disconnected_block_ids={disconnected_block_ids}; "
        f"block_ids_unique={block_ids_unique}; "
        "joint_profiles_matched_to_two_final_faces="
        f"{joint_face_validation['matched_profiles']}/"
        f"{len(joint_profiles)}; "
        "joint_profile_match_failures="
        f"{joint_face_validation['failures']}; "
        f"reused_joint_faces={joint_face_validation['reused_faces']}; "
        "max_joint_face_area_error="
        f"{joint_face_validation['maximum_area_error']:.6g}; "
        "max_joint_face_centroid_error="
        f"{joint_face_validation['maximum_centroid_error']:.6g}; "
        "max_joint_face_boundary_error="
        f"{joint_face_validation['maximum_boundary_error']:.6g}; "
        "max_joint_face_plane_error="
        f"{joint_face_validation['maximum_plane_error']:.6g}; "
        f"valid={valid}"
    )
    return (
        blocks,
        joint_planes,
        joint_profiles,
        block_ids,
        valid,
        report,
    )


try:
    _top_slope_component_input = TopSlopePercent
except NameError:
    _top_slope_component_input = None

try:
    _component_inputs = (
        WholeSolid,
        TNAEdges,
        Utilisations,
        TargetBlockLength,
        CrownBlockRadius,
        _top_slope_component_input,
    )
except NameError:
    _component_inputs = None

if _component_inputs is not None:
    (
        Blocks,
        JointPlanes,
        JointProfiles,
        BlockIDs,
        Valid,
        Report,
    ) = create_utilisation_guided_segmentation(*_component_inputs)
# ---------- end _06_引导径向分块 ----------

# ---- group: 07A 块重与接缝邻接
# 07A 块重与接缝邻接｜备注: 计算精确块重，为每个实际接缝解析唯一邻接块对。
# 单位重与02共用25.5 kN/m³，默认值也已同步。
# 输出JointIDs与JointBlockPairs，维持行顺序对应。
# 检查总质量闭合，不验证逐块力与力矩平衡。
# 节点荷载仍是网络求解的输入。
_07a_块重与接缝邻接 = Python3Script(
    Blocks=_06_引导径向分块.Blocks,
    JointPlanes=_06_引导径向分块.JointPlanes,
    JointProfiles=_06_引导径向分块.JointProfiles,
    BlockIDs=_06_引导径向分块.BlockIDs,
    UnitWeight=unitweight_25_5_kn_m³)  # -> out, BlockCentroids, BlockLoads, JointIDs, JointBlockPairs, Valid, Report; inputs Blocks: list of Brep, JointPlanes: list of Plane, JointProfiles: list of Curve, BlockIDs: list
# ---------- _07a_块重与接缝邻接: Python ----------
#! python 3
"""Stage 07A - exact block self-weight and actual joint adjacency.

Grasshopper Python inputs:
    Blocks          list[Brep]   Blocks from Stage 06 (List)
    JointPlanes     list[Plane]  JointPlanes from Stage 06 (List)
    JointProfiles   list[Curve]  JointProfiles from Stage 06 (List)
    BlockIDs        list[str]    BlockIDs from Stage 06 (List)
    UnitWeight      float        Stone unit weight in kN/m3 (Item, optional)

Outputs:
    BlockCentroids, BlockLoads, JointIDs, JointBlockPairs, Valid, Report

This first part of Stage 07 establishes exact block weights and the topology of
the already segmented assembly. It does not check contact pressure, opening,
friction, crushing or dowel capacity.
"""

import math
import re

import Rhino
import Rhino.Geometry as rg


DEFAULT_UNIT_WEIGHT = 25.5  # kN/m3; match the current Stage 02 limestone study.


def _as_list(value):
    if value is None:
        return []
    if isinstance(value, str):
        return [value]
    try:
        return list(value)
    except TypeError:
        return [value]


def _document_tolerance():
    document = Rhino.RhinoDoc.ActiveDoc
    if document is None:
        return 1.0e-3
    return document.ModelAbsoluteTolerance


def _coerce_brep(value):
    if isinstance(value, rg.Brep):
        return value
    if hasattr(value, "Value") and isinstance(value.Value, rg.Brep):
        return value.Value
    return None


def _coerce_plane(value):
    if isinstance(value, rg.Plane):
        return rg.Plane(value)
    if hasattr(value, "Value") and isinstance(value.Value, rg.Plane):
        return rg.Plane(value.Value)
    return None


def _coerce_curve(value):
    if isinstance(value, rg.Curve):
        return value
    if hasattr(value, "Value") and isinstance(value.Value, rg.Curve):
        return value.Value
    return None


def _positive_number(value, default, name):
    if value is None:
        return default
    try:
        number = float(value)
    except (TypeError, ValueError):
        return default
    if not math.isfinite(number) or number <= 0.0:
        raise ValueError("{0} must be a finite positive number.".format(name))
    return number


def _volume_centroid(block):
    properties = rg.VolumeMassProperties.Compute(block)
    if properties is None:
        raise RuntimeError("Could not compute a block volume and centroid.")
    try:
        return abs(properties.Volume), rg.Point3d(properties.Centroid)
    finally:
        properties.Dispose()


def _profile_centroid(profile):
    properties = rg.AreaMassProperties.Compute(profile)
    if properties is None:
        raise RuntimeError("Could not compute a joint-profile centroid.")
    try:
        return rg.Point3d(properties.Centroid), abs(properties.Area)
    finally:
        properties.Dispose()


def _containing_blocks(blocks, point, tolerance):
    return [
        index for index, block in enumerate(blocks)
        if block.IsPointInside(point, tolerance, False)
    ]


def _joint_pair(blocks, profile, plane, tolerance):
    centroid, area = _profile_centroid(profile)
    normal = rg.Vector3d(plane.Normal)
    if not normal.Unitize():
        raise ValueError("A JointPlane has an invalid normal.")

    base_offset = max(20.0 * tolerance, 1.0e-4)
    attempts = []
    for factor in (1.0, 2.0, 5.0, 10.0):
        offset = base_offset * factor
        plus = _containing_blocks(
            blocks, centroid + normal * offset, tolerance
        )
        minus = _containing_blocks(
            blocks, centroid - normal * offset, tolerance
        )
        attempts.append((offset, plus, minus))
        if len(plus) == 1 and len(minus) == 1 and plus[0] != minus[0]:
            return plus[0], minus[0], area, offset, attempts
    return None, None, area, None, attempts


def _parse_arch_block(identifier):
    match = re.fullmatch(r"arch\[(\d+)\]/block\[(\d+)\]", identifier)
    if match is None:
        return None
    return int(match.group(1)), int(match.group(2))


def _joint_id(first_id, second_id):
    first = _parse_arch_block(first_id)
    second = _parse_arch_block(second_id)
    first_is_center = first_id.startswith("center/")
    second_is_center = second_id.startswith("center/")

    if first_is_center and second is not None and second[1] == 1:
        return "arch[{0}]/joint[1]".format(second[0])
    if second_is_center and first is not None and first[1] == 1:
        return "arch[{0}]/joint[1]".format(first[0])
    if first is None or second is None or first[0] != second[0]:
        return None
    if abs(first[1] - second[1]) != 1:
        return None
    return "arch[{0}]/joint[{1}]".format(
        first[0], max(first[1], second[1])
    )


def _connected_block_count(block_count, pairs):
    if block_count == 0:
        return 0
    adjacency = [[] for _ in range(block_count)]
    for first, second in pairs:
        adjacency[first].append(second)
        adjacency[second].append(first)
    visited = {0}
    pending = [0]
    while pending:
        current = pending.pop()
        for neighbour in adjacency[current]:
            if neighbour not in visited:
                visited.add(neighbour)
                pending.append(neighbour)
    return len(visited)


def create_block_weight_and_joint_adjacency(
    blocks,
    joint_planes,
    joint_profiles,
    block_ids,
    unit_weight=None,
):
    block_values = []
    for index, value in enumerate(_as_list(blocks)):
        block = _coerce_brep(value)
        if block is None or not block.IsValid or not block.IsSolid:
            raise ValueError(
                "Blocks contains an invalid closed Brep at index {0}."
                .format(index)
            )
        block_values.append(block)
    if not block_values:
        raise ValueError("Blocks must contain valid closed Breps.")

    identifiers = [str(value) for value in _as_list(block_ids)]
    if len(identifiers) != len(block_values):
        raise ValueError("BlockIDs must correspond one-to-one with Blocks.")
    if len(set(identifiers)) != len(identifiers):
        raise ValueError("BlockIDs must be unique.")
    center_ids = [value for value in identifiers if value.startswith("center/")]
    if len(center_ids) != 1:
        raise ValueError("BlockIDs must contain exactly one center block.")

    planes = []
    for index, value in enumerate(_as_list(joint_planes)):
        plane = _coerce_plane(value)
        if plane is None or not plane.IsValid:
            raise ValueError(
                "JointPlanes contains an invalid plane at index {0}."
                .format(index)
            )
        planes.append(plane)

    profiles = []
    for index, value in enumerate(_as_list(joint_profiles)):
        profile = _coerce_curve(value)
        if profile is None or not profile.IsValid or not profile.IsClosed:
            raise ValueError(
                "JointProfiles contains an invalid closed curve at index {0}."
                .format(index)
            )
        profiles.append(profile)
    if len(planes) != len(profiles):
        raise ValueError(
            "JointPlanes and JointProfiles must correspond one-to-one."
        )

    weight_density = _positive_number(
        unit_weight, DEFAULT_UNIT_WEIGHT, "UnitWeight"
    )
    tolerance = _document_tolerance()
    centroids = []
    loads = []
    volumes = []
    for block in block_values:
        volume, centroid = _volume_centroid(block)
        if volume <= 0.0:
            raise RuntimeError("A block has non-positive volume.")
        volumes.append(volume)
        centroids.append(centroid)
        loads.append(rg.Vector3d(0.0, 0.0, -weight_density * volume))

    joint_ids = []
    pair_indices = []
    pair_ids = []
    areas = []
    offsets = []
    failures = []
    for index, (plane, profile) in enumerate(zip(planes, profiles)):
        first, second, area, offset, attempts = _joint_pair(
            block_values, profile, plane, tolerance
        )
        areas.append(area)
        offsets.append(offset)
        if first is None or second is None:
            failures.append((index, attempts))
            continue
        first_id = identifiers[first]
        second_id = identifiers[second]
        identifier = _joint_id(first_id, second_id)
        if identifier is None:
            failures.append((index, first_id, second_id, "non_radial_pair"))
            continue
        joint_ids.append(identifier)
        pair_indices.append((first, second))
        pair_ids.append((first_id, second_id))

    expected_joint_count = len(block_values) - 1
    unique_pairs = {tuple(sorted(pair)) for pair in pair_indices}
    connected_count = _connected_block_count(len(block_values), pair_indices)
    topology_valid = (
        not failures
        and len(planes) == expected_joint_count
        and len(pair_indices) == len(planes)
        and len(unique_pairs) == len(pair_indices)
        and len(set(joint_ids)) == len(joint_ids)
        and connected_count == len(block_values)
    )
    total_volume = sum(volumes)
    total_weight = sum(-load.Z for load in loads)
    expected_weight = weight_density * total_volume
    weight_error = abs(total_weight - expected_weight)
    weight_tolerance = max(expected_weight * 1.0e-12, 1.0e-9)
    valid = topology_valid and weight_error <= weight_tolerance
    report = (
        f"stage=block_weight_and_joint_adjacency; blocks={len(block_values)}; "
        f"joints={len(planes)}; unit_weight_kN_m3={weight_density:.6g}; "
        f"total_volume_m3={total_volume:.6g}; "
        f"total_weight_kN={total_weight:.6g}; "
        f"weight_balance_error_kN={weight_error:.6g}; "
        f"joint_pairs_resolved={len(pair_indices)}/{len(planes)}; "
        f"unique_joint_pairs={len(unique_pairs)}; "
        f"connected_blocks={connected_count}/{len(block_values)}; "
        f"joint_area_min_max_m2="
        f"({min(areas) if areas else 0.0:.6g},"
        f"{max(areas) if areas else 0.0:.6g}); "
        f"probe_offsets={offsets}; failures={failures}; "
        f"topology_valid={topology_valid}; valid={valid}; "
        "scope=weights_and_adjacency_only; "
        "contact_friction_crushing_and_pin_capacity_not_checked"
    )
    return centroids, loads, joint_ids, pair_ids, valid, report


try:
    _component_inputs = (
        Blocks,
        JointPlanes,
        JointProfiles,
        BlockIDs,
        UnitWeight,
    )
except NameError:
    _component_inputs = None

if _component_inputs is not None:
    (
        BlockCentroids,
        BlockLoads,
        JointIDs,
        JointBlockPairs,
        Valid,
        Report,
    ) = create_block_weight_and_joint_adjacency(*_component_inputs)
# ---------- end _07a_块重与接缝邻接 ----------
# ---- group: 07B 全方向接缝合力
# 07B 全方向接缝合力｜备注: 基于04网络、02荷载及实际接缝作方向诊断。
# kh=a_h/g=0.40；角度表示惯性力方向，与基底加速度反向。
# 5°粗扫、1°细化、初始±5°窗口；细化目标为滑移缺额。
# 明确自由节点/支承节点重量划分及竖向荷载输入检查。
# N为投影幅值，不是反转前有符号审计量S(θ)。
# 约束节点平动，不解决块体力矩、接触重分配或动力响应。
_07b_全方向接缝合力 = Python3Script(
    TNAEdges=_04_压缩平衡与包含.TNAEdges,
    NodalLoads=_02_实际自重.NodalLoads,
    JointPlanes=_06_引导径向分块.JointPlanes,
    JointProfiles=_06_引导径向分块.JointProfiles,
    JointIDs=_07a_块重与接缝邻接.JointIDs,
    JointBlockPairs=_07a_块重与接缝邻接.JointBlockPairs,
    HorizontalLoadRatio=kh_水平系数,
    HorizontalAngleStepDegrees=粗扫角步长,
    RefinementAngleStepDegrees=细化角步长,
    RefinementHalfWidthDegrees=初始细化半宽,
    FrictionCoefficient=μ_摩擦系数,
    SlidingSafetyFactor=γs_滑移系数)  # -> out, CaseAngles, CaseJointIDs, ContactPoints, ContactResultants, TangentialForces, Valid, Report; inputs TNAEdges: list of Line, NodalLoads: list of Vector3d, JointPlanes: list of Plane, JointProfiles: list of Curve, JointIDs: list, JointBlockPairs: list
# ---------- _07b_全方向接缝合力: Python ----------
#! python 3
"""Stage 07B - unified ideal and horizontal-study joint resultants.

Grasshopper Python inputs:
    TNAEdges             list[Line]   TNAEdges from Stage 04 (List)
    NodalLoads           list[Vector] NodalLoads from Stage 02 (List, kN)
    JointPlanes          list[Plane]  JointPlanes from Stage 06 (List)
    JointProfiles        list[Curve]  JointProfiles from Stage 06 (List)
    JointIDs             list[str]    JointIDs from Stage 07A (List)
    JointBlockPairs      list[pair]   JointBlockPairs from Stage 07A (List)
    HorizontalLoadRatio  float        k_h = a_h/g (Item, non-negative)
    HorizontalAngleStepDegrees float  Coarse sweep step (Item, degrees)
    RefinementAngleStepDegrees float  Local refinement step (Item, degrees)
    RefinementHalfWidthDegrees float  Initial half-width (Item, degrees)
    FrictionCoefficient float         Same empirical value as Stages 07E/07F
    SlidingSafetyFactor float         Same empirical value as Stages 07E/07F

Outputs:
    CaseAngles, CaseJointIDs, ContactPoints, ContactResultants,
    TangentialForces, Valid, Report

HorizontalLoadRatio is the dimensionless coefficient k_h = a_h/g. CaseAngles
denote the direction of the equivalent horizontal inertia force applied to the
Stage 02 lumped nodal masses; they do not denote the direction of base/ground
acceleration. The corresponding base-acceleration direction is
(CaseAngle + 180 degrees) modulo 360 degrees.

HorizontalLoadRatio=0 uses one exact axial TNA baseline case and returns
strictly zero tangential force. A positive ratio first sweeps 0 <= angle < 360
at HorizontalAngleStepDegrees. For every joint it then refines the coarse
local-maximum candidates of the signed Stage 07F sliding deficit within
plus/minus RefinementHalfWidthDegrees at RefinementAngleStepDegrees. Refining
all coarse local maxima avoids assuming that the response has only one smooth
peak. If a maximum remains on a refinement boundary, that boundary is extended
until the maximum is interior or the complete 360-degree domain has been
covered. Outputs are flattened case-major lists: each CaseAngles entry owns one
consecutive JointIDs-sized block in CaseJointIDs and the three result lists.

Only Stage 02 weights at free TNA nodes enter the internal vector-equilibrium
target. Stage 02 weights located at support nodes are reported separately and
are interpreted as balanced by local support reactions; they are not hidden or
claimed to enter the free-node solve. This model enforces translational force
equilibrium at free TNA nodes only. It does not solve individual block moments,
support-contact redistribution or dynamic response.

The method is a mass-proportional, full-direction equivalent-static inertia
sensitivity study under uniform base acceleration. It is not an earthquake
safety check, response-spectrum analysis, time-history analysis or structural
safety proof.
"""

import math

import numpy as np
import Rhino
import Rhino.Geometry as rg


COMPRESSION_EPSILON = 1.0e-8
MAX_ALIGNMENT_ERROR_DEGREES = 0.001
REFINEMENT_SCORE_TOLERANCE_KN = 1.0e-10
LOAD_COMPONENT_TOLERANCE_KN = 1.0e-9
WEIGHT_PARTITION_RELATIVE_TOLERANCE = 1.0e-12


def _as_list(value):
    if value is None:
        return []
    if isinstance(value, str):
        return [value]
    try:
        return list(value)
    except TypeError:
        return [value]


def _document_tolerance():
    document = Rhino.RhinoDoc.ActiveDoc
    return document.ModelAbsoluteTolerance if document is not None else 1.0e-3


def _coerce_line(value):
    if isinstance(value, rg.Line):
        return rg.Line(value.From, value.To)
    if isinstance(value, rg.LineCurve):
        return rg.Line(value.PointAtStart, value.PointAtEnd)
    if hasattr(value, "Value"):
        return _coerce_line(value.Value)
    return None


def _coerce_vector(value):
    if isinstance(value, rg.Vector3d):
        return rg.Vector3d(value)
    if hasattr(value, "Value"):
        return _coerce_vector(value.Value)
    try:
        return rg.Vector3d(value)
    except Exception:
        return None


def _validated_stage02_weights(loads):
    weights = []
    for index, load in enumerate(loads):
        components = (float(load.X), float(load.Y), float(load.Z))
        if not all(math.isfinite(value) for value in components):
            raise ValueError(
                "NodalLoads contains a non-finite vector at index {0}."
                .format(index)
            )
        component_tolerance = max(
            LOAD_COMPONENT_TOLERANCE_KN,
            abs(components[2]) * WEIGHT_PARTITION_RELATIVE_TOLERANCE,
        )
        if (
            abs(components[0]) > component_tolerance
            or abs(components[1]) > component_tolerance
        ):
            raise ValueError(
                "NodalLoads must contain vertical Stage 02 self-weight only; "
                "index {0} has a horizontal component.".format(index)
            )
        weight = -components[2]
        if weight < -component_tolerance:
            raise ValueError(
                "NodalLoads contains a negative nodal weight at index {0}."
                .format(index)
            )
        weights.append(max(0.0, weight))
    if sum(weights) <= LOAD_COMPONENT_TOLERANCE_KN:
        raise ValueError("NodalLoads must contain positive total Stage 02 weight.")
    return weights


def _coerce_plane(value):
    if isinstance(value, rg.Plane):
        return rg.Plane(value)
    if hasattr(value, "Value") and isinstance(value.Value, rg.Plane):
        return rg.Plane(value.Value)
    return None


def _coerce_curve(value):
    if isinstance(value, rg.Curve):
        return value
    if hasattr(value, "Value") and isinstance(value.Value, rg.Curve):
        return value.Value
    return None


def _coerce_pair(value):
    if value is None:
        return None
    if hasattr(value, "Value"):
        return _coerce_pair(value.Value)
    try:
        items = list(value)
    except TypeError:
        return None
    if len(items) != 2:
        return None
    return str(items[0]), str(items[1])


def _finite_number(value, name, minimum=None):
    try:
        number = float(value)
    except (TypeError, ValueError):
        raise ValueError("{0} must be a number.".format(name))
    if not math.isfinite(number) or (
        minimum is not None and number < minimum
    ):
        raise ValueError(
            "{0} must be finite and at least {1}.".format(name, minimum)
        )
    return number


def _point_key(point, tolerance):
    scale = 1.0 / max(tolerance, 1.0e-9)
    return (
        int(round(point.X * scale)),
        int(round(point.Y * scale)),
        int(round(point.Z * scale)),
    )


def _ordered_network(lines, tolerance):
    points = []
    key_to_index = {}
    edges = []
    seen = set()

    def vertex_index(point):
        key = _point_key(point, tolerance)
        if key not in key_to_index:
            key_to_index[key] = len(points)
            points.append(rg.Point3d(point))
        return key_to_index[key]

    for line in lines:
        if not line.IsValid or line.Length <= tolerance:
            raise ValueError("TNAEdges contains an invalid or zero-length line.")
        a = vertex_index(line.From)
        b = vertex_index(line.To)
        key = tuple(sorted((a, b)))
        if key in seen:
            raise ValueError("TNAEdges contains a duplicate edge.")
        seen.add(key)
        edges.append((a, b))
    return points, edges


def _radial_topology(points, edges):
    adjacency = [[] for _ in points]
    for edge_index, (a, b) in enumerate(edges):
        adjacency[a].append((b, edge_index))
        adjacency[b].append((a, edge_index))
    supports = [
        index for index, neighbours in enumerate(adjacency)
        if len(neighbours) == 1 and points[index].Z <= 1.0e-6
    ]
    crowns = [
        index for index, neighbours in enumerate(adjacency)
        if len(neighbours) >= 3
    ]
    if len(crowns) != 1 or len(supports) < 3:
        raise ValueError("TNAEdges must form one radial crown-to-support tree.")
    if len(edges) != len(points) - 1:
        raise ValueError("TNAEdges must form a connected tree.")
    return adjacency, crowns[0], supports


def _recover_ideal_force_densities(points, edges, adjacency, supports, loads):
    support_set = set(supports)
    free = [index for index in range(len(points)) if index not in support_set]
    matrix = np.zeros((3 * len(free), len(edges)), dtype=float)
    target = np.zeros(3 * len(free), dtype=float)
    for local_index, node_index in enumerate(free):
        point = points[node_index]
        load = loads[node_index]
        target[3 * local_index:3 * local_index + 3] = (
            load.X, load.Y, load.Z
        )
        for neighbour, edge_index in adjacency[node_index]:
            other = points[neighbour]
            matrix[3 * local_index:3 * local_index + 3, edge_index] = (
                point.X - other.X,
                point.Y - other.Y,
                point.Z - other.Z,
            )
    q, residual_values, rank, singular_values = np.linalg.lstsq(
        matrix, target, rcond=None
    )
    residual = float(np.linalg.norm(matrix.dot(q) - target))
    total_weight = -sum(load.Z for load in loads)
    tolerance = max(1.0e-6, total_weight * 1.0e-6)
    forces = [
        -float(q[index]) * points[a].DistanceTo(points[b])
        for index, (a, b) in enumerate(edges)
    ]
    valid = (
        int(rank) == len(edges)
        and residual <= tolerance
        and all(float(value) < -COMPRESSION_EPSILON for value in q)
        and all(value > COMPRESSION_EPSILON for value in forces)
    )
    return q, forces, residual, tolerance, int(rank), free, valid


def _vector_equilibrium_matrix(points, edges, free):
    row_by_node = {node: index for index, node in enumerate(free)}
    matrix = np.zeros((3 * len(free), 3 * len(edges)), dtype=float)
    identity = np.eye(3)
    for edge_index, (a, b) in enumerate(edges):
        column = slice(3 * edge_index, 3 * edge_index + 3)
        if a in row_by_node:
            row = 3 * row_by_node[a]
            matrix[row:row + 3, column] += identity
        if b in row_by_node:
            row = 3 * row_by_node[b]
            matrix[row:row + 3, column] -= identity
    return matrix


def _ideal_edge_vectors(points, edges, force_densities):
    values = np.zeros(3 * len(edges), dtype=float)
    for edge_index, (a, b) in enumerate(edges):
        delta = points[a] - points[b]
        values[3 * edge_index:3 * edge_index + 3] = (
            float(force_densities[edge_index])
            * np.array([delta.X, delta.Y, delta.Z], dtype=float)
        )
    return values


def _profile_centroid(profile):
    properties = rg.AreaMassProperties.Compute(profile)
    if properties is None:
        raise RuntimeError("Could not compute a JointProfile centroid.")
    try:
        return rg.Point3d(properties.Centroid)
    finally:
        properties.Dispose()


def _line_plane_candidate(line, plane, tolerance):
    normal = rg.Vector3d(plane.Normal)
    direction = rg.Vector3d(line.Direction)
    if not normal.Unitize() or not direction.Unitize():
        return None
    denominator = rg.Vector3d.Multiply(line.Direction, normal)
    if abs(denominator) <= 1.0e-12:
        return None
    origin_delta = rg.Vector3d(
        plane.Origin.X - line.From.X,
        plane.Origin.Y - line.From.Y,
        plane.Origin.Z - line.From.Z,
    )
    parameter = rg.Vector3d.Multiply(origin_delta, normal) / denominator
    parameter_tolerance = tolerance / max(line.Length, tolerance)
    if parameter < -parameter_tolerance or parameter > 1.0 + parameter_tolerance:
        return None
    parameter = min(max(parameter, 0.0), 1.0)
    point = line.PointAt(parameter)
    alignment = abs(rg.Vector3d.Multiply(direction, normal))
    alignment = min(max(alignment, -1.0), 1.0)
    return point, math.degrees(math.acos(alignment))


def _map_joint(profile, plane, lines, tolerance):
    centroid = _profile_centroid(profile)
    candidates = []
    for edge_index, line in enumerate(lines):
        candidate = _line_plane_candidate(line, plane, tolerance)
        if candidate is None:
            continue
        point, angle_error = candidate
        if angle_error > MAX_ALIGNMENT_ERROR_DEGREES:
            continue
        containment = profile.Contains(point, plane, tolerance)
        if containment not in (
            rg.PointContainment.Inside,
            rg.PointContainment.Coincident,
        ):
            continue
        candidates.append(
            (angle_error, point.DistanceTo(centroid), edge_index, point)
        )
    if not candidates:
        return None
    candidates.sort(key=lambda item: (item[0], item[1], item[2]))
    return candidates[0]


def _free_load_target(loads, free):
    target = np.zeros(3 * len(free), dtype=float)
    for local_index, node_index in enumerate(free):
        load = loads[node_index]
        target[3 * local_index:3 * local_index + 3] = (
            load.X, load.Y, load.Z
        )
    return target


def _horizontal_load_targets(loads, free):
    target_x = np.zeros(3 * len(free), dtype=float)
    target_y = np.zeros(3 * len(free), dtype=float)
    for local_index, node_index in enumerate(free):
        weight = max(0.0, -loads[node_index].Z)
        target_x[3 * local_index] = weight
        target_y[3 * local_index + 1] = weight
    return target_x, target_y


def _prepare_joint_resultants(
    tna_edges,
    nodal_loads,
    joint_planes,
    joint_profiles,
    joint_ids,
    joint_block_pairs,
):
    tolerance = _document_tolerance()
    lines = [_coerce_line(value) for value in _as_list(tna_edges)]
    loads = [_coerce_vector(value) for value in _as_list(nodal_loads)]
    planes = [_coerce_plane(value) for value in _as_list(joint_planes)]
    profiles = [_coerce_curve(value) for value in _as_list(joint_profiles)]
    identifiers = [str(value) for value in _as_list(joint_ids)]
    pairs = [_coerce_pair(value) for value in _as_list(joint_block_pairs)]
    if not lines or any(value is None for value in lines):
        raise ValueError("TNAEdges must contain valid lines.")
    if any(value is None for value in loads):
        raise ValueError("NodalLoads must contain valid vectors.")
    joint_count = len(planes)
    if (
        not joint_count
        or len(profiles) != joint_count
        or len(identifiers) != joint_count
        or len(pairs) != joint_count
        or any(value is None for value in planes + profiles)
        or any(value is None or value[0] == value[1] for value in pairs)
    ):
        raise ValueError(
            "JointPlanes, JointProfiles, JointIDs and JointBlockPairs must "
            "correspond one-to-one."
        )
    if len(set(identifiers)) != joint_count:
        raise ValueError("JointIDs must be unique.")

    points, edges = _ordered_network(
        lines, max(tolerance * 0.1, 1.0e-7)
    )
    if len(loads) != len(points):
        raise ValueError("NodalLoads must correspond to the ordered TNA nodes.")
    nodal_weights = _validated_stage02_weights(loads)
    adjacency, crown, supports = _radial_topology(points, edges)
    (
        force_densities,
        ideal_forces,
        ideal_residual,
        ideal_tolerance,
        ideal_rank,
        free,
        ideal_valid,
    ) = _recover_ideal_force_densities(
        points, edges, adjacency, supports, loads
    )
    total_nodal_weight = sum(nodal_weights)
    free_node_weight = sum(nodal_weights[index] for index in free)
    support_node_weight = sum(nodal_weights[index] for index in supports)
    weight_partition_error = abs(
        total_nodal_weight - free_node_weight - support_node_weight
    )
    weight_partition_tolerance = max(
        LOAD_COMPONENT_TOLERANCE_KN,
        total_nodal_weight * WEIGHT_PARTITION_RELATIVE_TOLERANCE,
    )
    if weight_partition_error > weight_partition_tolerance:
        raise RuntimeError(
            "Stage 02 nodal weights do not close between free and support nodes."
        )

    contact_points = []
    angle_errors = []
    mapped_edges = []
    failures = []
    for index, (plane, profile) in enumerate(zip(planes, profiles)):
        mapped = _map_joint(profile, plane, lines, tolerance)
        if mapped is None:
            failures.append((
                index, identifiers[index], "no_TNA_joint_intersection"
            ))
            continue
        angle_error, centroid_distance, edge_index, point = mapped
        contact_points.append(point)
        angle_errors.append(angle_error)
        mapped_edges.append(edge_index)

    mapping_valid = not failures and len(contact_points) == joint_count
    equilibrium = None
    ideal_vectors = None
    correction_basis = None
    vector_rank = 0
    if mapping_valid:
        equilibrium = _vector_equilibrium_matrix(points, edges, free)
        ideal_vectors = _ideal_edge_vectors(points, edges, force_densities)
        base_target = _free_load_target(loads, free)
        horizontal_x, horizontal_y = _horizontal_load_targets(loads, free)
        correction_targets = np.column_stack((
            base_target - equilibrium.dot(ideal_vectors),
            horizontal_x,
            horizontal_y,
        ))
        correction_basis, residual_values, vector_rank, singular_values = (
            np.linalg.lstsq(equilibrium, correction_targets, rcond=None)
        )

    return {
        "tolerance": tolerance,
        "lines": lines,
        "loads": loads,
        "planes": planes,
        "profiles": profiles,
        "identifiers": identifiers,
        "pairs": pairs,
        "joint_count": joint_count,
        "points": points,
        "edges": edges,
        "crown": crown,
        "supports": supports,
        "free": free,
        "force_densities": force_densities,
        "ideal_forces": ideal_forces,
        "ideal_residual": ideal_residual,
        "ideal_tolerance": ideal_tolerance,
        "ideal_rank": ideal_rank,
        "ideal_valid": ideal_valid,
        "contact_points": contact_points,
        "angle_errors": angle_errors,
        "mapped_edges": mapped_edges,
        "mapping_failures": failures,
        "mapping_valid": mapping_valid,
        "equilibrium": equilibrium,
        "ideal_vectors": ideal_vectors,
        "correction_basis": correction_basis,
        "vector_rank": int(vector_rank),
        "total_nodal_weight": total_nodal_weight,
        "free_node_weight": free_node_weight,
        "support_node_weight": support_node_weight,
        "weight_partition_error": weight_partition_error,
        "weight_partition_tolerance": weight_partition_tolerance,
    }


def _evaluate_prepared_joint_resultants(
    prepared,
    horizontal_load_ratio,
    horizontal_load_angle,
):
    ratio = _finite_number(
        horizontal_load_ratio, "HorizontalLoadRatio", minimum=0.0
    )
    angle = _finite_number(
        horizontal_load_angle, "HorizontalLoadAngle"
    )
    radians = math.radians(angle)
    direction = rg.Vector3d(math.cos(radians), math.sin(radians), 0.0)

    lines = prepared["lines"]
    loads = prepared["loads"]
    planes = prepared["planes"]
    identifiers = prepared["identifiers"]
    joint_count = prepared["joint_count"]
    points = prepared["points"]
    edges = prepared["edges"]
    crown = prepared["crown"]
    supports = prepared["supports"]
    free = prepared["free"]
    ideal_forces = prepared["ideal_forces"]
    ideal_residual = prepared["ideal_residual"]
    ideal_tolerance = prepared["ideal_tolerance"]
    ideal_rank = prepared["ideal_rank"]
    ideal_valid = prepared["ideal_valid"]
    contact_points = prepared["contact_points"]
    angle_errors = prepared["angle_errors"]
    mapped_edges = prepared["mapped_edges"]
    failures = list(prepared["mapping_failures"])
    mapping_valid = prepared["mapping_valid"]

    contact_resultants = []
    tangential_forces = []
    normal_forces = []
    load_case = "ideal" if ratio == 0.0 else "horizontal_sensitivity"
    equilibrium_valid = True
    vector_rank_text = "not_applicable"
    residual = ideal_residual
    residual_tolerance = ideal_tolerance
    correction_norm = 0.0
    total_nodal_weight = prepared["total_nodal_weight"]
    free_node_weight = prepared["free_node_weight"]
    support_node_weight = prepared["support_node_weight"]
    free_horizontal_resultant = ratio * free_node_weight
    full_structure_inertia_resultant = ratio * total_nodal_weight
    support_local_inertia_resultant = ratio * support_node_weight
    ground_acceleration_angle = (angle + 180.0) % 360.0

    if mapping_valid and ratio == 0.0:
        for plane, edge_index in zip(planes, mapped_edges):
            normal = rg.Vector3d(plane.Normal)
            normal.Unitize()
            magnitude = ideal_forces[edge_index]
            contact_resultants.append(normal * magnitude)
            tangential_forces.append(0.0)
            normal_forces.append(magnitude)
    elif mapping_valid:
        equilibrium = prepared["equilibrium"]
        ideal_vectors = prepared["ideal_vectors"]
        correction_basis = prepared["correction_basis"]
        correction = (
            correction_basis[:, 0]
            + ratio * (
                math.cos(radians) * correction_basis[:, 1]
                + math.sin(radians) * correction_basis[:, 2]
            )
        )
        solved_vectors = ideal_vectors + correction
        target = _free_load_target(loads, free)
        horizontal_x, horizontal_y = _horizontal_load_targets(loads, free)
        target += ratio * (
            math.cos(radians) * horizontal_x
            + math.sin(radians) * horizontal_y
        )
        residual = float(np.linalg.norm(
            equilibrium.dot(solved_vectors) - target
        ))
        total_weight = -sum(load.Z for load in loads)
        residual_tolerance = max(1.0e-7, total_weight * 1.0e-8)
        equilibrium_valid = (
            prepared["vector_rank"] == equilibrium.shape[0]
            and residual <= residual_tolerance
        )
        vector_rank_text = "{0}/{1}".format(
            prepared["vector_rank"], equilibrium.shape[0]
        )
        correction_norm = float(np.linalg.norm(correction))
        for index, (plane, edge_index) in enumerate(zip(planes, mapped_edges)):
            vector = rg.Vector3d(
                solved_vectors[3 * edge_index],
                solved_vectors[3 * edge_index + 1],
                solved_vectors[3 * edge_index + 2],
            )
            normal = rg.Vector3d(plane.Normal)
            normal.Unitize()
            if rg.Vector3d.Multiply(vector, normal) < 0.0:
                vector = -vector
            normal_force = rg.Vector3d.Multiply(vector, normal)
            tangential = vector - normal * normal_force
            if normal_force <= COMPRESSION_EPSILON:
                failures.append((
                    index, identifiers[index], "nonpositive_normal_force"
                ))
                continue
            contact_resultants.append(vector)
            tangential_forces.append(tangential.Length)
            normal_forces.append(normal_force)

    mapping_valid = (
        mapping_valid
        and not failures
        and len(contact_resultants) == joint_count
        and len(tangential_forces) == joint_count
    )
    valid = ideal_valid and equilibrium_valid and mapping_valid
    report = (
        f"stage=joint_resultants; load_case={load_case}; nodes={len(points)}; "
        f"edges={len(edges)}; free_nodes={len(free)}; supports={len(supports)}; "
        f"crown_node={crown}; horizontal_load_ratio={ratio:.6g}; "
        "kh_definition=a_h_over_g; "
        f"equivalent_inertia_force_angle_deg={angle:.6g}; "
        f"corresponding_base_acceleration_angle_deg="
        f"{ground_acceleration_angle:.6g}; "
        f"horizontal_direction=({direction.X:.6g},{direction.Y:.6g},0); "
        f"stage02_total_nodal_weight_kN={total_nodal_weight:.12g}; "
        f"free_node_weight_kN={free_node_weight:.12g}; "
        f"support_node_weight_kN={support_node_weight:.12g}; "
        f"weight_partition_error_kN="
        f"{prepared['weight_partition_error']:.12g}; "
        f"free_node_horizontal_target_resultant_kN="
        f"{free_horizontal_resultant:.12g}; "
        f"full_structure_equivalent_inertia_resultant_kN="
        f"{full_structure_inertia_resultant:.12g}; "
        f"support_local_inertia_resultant_kN="
        f"{support_local_inertia_resultant:.12g}; "
        f"ideal_force_density_rank={ideal_rank}/{len(edges)}; "
        f"ideal_equilibrium_residual_kN={ideal_residual:.6g}; "
        f"ideal_valid={ideal_valid}; "
        f"vector_equilibrium_rank={vector_rank_text}; "
        f"vector_equilibrium_residual_kN={residual:.6g}; "
        f"vector_equilibrium_tolerance_kN={residual_tolerance:.6g}; "
        f"force_vector_correction_norm_kN={correction_norm:.6g}; "
        f"joints_mapped={len(contact_resultants)}/{joint_count}; "
        f"normal_force_min_max_kN="
        f"({min(normal_forces) if normal_forces else 0.0:.6g},"
        f"{max(normal_forces) if normal_forces else 0.0:.6g}); "
        f"tangential_force_min_max_kN="
        f"({min(tangential_forces) if tangential_forces else 0.0:.6g},"
        f"{max(tangential_forces) if tangential_forces else 0.0:.6g}); "
        f"max_alignment_error_deg="
        f"{max(angle_errors) if angle_errors else 0.0:.6g}; "
        f"mapped_tna_edge_indices={mapped_edges}; failures={failures}; "
        f"equilibrium_valid={equilibrium_valid}; "
        f"mapping_valid={mapping_valid}; valid={valid}; "
        f"solution={'exact_ideal_axial' if ratio == 0.0 else 'min_change_from_ideal_axial_vectors'}; "
        "resultant_convention=second_block_on_first_block; "
        "case_angle_convention=equivalent_inertia_force_direction; "
        "base_acceleration_direction=(inertia_force_angle+180deg)_mod_360; "
        "support_node_inertia_treatment=local_support_reaction_not_free_node_solve; "
        f"scope={'TNA_compression_mapping_only' if ratio == 0.0 else 'mass_proportional_uniform_base_acceleration_full_direction_equivalent_static_inertia_sensitivity'}; "
        "free_TNA_node_translational_equilibrium_only; "
        "block_moments_support_contact_distribution_and_dynamic_response_not_checked; "
        "not_earthquake_safety_response_spectrum_or_time_history_analysis"
    )
    return (
        list(contact_points),
        contact_resultants,
        tangential_forces,
        valid,
        report,
    )


def create_joint_resultants(
    tna_edges,
    nodal_loads,
    joint_planes,
    joint_profiles,
    joint_ids,
    joint_block_pairs,
    horizontal_load_ratio,
    horizontal_load_angle,
):
    prepared = _prepare_joint_resultants(
        tna_edges,
        nodal_loads,
        joint_planes,
        joint_profiles,
        joint_ids,
        joint_block_pairs,
    )
    return _evaluate_prepared_joint_resultants(
        prepared,
        horizontal_load_ratio,
        horizontal_load_angle,
    )


def _direction_angles(horizontal_load_ratio, angle_step_degrees):
    ratio = _finite_number(
        horizontal_load_ratio, "HorizontalLoadRatio", minimum=0.0
    )
    if ratio == 0.0:
        return ratio, [0.0]
    step = _finite_number(
        angle_step_degrees, "HorizontalAngleStepDegrees", minimum=1.0e-9
    )
    divisions = 360.0 / step
    rounded = int(round(divisions))
    if rounded < 2 or rounded > 720 or abs(divisions - rounded) > 1.0e-9:
        raise ValueError(
            "HorizontalAngleStepDegrees must divide 360 exactly and produce "
            "between 2 and 720 directional cases."
        )
    return ratio, [index * step for index in range(rounded)]


def _canonical_angle(angle):
    value = float(angle) % 360.0
    if abs(value - 360.0) <= 1.0e-9 or abs(value) <= 1.0e-9:
        value = 0.0
    return round(value, 10)


def _refinement_parameters(
    coarse_step_degrees,
    refinement_step_degrees,
    refinement_half_width_degrees,
    friction_coefficient,
    sliding_safety_factor,
):
    coarse_step = _finite_number(
        coarse_step_degrees, "HorizontalAngleStepDegrees", minimum=1.0e-9
    )
    refinement_step = _finite_number(
        refinement_step_degrees,
        "RefinementAngleStepDegrees",
        minimum=1.0e-9,
    )
    half_width = _finite_number(
        refinement_half_width_degrees,
        "RefinementHalfWidthDegrees",
        minimum=refinement_step,
    )
    friction = _finite_number(
        friction_coefficient, "FrictionCoefficient", minimum=1.0e-12
    )
    sliding_factor = _finite_number(
        sliding_safety_factor, "SlidingSafetyFactor", minimum=1.0e-12
    )
    coarse_ratio = coarse_step / refinement_step
    half_width_ratio = half_width / refinement_step
    full_circle_ratio = 360.0 / refinement_step
    if (
        abs(coarse_ratio - round(coarse_ratio)) > 1.0e-9
        or abs(half_width_ratio - round(half_width_ratio)) > 1.0e-9
        or abs(full_circle_ratio - round(full_circle_ratio)) > 1.0e-9
    ):
        raise ValueError(
            "RefinementAngleStepDegrees must divide the coarse step, "
            "RefinementHalfWidthDegrees and 360 exactly."
        )
    if refinement_step > coarse_step + 1.0e-12:
        raise ValueError(
            "RefinementAngleStepDegrees must not exceed "
            "HorizontalAngleStepDegrees."
        )
    if int(round(full_circle_ratio)) > 720:
        raise ValueError(
            "RefinementAngleStepDegrees must produce no more than 720 "
            "directions over 360 degrees."
        )
    return refinement_step, half_width, friction, sliding_factor


def _signed_sliding_deficit(resultant, plane, friction, sliding_factor):
    normal = rg.Vector3d(plane.Normal)
    if not normal.Unitize():
        raise ValueError("JointPlanes contains a degenerate plane.")
    force = rg.Vector3d(resultant)
    normal_force = rg.Vector3d.Multiply(force, normal)
    tangent = force - normal * normal_force
    return sliding_factor * tangent.Length - friction * normal_force


def _adaptive_refinement_window(
    coarse_peak_angle,
    score_at_angle,
    refinement_step_degrees,
    refinement_half_width_degrees,
):
    step = float(refinement_step_degrees)
    half_width = float(refinement_half_width_degrees)
    lower = float(coarse_peak_angle) - half_width
    upper = float(coarse_peak_angle) + half_width
    evaluated = set()
    expansions = 0
    full_circle_covered = False

    while True:
        count = int(round((upper - lower) / step))
        unwrapped = [lower + index * step for index in range(count + 1)]
        for angle in unwrapped:
            evaluated.add(_canonical_angle(angle))
        scores = [float(score_at_angle(angle)) for angle in unwrapped]
        maximum = max(scores)
        lower_is_peak = (
            scores[0] >= maximum - REFINEMENT_SCORE_TOLERANCE_KN
        )
        upper_is_peak = (
            scores[-1] >= maximum - REFINEMENT_SCORE_TOLERANCE_KN
        )
        if not lower_is_peak and not upper_is_peak:
            break
        if upper - lower + step >= 360.0 - 1.0e-9:
            full_circle_covered = True
            break
        if lower_is_peak:
            lower -= half_width
        if upper_is_peak:
            upper += half_width
        expansions += 1

    final_count = int(round((upper - lower) / step))
    final_unwrapped = [lower + index * step for index in range(final_count + 1)]
    final_scores = [float(score_at_angle(angle)) for angle in final_unwrapped]
    maximum = max(final_scores)
    peak_candidates = [
        angle
        for angle, score in zip(final_unwrapped, final_scores)
        if score >= maximum - REFINEMENT_SCORE_TOLERANCE_KN
    ]
    interior_candidates = [
        angle
        for angle in peak_candidates
        if angle > lower + 1.0e-9 and angle < upper - 1.0e-9
    ]
    selected = (
        min(interior_candidates, key=lambda value: _canonical_angle(value))
        if interior_candidates
        else min(peak_candidates, key=lambda value: _canonical_angle(value))
    )
    return (
        sorted(evaluated),
        _canonical_angle(selected),
        maximum,
        expansions,
        full_circle_covered,
    )


def create_directional_joint_resultants(
    tna_edges,
    nodal_loads,
    joint_planes,
    joint_profiles,
    joint_ids,
    joint_block_pairs,
    horizontal_load_ratio,
    horizontal_angle_step_degrees,
    refinement_angle_step_degrees=1.0,
    refinement_half_width_degrees=5.0,
    friction_coefficient=0.55,
    sliding_safety_factor=1.5,
):
    ratio, coarse_angles = _direction_angles(
        horizontal_load_ratio, horizontal_angle_step_degrees
    )
    identifiers = [str(value) for value in _as_list(joint_ids)]
    planes = [_coerce_plane(value) for value in _as_list(joint_planes)]
    if (
        not identifiers
        or len(planes) != len(identifiers)
        or any(value is None for value in planes)
    ):
        raise ValueError("JointPlanes and JointIDs must correspond one-to-one.")
    if ratio > 0.0:
        (
            refinement_step,
            refinement_half_width,
            friction,
            sliding_factor,
        ) = _refinement_parameters(
            horizontal_angle_step_degrees,
            refinement_angle_step_degrees,
            refinement_half_width_degrees,
            friction_coefficient,
            sliding_safety_factor,
        )
    else:
        refinement_step = 0.0
        refinement_half_width = 0.0
        friction = 0.0
        sliding_factor = 0.0

    result_cache = {}
    case_failures = []
    prepared = _prepare_joint_resultants(
        tna_edges,
        nodal_loads,
        joint_planes,
        joint_profiles,
        joint_ids,
        joint_block_pairs,
    )

    def evaluate(angle):
        canonical = _canonical_angle(angle)
        if canonical not in result_cache:
            result = _evaluate_prepared_joint_resultants(
                prepared,
                ratio,
                canonical,
            )
            result_cache[canonical] = result
            if not result[3]:
                case_failures.append((canonical, result[4]))
        return result_cache[canonical]

    for angle in coarse_angles:
        evaluate(angle)

    coarse_peak_angles = []
    coarse_candidate_angles = []
    refined_peak_angles = []
    refined_peak_deficits = []
    boundary_expansions = []
    full_circle_refinements = []
    if ratio > 0.0 and not case_failures:
        for joint_index, plane in enumerate(planes):
            coarse_scores = [
                _signed_sliding_deficit(
                    evaluate(angle)[1][joint_index],
                    plane,
                    friction,
                    sliding_factor,
                )
                for angle in coarse_angles
            ]
            coarse_maximum = max(coarse_scores)
            coarse_peak = min(
                angle
                for angle, score in zip(coarse_angles, coarse_scores)
                if score >= coarse_maximum - REFINEMENT_SCORE_TOLERANCE_KN
            )
            coarse_peak_angles.append(coarse_peak)
            candidate_indices = []
            for index, score in enumerate(coarse_scores):
                previous = coarse_scores[index - 1]
                following = coarse_scores[(index + 1) % len(coarse_scores)]
                is_not_lower = (
                    score >= previous - REFINEMENT_SCORE_TOLERANCE_KN
                    and score >= following - REFINEMENT_SCORE_TOLERANCE_KN
                )
                is_not_flat = (
                    score > previous + REFINEMENT_SCORE_TOLERANCE_KN
                    or score > following + REFINEMENT_SCORE_TOLERANCE_KN
                )
                if is_not_lower and is_not_flat:
                    candidate_indices.append(index)
            if not candidate_indices:
                candidate_indices = [coarse_angles.index(coarse_peak)]
            candidate_angles = [
                coarse_angles[index] for index in candidate_indices
            ]
            if coarse_peak not in candidate_angles:
                candidate_angles.append(coarse_peak)
                candidate_angles.sort()
            coarse_candidate_angles.append(candidate_angles)

            def score_at_angle(angle, index=joint_index, joint_plane=plane):
                result = evaluate(angle)
                if not result[3]:
                    return float("-inf")
                return _signed_sliding_deficit(
                    result[1][index],
                    joint_plane,
                    friction,
                    sliding_factor,
                )

            candidate_results = []
            for candidate_angle in candidate_angles:
                result = _adaptive_refinement_window(
                    candidate_angle,
                    score_at_angle,
                    refinement_step,
                    refinement_half_width,
                )
                for angle in result[0]:
                    evaluate(angle)
                candidate_results.append(result)
            best_deficit = max(value[2] for value in candidate_results)
            best_candidates = [
                value
                for value in candidate_results
                if value[2]
                >= best_deficit - REFINEMENT_SCORE_TOLERANCE_KN
            ]
            best = min(best_candidates, key=lambda value: value[1])
            refined_peak_angles.append(best[1])
            refined_peak_deficits.append(best[2])
            boundary_expansions.append(
                sum(value[3] for value in candidate_results)
            )
            full_circle_refinements.append(
                any(value[4] for value in candidate_results)
            )
    elif ratio == 0.0:
        coarse_peak_angles = [0.0] * len(identifiers)
        coarse_candidate_angles = [[0.0] for value in identifiers]
        refined_peak_angles = [0.0] * len(identifiers)
        refined_peak_deficits = [0.0] * len(identifiers)
        boundary_expansions = [0] * len(identifiers)
        full_circle_refinements = [False] * len(identifiers)

    angles = sorted(result_cache)
    case_joint_ids = []
    contact_points = []
    contact_resultants = []
    tangential_forces = []
    for angle in angles:
        result = result_cache[angle]
        if not result[3]:
            continue
        case_joint_ids.extend(identifiers)
        contact_points.extend(result[0])
        contact_resultants.extend(result[1])
        tangential_forces.extend(result[2])

    expected_rows = len(angles) * len(identifiers)
    total_nodal_weight = prepared["total_nodal_weight"]
    free_node_weight = prepared["free_node_weight"]
    support_node_weight = prepared["support_node_weight"]
    valid = (
        not case_failures
        and len(case_joint_ids)
        == len(contact_points)
        == len(contact_resultants)
        == len(tangential_forces)
        == expected_rows
    )
    report = (
        f"stage=directional_joint_resultants; horizontal_load_ratio={ratio:.6g}; "
        "kh_definition=a_h_over_g; "
        "case_angle_convention=equivalent_horizontal_inertia_force_direction; "
        "base_acceleration_direction=(CaseAngle+180deg)_mod_360; "
        f"stage02_total_nodal_weight_kN={total_nodal_weight:.12g}; "
        f"free_node_weight_kN={free_node_weight:.12g}; "
        f"support_node_weight_kN={support_node_weight:.12g}; "
        f"weight_partition_error_kN="
        f"{prepared['weight_partition_error']:.12g}; "
        f"free_node_horizontal_target_resultant_kN="
        f"{ratio * free_node_weight:.12g}; "
        f"full_structure_equivalent_inertia_resultant_kN="
        f"{ratio * total_nodal_weight:.12g}; "
        f"support_local_inertia_resultant_kN="
        f"{ratio * support_node_weight:.12g}; "
        "support_node_inertia_treatment=local_support_reaction_not_free_node_solve; "
        f"directional_sweep={ratio > 0.0}; angle_cases={len(angles)}; "
        f"coarse_angle_cases={len(coarse_angles)}; coarse_angle_step_deg="
        f"{horizontal_angle_step_degrees if ratio > 0.0 else 0.0}; "
        f"refinement_step_deg={refinement_step:.6g}; "
        f"refinement_half_width_deg={refinement_half_width:.6g}; "
        f"angle_min_max_deg=({min(angles):.6g},{max(angles):.6g}); "
        f"joints_per_case={len(identifiers)}; flattened_rows={len(case_joint_ids)}; "
        f"coarse_peak_angles_deg={coarse_peak_angles}; "
        f"coarse_local_peak_candidates_deg={coarse_candidate_angles}; "
        f"refined_peak_angles_deg={refined_peak_angles}; "
        f"refined_peak_signed_deficits_kN={refined_peak_deficits}; "
        f"boundary_expansions={boundary_expansions}; "
        f"full_circle_refinements={full_circle_refinements}; "
        f"case_failures={case_failures}; valid={valid}; "
        "adaptive_refinement=all_coarse_local_maxima_of_per_joint_final_sliding_deficit; "
        "boundary_rule=extend_while_boundary_equals_current_maximum; "
        "flattening=case_major_each_case_follows_jointids_order; "
        "equilibrium_scope=free_TNA_node_translational_force_balance_only; "
        "block_moments_support_contact_distribution_and_dynamic_response_not_checked; "
        "scope=mass_proportional_uniform_base_acceleration_full_direction_equivalent_static_inertia_sensitivity_not_earthquake_safety_check"
    )
    return (
        angles,
        case_joint_ids,
        contact_points,
        contact_resultants,
        tangential_forces,
        valid,
        report,
    )


try:
    _component_inputs = (
        TNAEdges,
        NodalLoads,
        JointPlanes,
        JointProfiles,
        JointIDs,
        JointBlockPairs,
        HorizontalLoadRatio,
        HorizontalAngleStepDegrees,
        RefinementAngleStepDegrees,
        RefinementHalfWidthDegrees,
        FrictionCoefficient,
        SlidingSafetyFactor,
    )
except NameError:
    _component_inputs = None

if _component_inputs is not None:
    (
        CaseAngles,
        CaseJointIDs,
        ContactPoints,
        ContactResultants,
        TangentialForces,
        Valid,
        Report,
    ) = create_directional_joint_resultants(*_component_inputs)
# ---------- end _07b_全方向接缝合力 ----------

# ---- group: 07C 张开与线性压力
_07c_张开与线性压力_备注 = Panel("""使用实际接缝和07B合力做线性全截面诊断。
最小压力为负表示全接触假设下发生张开。
Valid与NoOpeningPass分别解释。
按方向输出核利用率、压力与张开键。
张开不必然意味着存在正滑移缺额。""")
_07c_张开与线性压力 = Python3Script(
    JointProfiles=_06_引导径向分块.JointProfiles,
    JointPlanes=_06_引导径向分块.JointPlanes,
    JointIDs=_07a_块重与接缝邻接.JointIDs,
    CaseAngles=_07b_全方向接缝合力.CaseAngles,
    CaseJointIDs=_07b_全方向接缝合力.CaseJointIDs,
    ContactPoints=_07b_全方向接缝合力.ContactPoints,
    ContactResultants=_07b_全方向接缝合力.ContactResultants)  # -> out, JointKerns, KernUtilisations, MinPressures, MaxPressures, OpeningCaseKeys, NoOpeningPass, Valid, Report; inputs JointProfiles: list of Curve, JointPlanes: list of Plane, JointIDs: list, CaseAngles: list, CaseJointIDs: list, ContactPoints: list of Point3d, ContactResultants: list of Vector3d
# ---------- _07c_张开与线性压力: Python ----------
#! python 3
"""Stage 07C - actual-joint eccentricity, opening and contact pressure.

Grasshopper Python inputs:
    JointProfiles      list[Curve]  JointProfiles from Stage 06 (List)
    JointPlanes        list[Plane]  JointPlanes from Stage 06 (List)
    JointIDs           list[str]    JointIDs from Stage 07A (List)
    CaseAngles         list[float]  CaseAngles from Stage 07B (List)
    CaseJointIDs       list[str]    CaseJointIDs from Stage 07B (List)
    ContactPoints      list[Point]  Flattened Stage 07B points (List)
    ContactResultants  list[Vector] Flattened Stage 07B resultants (List)

Outputs:
    JointKerns, KernUtilisations, MinPressures, MaxPressures,
    OpeningCaseKeys, NoOpeningPass, Valid, Report

The actual Stage 06 joint profile is treated as a planar section. A linear
normal-pressure field is reconstructed from the normal resultant and its
eccentricity. The exact linear-elastic no-tension kern is generated numerically
from the sampled profile. Pressures are returned in MPa.

Negative MinPressures indicate loss of full contact. In that case the reported
linear pressure range is a diagnostic full-contact field, not a nonlinear
partial-contact solution. Stone crushing, friction and dowel capacity are not
checked in this stage.
"""

import math

import Rhino
import Rhino.Geometry as rg


BOUNDARY_SAMPLES = 192
MOMENT_EPSILON = 1.0e-12
KERN_TOLERANCE = 1.0e-6


def _as_list(value):
    if value is None:
        return []
    if isinstance(value, str):
        return [value]
    try:
        return list(value)
    except TypeError:
        return [value]


def _document_tolerance():
    document = Rhino.RhinoDoc.ActiveDoc
    if document is None:
        return 1.0e-3
    return document.ModelAbsoluteTolerance


def _coerce_curve(value):
    if isinstance(value, rg.Curve):
        return value
    if hasattr(value, "Value") and isinstance(value.Value, rg.Curve):
        return value.Value
    return None


def _coerce_plane(value):
    if isinstance(value, rg.Plane):
        return rg.Plane(value)
    if hasattr(value, "Value") and isinstance(value.Value, rg.Plane):
        return rg.Plane(value.Value)
    return None


def _coerce_point(value):
    if isinstance(value, rg.Point3d):
        return rg.Point3d(value)
    if hasattr(value, "Value") and isinstance(value.Value, rg.Point3d):
        return rg.Point3d(value.Value)
    return None


def _coerce_vector(value):
    if isinstance(value, rg.Vector3d):
        return rg.Vector3d(value)
    if hasattr(value, "Value") and isinstance(value.Value, rg.Vector3d):
        return rg.Vector3d(value.Value)
    try:
        return rg.Vector3d(value)
    except Exception:
        return None


def _plane_coordinates(point, plane):
    vector = point - plane.Origin
    return (
        rg.Vector3d.Multiply(vector, plane.XAxis),
        rg.Vector3d.Multiply(vector, plane.YAxis),
    )


def _world_point(plane, x, y):
    return plane.Origin + plane.XAxis * x + plane.YAxis * y


def _sample_closed_curve(curve):
    try:
        success, polyline = curve.TryGetPolyline()
    except Exception:
        success, polyline = False, None
    if success and polyline is not None and polyline.Count >= 4:
        points = [rg.Point3d(point) for point in polyline]
        if points[0].DistanceTo(points[-1]) <= 1.0e-9:
            points.pop()
        if len(points) >= 3:
            return points
    parameters = curve.DivideByCount(BOUNDARY_SAMPLES, False)
    if parameters is None or len(parameters) < 3:
        raise RuntimeError("Could not sample a JointProfile boundary.")
    return [curve.PointAt(parameter) for parameter in parameters]


def _signed_area_and_centroid(points):
    twice_area = 0.0
    centroid_x = 0.0
    centroid_y = 0.0
    for index, point in enumerate(points):
        following = points[(index + 1) % len(points)]
        cross = point[0] * following[1] - following[0] * point[1]
        twice_area += cross
        centroid_x += (point[0] + following[0]) * cross
        centroid_y += (point[1] + following[1]) * cross
    area = 0.5 * twice_area
    if abs(area) <= MOMENT_EPSILON:
        raise RuntimeError("A sampled JointProfile has zero area.")
    centroid_x /= 6.0 * area
    centroid_y /= 6.0 * area
    return area, (centroid_x, centroid_y)


def _section_moments(points):
    area, centroid = _signed_area_and_centroid(points)
    if area < 0.0:
        points = list(reversed(points))
        area, centroid = _signed_area_and_centroid(points)
    centered = [
        (point[0] - centroid[0], point[1] - centroid[1])
        for point in points
    ]
    second_x = 0.0
    second_y = 0.0
    product = 0.0
    for index, point in enumerate(centered):
        following = centered[(index + 1) % len(centered)]
        cross = point[0] * following[1] - following[0] * point[1]
        second_x += (
            point[0] * point[0]
            + point[0] * following[0]
            + following[0] * following[0]
        ) * cross
        second_y += (
            point[1] * point[1]
            + point[1] * following[1]
            + following[1] * following[1]
        ) * cross
        product += (
            2.0 * point[0] * point[1]
            + point[0] * following[1]
            + following[0] * point[1]
            + 2.0 * following[0] * following[1]
        ) * cross
    second_x /= 12.0
    second_y /= 12.0
    product /= 24.0
    determinant = second_x * second_y - product * product
    if determinant <= MOMENT_EPSILON:
        raise RuntimeError("A JointProfile has singular area moments.")
    return area, centroid, centered, second_x, second_y, product


def _inverse_moment_action(x, y, second_x, second_y, product):
    determinant = second_x * second_y - product * product
    return (
        (second_y * x - product * y) / determinant,
        (-product * x + second_x * y) / determinant,
    )


def _clip_half_plane(polygon, normal_x, normal_y, limit):
    if not polygon:
        return []
    clipped = []
    for index, start in enumerate(polygon):
        end = polygon[(index + 1) % len(polygon)]
        start_value = normal_x * start[0] + normal_y * start[1]
        end_value = normal_x * end[0] + normal_y * end[1]
        start_inside = start_value <= limit + 1.0e-12
        end_inside = end_value <= limit + 1.0e-12
        if start_inside:
            clipped.append(start)
        if start_inside != end_inside:
            denominator = end_value - start_value
            if abs(denominator) > 1.0e-15:
                parameter = (limit - start_value) / denominator
                clipped.append(
                    (
                        start[0] + (end[0] - start[0]) * parameter,
                        start[1] + (end[1] - start[1]) * parameter,
                    )
                )
    return clipped


def _clean_polygon(polygon, tolerance):
    if not polygon:
        return []
    cleaned = []
    for point in polygon:
        if not cleaned or math.hypot(
            point[0] - cleaned[-1][0], point[1] - cleaned[-1][1]
        ) > tolerance:
            cleaned.append(point)
    if len(cleaned) > 1 and math.hypot(
        cleaned[0][0] - cleaned[-1][0],
        cleaned[0][1] - cleaned[-1][1],
    ) <= tolerance:
        cleaned.pop()
    changed = True
    while changed and len(cleaned) >= 3:
        changed = False
        result = []
        count = len(cleaned)
        for index, point in enumerate(cleaned):
            previous = cleaned[(index - 1) % count]
            following = cleaned[(index + 1) % count]
            cross = (
                (point[0] - previous[0]) * (following[1] - point[1])
                - (point[1] - previous[1]) * (following[0] - point[0])
            )
            scale = max(
                math.hypot(point[0] - previous[0], point[1] - previous[1]),
                math.hypot(following[0] - point[0], following[1] - point[1]),
                1.0,
            )
            if abs(cross) <= tolerance * scale:
                changed = True
            else:
                result.append(point)
        cleaned = result
    return cleaned


def _kern_polygon(area, boundary, second_x, second_y, product):
    extent = max(
        max(math.hypot(point[0], point[1]) for point in boundary),
        1.0e-6,
    )
    polygon = [
        (-2.0 * extent, -2.0 * extent),
        (2.0 * extent, -2.0 * extent),
        (2.0 * extent, 2.0 * extent),
        (-2.0 * extent, 2.0 * extent),
    ]
    cleanup_tolerance = max(extent * 1.0e-9, 1.0e-12)
    for point in boundary:
        normal_x, normal_y = _inverse_moment_action(
            point[0], point[1], second_x, second_y, product
        )
        polygon = _clip_half_plane(
            polygon, -normal_x, -normal_y, 1.0 / area
        )
        polygon = _clean_polygon(polygon, cleanup_tolerance)
        if len(polygon) < 3:
            return []
    return _clean_polygon(polygon, cleanup_tolerance)


def _prepare_joint_section(profile, plane):
    world_boundary = _sample_closed_curve(profile)
    local_boundary = [
        _plane_coordinates(point, plane) for point in world_boundary
    ]
    (
        area,
        centroid,
        centered_boundary,
        second_x,
        second_y,
        product,
    ) = _section_moments(local_boundary)
    kern = _kern_polygon(
        area, centered_boundary, second_x, second_y, product
    )
    if len(kern) < 3:
        raise RuntimeError("The calculated actual-joint kern is empty.")
    kern_points = [
        _world_point(
            plane,
            centroid[0] + point[0],
            centroid[1] + point[1],
        )
        for point in kern
    ]
    kern_points.append(kern_points[0])
    kern_curve = rg.PolylineCurve(kern_points)
    if not kern_curve.IsValid or not kern_curve.IsClosed:
        raise RuntimeError("The calculated actual-joint kern is invalid.")
    normal = rg.Vector3d(plane.Normal)
    if not normal.Unitize():
        raise ValueError("A JointPlane has an invalid normal.")
    return {
        "area": area,
        "centroid": centroid,
        "centered_boundary": centered_boundary,
        "second_x": second_x,
        "second_y": second_y,
        "product": product,
        "kern": kern_curve,
        "normal": normal,
    }


def _joint_check(
    profile,
    plane,
    contact_point,
    resultant,
    tolerance,
    prepared_section=None,
):
    containment = profile.Contains(contact_point, plane, tolerance)
    if containment not in (
        rg.PointContainment.Inside,
        rg.PointContainment.Coincident,
    ):
        raise ValueError("A ContactPoint lies outside its JointProfile.")

    section = (
        prepared_section
        if prepared_section is not None
        else _prepare_joint_section(profile, plane)
    )
    area = section["area"]
    centroid = section["centroid"]
    centered_boundary = section["centered_boundary"]
    second_x = section["second_x"]
    second_y = section["second_y"]
    product = section["product"]
    contact_local = _plane_coordinates(contact_point, plane)
    eccentricity = (
        contact_local[0] - centroid[0],
        contact_local[1] - centroid[1],
    )
    coefficient = _inverse_moment_action(
        eccentricity[0],
        eccentricity[1],
        second_x,
        second_y,
        product,
    )
    pressure_terms = [
        1.0 / area + coefficient[0] * point[0] + coefficient[1] * point[1]
        for point in centered_boundary
    ]
    minimum_term = min(pressure_terms)
    maximum_term = max(pressure_terms)
    utilisation = max(
        0.0,
        -area * min(
            coefficient[0] * point[0] + coefficient[1] * point[1]
            for point in centered_boundary
        ),
    )
    no_opening = utilisation <= 1.0 + KERN_TOLERANCE

    normal = section["normal"]
    normal_force = rg.Vector3d.Multiply(resultant, normal)
    tangential = resultant - normal * normal_force
    if normal_force <= 0.0:
        raise ValueError("A ContactResultant has no positive compression.")
    minimum_pressure = normal_force * minimum_term / 1000.0
    maximum_pressure = normal_force * maximum_term / 1000.0

    return {
        "kern": section["kern"],
        "utilisation": utilisation,
        "no_opening": no_opening,
        "minimum_pressure": minimum_pressure,
        "maximum_pressure": maximum_pressure,
        "area": area,
        "eccentricity": math.hypot(*eccentricity),
        "normal_force": normal_force,
        "tangential_force": tangential.Length,
    }


def create_joint_opening_and_pressure(
    joint_profiles,
    joint_planes,
    contact_points,
    contact_resultants,
    joint_ids,
    _prepared_sections=None,
):
    profiles = []
    for index, value in enumerate(_as_list(joint_profiles)):
        profile = _coerce_curve(value)
        if profile is None or not profile.IsValid or not profile.IsClosed:
            raise ValueError(
                "JointProfiles contains invalid data at index {0}."
                .format(index)
            )
        profiles.append(profile)

    planes = []
    for index, value in enumerate(_as_list(joint_planes)):
        plane = _coerce_plane(value)
        if plane is None or not plane.IsValid:
            raise ValueError(
                "JointPlanes contains invalid data at index {0}."
                .format(index)
            )
        planes.append(plane)

    points = []
    for index, value in enumerate(_as_list(contact_points)):
        point = _coerce_point(value)
        if point is None or not point.IsValid:
            raise ValueError(
                "ContactPoints contains invalid data at index {0}."
                .format(index)
            )
        points.append(point)

    resultants = []
    for index, value in enumerate(_as_list(contact_resultants)):
        resultant = _coerce_vector(value)
        if resultant is None or not all(
            math.isfinite(component)
            for component in (resultant.X, resultant.Y, resultant.Z)
        ):
            raise ValueError(
                "ContactResultants contains invalid data at index {0}."
                .format(index)
            )
        resultants.append(resultant)

    identifiers = [str(value) for value in _as_list(joint_ids)]
    count = len(profiles)
    if not (
        len(planes) == count
        and len(points) == count
        and len(resultants) == count
        and len(identifiers) == count
    ):
        raise ValueError(
            "All Stage 07C inputs must correspond one-to-one with joints."
        )
    if not identifiers or len(set(identifiers)) != count:
        raise ValueError("JointIDs must contain unique identifiers.")
    if _prepared_sections is None:
        prepared_sections = [None] * count
    else:
        prepared_sections = list(_prepared_sections)
        if len(prepared_sections) != count:
            raise ValueError("Prepared Stage 07C sections must match JointIDs.")

    tolerance = _document_tolerance()
    records = []
    failures = []
    values_by_joint = zip(
        profiles,
        planes,
        points,
        resultants,
        prepared_sections,
    )
    for index, values in enumerate(values_by_joint):
        try:
            profile, plane, point, resultant, prepared = values
            records.append(_joint_check(
                profile,
                plane,
                point,
                resultant,
                tolerance,
                prepared,
            ))
        except Exception as error:
            failures.append((index, identifiers[index], str(error)))

    joint_kerns = [record["kern"] for record in records]
    utilisations = [record["utilisation"] for record in records]
    minimum_pressures = [record["minimum_pressure"] for record in records]
    maximum_pressures = [record["maximum_pressure"] for record in records]
    opening_ids = [
        identifiers[index]
        for index, record in enumerate(records)
        if not record["no_opening"]
    ] if not failures else []
    no_opening_pass = not failures and not opening_ids
    valid = not failures and len(records) == count

    report = (
        f"stage=joint_opening_and_pressure; joints={count}; "
        f"sections_evaluated={len(records)}; kerns={len(joint_kerns)}; "
        f"opening_joints={len(opening_ids)}; opening_joint_ids={opening_ids}; "
        f"no_opening_pass={no_opening_pass}; "
        f"kern_utilisation_min_max="
        f"({min(utilisations) if utilisations else 0.0:.6g},"
        f"{max(utilisations) if utilisations else 0.0:.6g}); "
        f"full_contact_pressure_min_max_MPa="
        f"({min(minimum_pressures) if minimum_pressures else 0.0:.6g},"
        f"{max(maximum_pressures) if maximum_pressures else 0.0:.6g}); "
        f"joint_area_min_max_m2="
        f"({min((record['area'] for record in records), default=0.0):.6g},"
        f"{max((record['area'] for record in records), default=0.0):.6g}); "
        f"eccentricity_min_max_m="
        f"({min((record['eccentricity'] for record in records), default=0.0):.6g},"
        f"{max((record['eccentricity'] for record in records), default=0.0):.6g}); "
        f"max_tangential_force_kN="
        f"{max((record['tangential_force'] for record in records), default=0.0):.6g}; "
        f"failures={failures}; valid={valid}; "
        "pressure_model=linear_full_contact_diagnostic; "
        "negative_min_pressure_means_opening; "
        "partial_contact_crushing_friction_and_pin_capacity_not_checked"
    )
    return (
        joint_kerns,
        utilisations,
        minimum_pressures,
        maximum_pressures,
        opening_ids,
        no_opening_pass,
        valid,
        report,
    )


def _case_key(case_index, angle, identifier):
    return "case[{0}]/angle[{1:.6g}]/{2}".format(
        case_index, angle, identifier
    )


def create_directional_joint_opening_and_pressure(
    joint_profiles,
    joint_planes,
    joint_ids,
    case_angles,
    case_joint_ids,
    contact_points,
    contact_resultants,
):
    identifiers = [str(value) for value in _as_list(joint_ids)]
    try:
        angles = [float(value) for value in _as_list(case_angles)]
    except (TypeError, ValueError):
        raise ValueError("CaseAngles must contain numeric degree values.")
    row_ids = [str(value) for value in _as_list(case_joint_ids)]
    points = _as_list(contact_points)
    resultants = _as_list(contact_resultants)
    joint_count = len(identifiers)
    expected_rows = len(angles) * joint_count
    if (
        not joint_count
        or not angles
        or len(set(identifiers)) != joint_count
        or len(row_ids) != expected_rows
        or len(points) != expected_rows
        or len(resultants) != expected_rows
    ):
        raise ValueError(
            "Stage 07C directional inputs must contain one complete "
            "JointIDs-sized block for every CaseAngles item."
        )

    profiles = [_coerce_curve(value) for value in _as_list(joint_profiles)]
    planes = [_coerce_plane(value) for value in _as_list(joint_planes)]
    if (
        len(profiles) != joint_count
        or len(planes) != joint_count
        or any(
            profile is None or not profile.IsValid or not profile.IsClosed
            for profile in profiles
        )
        or any(plane is None or not plane.IsValid for plane in planes)
    ):
        raise ValueError(
            "JointProfiles, JointPlanes and JointIDs must correspond one-to-one."
        )
    prepared_sections = []
    for profile, plane in zip(profiles, planes):
        try:
            prepared_sections.append(_prepare_joint_section(profile, plane))
        except Exception:
            prepared_sections.append(None)

    joint_kerns = []
    utilisations = []
    minimum_pressures = []
    maximum_pressures = []
    opening_keys = []
    failures = []
    for case_index, angle in enumerate(angles):
        start = case_index * joint_count
        end = start + joint_count
        if row_ids[start:end] != identifiers:
            failures.append((case_index, angle, "case_joint_id_order_mismatch"))
            continue
        result = create_joint_opening_and_pressure(
            profiles,
            planes,
            points[start:end],
            resultants[start:end],
            identifiers,
            prepared_sections,
        )
        if not result[6]:
            failures.append((case_index, angle, result[7]))
            continue
        joint_kerns.extend(result[0])
        utilisations.extend(result[1])
        minimum_pressures.extend(result[2])
        maximum_pressures.extend(result[3])
        opening_keys.extend(
            _case_key(case_index, angle, identifier)
            for identifier in result[4]
        )

    valid = (
        not failures
        and len(joint_kerns)
        == len(utilisations)
        == len(minimum_pressures)
        == len(maximum_pressures)
        == expected_rows
    )
    no_opening_pass = valid and not opening_keys
    report = (
        f"stage=directional_joint_opening_and_pressure; "
        f"angle_cases={len(angles)}; joints_per_case={joint_count}; "
        f"flattened_rows={len(utilisations)}; opening_case_rows={len(opening_keys)}; "
        f"kern_utilisation_min_max="
        f"({min(utilisations) if utilisations else 0.0:.6g},"
        f"{max(utilisations) if utilisations else 0.0:.6g}); "
        f"full_contact_pressure_min_max_MPa="
        f"({min(minimum_pressures) if minimum_pressures else 0.0:.6g},"
        f"{max(maximum_pressures) if maximum_pressures else 0.0:.6g}); "
        f"case_failures={failures}; no_opening_pass={no_opening_pass}; "
        f"valid={valid}; flattening=case_major; "
        "negative_min_pressure_means_opening"
    )
    return (
        joint_kerns,
        utilisations,
        minimum_pressures,
        maximum_pressures,
        opening_keys,
        no_opening_pass,
        valid,
        report,
    )


try:
    _component_inputs = (
        JointProfiles,
        JointPlanes,
        JointIDs,
        CaseAngles,
        CaseJointIDs,
        ContactPoints,
        ContactResultants,
    )
except NameError:
    _component_inputs = None

if _component_inputs is not None:
    (
        JointKerns,
        KernUtilisations,
        MinPressures,
        MaxPressures,
        OpeningCaseKeys,
        NoOpeningPass,
        Valid,
        Report,
    ) = create_directional_joint_opening_and_pressure(*_component_inputs)
# ---------- end _07c_张开与线性压力 ----------

# ---- group: 07D 仅受压部分接触
_07d_仅受压部分接触_备注 = Panel("""张开接缝使用非负截断仿射压力场重新分配。
匹配法向力及一阶矩，输出接触比例和峰值压力。
保留收敛门槛与多起点回退。
不移动块体，不代表分块修复了之前的核筛失败。
压力以MPa报告；不与实测石材强度等同。""")
_07d_仅受压部分接触 = Python3Script(
    JointProfiles=_06_引导径向分块.JointProfiles,
    JointPlanes=_06_引导径向分块.JointPlanes,
    JointIDs=_07a_块重与接缝邻接.JointIDs,
    CaseAngles=_07b_全方向接缝合力.CaseAngles,
    CaseJointIDs=_07b_全方向接缝合力.CaseJointIDs,
    ContactPoints=_07b_全方向接缝合力.ContactPoints,
    ContactResultants=_07b_全方向接缝合力.ContactResultants,
    KernUtilisations=_07c_张开与线性压力.KernUtilisations)  # -> out, ContactAreaRatios, MinPressures, MaxPressures, PressureCentroids, PartialContactCaseKeys, Valid, Report; inputs JointProfiles: list of Curve, JointPlanes: list of Plane, JointIDs: list, CaseAngles: list, CaseJointIDs: list, ContactPoints: list of Point3d, ContactResultants: list of Vector3d, KernUtilisations: list
# ---------- _07d_仅受压部分接触: Python ----------
#! python 3
"""Stage 07D - compression-only partial-contact pressure redistribution.

Grasshopper Python inputs:
    JointProfiles      list[Curve]  JointProfiles from Stage 06 (List)
    JointPlanes        list[Plane]  JointPlanes from Stage 06 (List)
    JointIDs           list[str]    JointIDs from Stage 07A (List)
    CaseAngles         list[float]  CaseAngles from Stage 07B (List)
    CaseJointIDs       list[str]    CaseJointIDs from Stage 07B (List)
    ContactPoints      list[Point]  Flattened Stage 07B points (List)
    ContactResultants  list[Vector] Flattened Stage 07B resultants (List)
    KernUtilisations   list[float]  Flattened Stage 07C values (List)

Outputs:
    ContactAreaRatios, MinPressures, MaxPressures, PressureCentroids,
    PartialContactCaseKeys, Valid, Report

Full-contact joints retain the linear Stage 07C pressure field. For joints
outside the no-tension kern, an affine compression field truncated at zero is
solved over a triangulation of the actual joint profile. Its total force and
pressure centroid reproduce the Stage 07B normal resultant. Pressures are MPa.

This stage does not compare pressure with a stone strength and does not check
friction or dowel capacity.
"""

import math

import Rhino
import Rhino.Geometry as rg
from scipy.optimize import least_squares


BOUNDARY_SAMPLES = 192
MOMENT_EPSILON = 1.0e-12
KERN_TOLERANCE = 1.0e-6
MAX_SOLVER_EVALUATIONS = 500


def _as_list(value):
    if value is None:
        return []
    if isinstance(value, str):
        return [value]
    try:
        return list(value)
    except TypeError:
        return [value]


def _document_tolerance():
    document = Rhino.RhinoDoc.ActiveDoc
    return document.ModelAbsoluteTolerance if document is not None else 1.0e-3


def _coerce(value, geometry_type):
    if isinstance(value, geometry_type):
        return value
    if hasattr(value, "Value") and isinstance(value.Value, geometry_type):
        return value.Value
    return None


def _plane_coordinates(point, plane):
    vector = point - plane.Origin
    return (
        rg.Vector3d.Multiply(vector, plane.XAxis),
        rg.Vector3d.Multiply(vector, plane.YAxis),
    )


def _world_point(plane, x, y):
    return plane.Origin + plane.XAxis * x + plane.YAxis * y


def _sample_boundary(curve):
    try:
        success, polyline = curve.TryGetPolyline()
    except Exception:
        success, polyline = False, None
    if success and polyline is not None and polyline.Count >= 4:
        points = [rg.Point3d(point) for point in polyline]
        if points[0].DistanceTo(points[-1]) <= 1.0e-9:
            points.pop()
        if len(points) >= 3:
            return points
    parameters = curve.DivideByCount(BOUNDARY_SAMPLES, False)
    if parameters is None or len(parameters) < 3:
        raise RuntimeError("Could not sample a JointProfile boundary.")
    return [curve.PointAt(parameter) for parameter in parameters]


def _polygon_moments(points):
    area2 = sx6 = sy6 = 0.0
    sxx12 = syy12 = sxy24 = 0.0
    for index, point in enumerate(points):
        following = points[(index + 1) % len(points)]
        x0, y0 = point
        x1, y1 = following
        cross = x0 * y1 - x1 * y0
        area2 += cross
        sx6 += (x0 + x1) * cross
        sy6 += (y0 + y1) * cross
        sxx12 += (x0 * x0 + x0 * x1 + x1 * x1) * cross
        syy12 += (y0 * y0 + y0 * y1 + y1 * y1) * cross
        sxy24 += (
            2.0 * x0 * y0 + x0 * y1 + x1 * y0 + 2.0 * x1 * y1
        ) * cross
    area = area2 / 2.0
    if abs(area) <= MOMENT_EPSILON:
        raise RuntimeError("A polygon has zero area.")
    sign = 1.0 if area > 0.0 else -1.0
    return (
        area * sign,
        sx6 / 6.0 * sign,
        sy6 / 6.0 * sign,
        sxx12 / 12.0 * sign,
        syy12 / 12.0 * sign,
        sxy24 / 24.0 * sign,
    )


def _clean_polygon(points, tolerance):
    cleaned = []
    for point in points:
        if not cleaned or math.hypot(
            point[0] - cleaned[-1][0], point[1] - cleaned[-1][1]
        ) > tolerance:
            cleaned.append(point)
    if len(cleaned) > 1 and math.hypot(
        cleaned[0][0] - cleaned[-1][0],
        cleaned[0][1] - cleaned[-1][1],
    ) <= tolerance:
        cleaned.pop()
    changed = True
    while changed and len(cleaned) >= 3:
        changed = False
        reduced = []
        for index, point in enumerate(cleaned):
            previous = cleaned[(index - 1) % len(cleaned)]
            following = cleaned[(index + 1) % len(cleaned)]
            first_length = math.hypot(
                point[0] - previous[0], point[1] - previous[1]
            )
            second_length = math.hypot(
                following[0] - point[0], following[1] - point[1]
            )
            cross = abs(_cross(previous, point, following))
            if (
                first_length <= tolerance
                or second_length <= tolerance
                or cross <= tolerance * (first_length + second_length)
            ):
                changed = True
            else:
                reduced.append(point)
        if len(reduced) < 3:
            break
        cleaned = reduced
    return cleaned


def _cross(a, b, c):
    return (b[0] - a[0]) * (c[1] - a[1]) - (b[1] - a[1]) * (c[0] - a[0])


def _point_in_triangle(point, a, b, c, tolerance):
    return (
        _cross(a, b, point) >= -tolerance
        and _cross(b, c, point) >= -tolerance
        and _cross(c, a, point) >= -tolerance
    )


def _triangulate(boundary, tolerance):
    points = list(boundary)
    signed_area = 0.5 * sum(
        points[index][0] * points[(index + 1) % len(points)][1]
        - points[(index + 1) % len(points)][0] * points[index][1]
        for index in range(len(points))
    )
    if signed_area < 0.0:
        points.reverse()
    indices = list(range(len(points)))
    triangles = []
    guard = 0
    while len(indices) > 3 and guard < len(points) * len(points):
        guard += 1
        clipped = False
        for local_index, current in enumerate(indices):
            previous = indices[(local_index - 1) % len(indices)]
            following = indices[(local_index + 1) % len(indices)]
            a, b, c = points[previous], points[current], points[following]
            if _cross(a, b, c) <= tolerance:
                continue
            if any(
                _point_in_triangle(points[index], a, b, c, tolerance)
                for index in indices
                if index not in (previous, current, following)
            ):
                continue
            triangles.append([a, b, c])
            indices.pop(local_index)
            clipped = True
            break
        if not clipped:
            raise RuntimeError("Could not triangulate a JointProfile.")
    if len(indices) == 3:
        triangles.append([points[index] for index in indices])
    return triangles


def _clip_positive(polygon, ux, uy, cutoff):
    clipped = []
    for index, start in enumerate(polygon):
        end = polygon[(index + 1) % len(polygon)]
        start_value = ux * start[0] + uy * start[1] - cutoff
        end_value = ux * end[0] + uy * end[1] - cutoff
        start_inside = start_value >= -1.0e-12
        end_inside = end_value >= -1.0e-12
        if start_inside:
            clipped.append(start)
        if start_inside != end_inside:
            denominator = end_value - start_value
            if abs(denominator) > 1.0e-15:
                parameter = -start_value / denominator
                clipped.append((
                    start[0] + parameter * (end[0] - start[0]),
                    start[1] + parameter * (end[1] - start[1]),
                ))
    return clipped


def _positive_field_moments(triangles, ux, uy, cutoff):
    area = sx = sy = sxx = syy = sxy = 0.0
    for triangle in triangles:
        polygon = _clip_positive(triangle, ux, uy, cutoff)
        if len(polygon) < 3:
            continue
        values = _polygon_moments(polygon)
        area += values[0]
        sx += values[1]
        sy += values[2]
        sxx += values[3]
        syy += values[4]
        sxy += values[5]
    weighted = ux * sx + uy * sy - cutoff * area
    weighted_x = ux * sxx + uy * sxy - cutoff * sx
    weighted_y = ux * sxy + uy * syy - cutoff * sy
    if weighted <= MOMENT_EPSILON:
        return None
    return area, weighted, weighted_x / weighted, weighted_y / weighted


def _inverse_moment_action(x, y, second_x, second_y, product):
    determinant = second_x * second_y - product * product
    return (
        (second_y * x - product * y) / determinant,
        (-product * x + second_x * y) / determinant,
    )


def _prepare_joint_section(profile, plane, tolerance):
    world_boundary = _sample_boundary(profile)
    local_boundary = _clean_polygon(
        [_plane_coordinates(value, plane) for value in world_boundary],
        max(tolerance * 0.01, 1.0e-9),
    )
    area, sx, sy, sxx, syy, sxy = _polygon_moments(local_boundary)
    centroid = (sx / area, sy / area)
    centered_boundary = [
        (value[0] - centroid[0], value[1] - centroid[1])
        for value in local_boundary
    ]
    full_moments = _polygon_moments(centered_boundary)
    triangles = _triangulate(
        centered_boundary, max(tolerance * 1.0e-4, 1.0e-10)
    )
    normal = rg.Vector3d(plane.Normal)
    if not normal.Unitize():
        raise ValueError("JointPlane has an invalid normal.")
    return {
        "area": area,
        "centroid": centroid,
        "boundary": centered_boundary,
        "triangles": triangles,
        "full_moments": full_moments,
        "extent": max(
            max(math.hypot(*point) for point in centered_boundary),
            1.0e-6,
        ),
        "normal": normal,
    }


def _full_contact(boundary, normal_force, target, moments=None):
    area, sx, sy, sxx, syy, sxy = (
        moments if moments is not None else _polygon_moments(boundary)
    )
    centroid = (sx / area, sy / area)
    centered_target = (target[0] - centroid[0], target[1] - centroid[1])
    second_x = sxx - area * centroid[0] * centroid[0]
    second_y = syy - area * centroid[1] * centroid[1]
    product = sxy - area * centroid[0] * centroid[1]
    coefficient = _inverse_moment_action(
        centered_target[0], centered_target[1], second_x, second_y, product
    )
    terms = [
        1.0 / area
        + coefficient[0] * (point[0] - centroid[0])
        + coefficient[1] * (point[1] - centroid[1])
        for point in boundary
    ]
    return 1.0, normal_force * min(terms) / 1000.0, normal_force * max(terms) / 1000.0, target


def _partial_contact(
    boundary,
    triangles,
    normal_force,
    target,
    tolerance,
    area=None,
    extent=None,
    warm_start=None,
):
    if area is None:
        area = _polygon_moments(boundary)[0]
    if extent is None:
        extent = max(max(math.hypot(*point) for point in boundary), 1.0e-6)
    target_angle = math.atan2(target[1], target[0])
    best = None

    def state(parameters):
        theta, fraction = float(parameters[0]), float(parameters[1])
        ux, uy = math.cos(theta), math.sin(theta)
        projections = [ux * point[0] + uy * point[1] for point in boundary]
        minimum, maximum = min(projections), max(projections)
        cutoff = minimum + fraction * (maximum - minimum)
        moments = _positive_field_moments(triangles, ux, uy, cutoff)
        return ux, uy, cutoff, moments

    def residual(parameters):
        values = state(parameters)
        moments = values[3]
        if moments is None:
            return [1.0e3, 1.0e3]
        return [
            (moments[2] - target[0]) / extent,
            (moments[3] - target[1]) / extent,
        ]

    def solve(starts, current_best=None):
        best_result = current_best
        for start in starts:
            result = least_squares(
                residual,
                start,
                bounds=([-4.0 * math.pi, 0.0], [4.0 * math.pi, 0.999999]),
                xtol=1.0e-12,
                ftol=1.0e-12,
                gtol=1.0e-12,
                max_nfev=MAX_SOLVER_EVALUATIONS,
            )
            values = state(result.x)
            moments = values[3]
            if moments is None:
                continue
            error = math.hypot(
                moments[2] - target[0], moments[3] - target[1]
            )
            if best_result is None or error < best_result[0]:
                best_result = (error, values, moments, result)
        return best_result

    used_warm_start = warm_start is not None
    used_full_fallback = not used_warm_start
    if used_warm_start:
        warm_fraction = min(max(float(warm_start[1]), 0.0), 0.999999)
        warm_starts = [
            (float(warm_start[0]), warm_fraction),
            (target_angle, warm_fraction),
        ]
        best = solve(warm_starts)
        warm_tolerance = max(1.0e-9, tolerance * 1.0e-5)
        if best is None or best[0] > warm_tolerance:
            used_full_fallback = True

    if used_full_fallback:
        starts = []
        for angle_offset in (0.0, -0.35, 0.35, -0.75, 0.75, math.pi):
            for fraction in (0.10, 0.35, 0.60, 0.82):
                starts.append((target_angle + angle_offset, fraction))
        best = solve(starts, best)

    if best is None or best[0] > max(0.1 * tolerance, 1.0e-6):
        raise RuntimeError(
            "Partial-contact pressure centroid did not converge."
        )
    error, values, moments, result = best
    ux, uy, cutoff = values[:3]
    contact_area, weighted, centroid_x, centroid_y = moments
    scale = normal_force / weighted
    maximum_shape = max(
        max(0.0, ux * point[0] + uy * point[1] - cutoff)
        for point in boundary
    )
    return (
        contact_area / area,
        0.0,
        scale * maximum_shape / 1000.0,
        (centroid_x, centroid_y),
        error,
        int(result.nfev),
        (float(result.x[0]), float(result.x[1])),
        used_warm_start,
        used_full_fallback,
    )


def create_partial_contact_pressure(
    joint_profiles,
    joint_planes,
    contact_points,
    contact_resultants,
    kern_utilisations,
    joint_ids,
    _prepared_sections=None,
    _warm_starts=None,
    _solver_stats=None,
):
    profiles = [_coerce(value, rg.Curve) for value in _as_list(joint_profiles)]
    planes = [_coerce(value, rg.Plane) for value in _as_list(joint_planes)]
    points = [_coerce(value, rg.Point3d) for value in _as_list(contact_points)]
    resultants = []
    for value in _as_list(contact_resultants):
        vector = _coerce(value, rg.Vector3d)
        if vector is None:
            try:
                vector = rg.Vector3d(value)
            except Exception:
                vector = None
        resultants.append(vector)
    utilisations = [float(value) for value in _as_list(kern_utilisations)]
    identifiers = [str(value) for value in _as_list(joint_ids)]
    count = len(profiles)
    if not count or not all(
        len(values) == count
        for values in (planes, points, resultants, utilisations, identifiers)
    ):
        raise ValueError("All Stage 07D inputs must correspond one-to-one.")
    if any(value is None for value in profiles + planes + points + resultants):
        raise ValueError("Stage 07D contains invalid geometric input data.")
    if len(set(identifiers)) != count:
        raise ValueError("JointIDs must be unique.")
    if _prepared_sections is None:
        prepared_sections = [None] * count
    else:
        prepared_sections = list(_prepared_sections)
        if len(prepared_sections) != count:
            raise ValueError("Prepared Stage 07D sections must match JointIDs.")
    if _warm_starts is None:
        warm_starts = [None] * count
    else:
        warm_starts = _warm_starts
        if len(warm_starts) != count:
            raise ValueError("Stage 07D warm starts must match JointIDs.")
    solver_stats = _solver_stats if _solver_stats is not None else {}
    for key in ("partial_solves", "warm_attempts", "full_multistart_solves"):
        solver_stats.setdefault(key, 0)

    tolerance = _document_tolerance()
    ratios = []
    minimum_pressures = []
    maximum_pressures = []
    pressure_centroids = []
    partial_ids = []
    centroid_errors = []
    solver_evaluations = []
    failures = []

    values_by_joint = zip(
        profiles,
        planes,
        points,
        resultants,
        utilisations,
        prepared_sections,
    )
    for index, values in enumerate(values_by_joint):
        try:
            profile, plane, point, resultant, utilisation, section = values
            if section is None:
                section = _prepare_joint_section(profile, plane, tolerance)
            area = section["area"]
            centroid = section["centroid"]
            centered_boundary = section["boundary"]
            target_local = _plane_coordinates(point, plane)
            target = (
                target_local[0] - centroid[0],
                target_local[1] - centroid[1],
            )
            normal = section["normal"]
            normal_force = rg.Vector3d.Multiply(resultant, normal)
            if normal_force <= 0.0:
                raise ValueError("ContactResultant has no positive compression.")
            if utilisation <= 1.0 + KERN_TOLERANCE:
                ratio, minimum, maximum, reconstructed = _full_contact(
                    centered_boundary,
                    normal_force,
                    target,
                    section["full_moments"],
                )
                error = 0.0
                evaluations = 0
            else:
                partial_result = _partial_contact(
                    centered_boundary,
                    section["triangles"],
                    normal_force,
                    target,
                    tolerance,
                    area,
                    section["extent"],
                    warm_starts[index],
                )
                (
                    ratio,
                    minimum,
                    maximum,
                    reconstructed,
                    error,
                    evaluations,
                    warm_starts[index],
                    used_warm_start,
                    used_full_fallback,
                ) = partial_result
                solver_stats["partial_solves"] += 1
                solver_stats["warm_attempts"] += int(used_warm_start)
                solver_stats["full_multistart_solves"] += int(
                    used_full_fallback
                )
                partial_ids.append(identifiers[index])
            ratios.append(ratio)
            minimum_pressures.append(minimum)
            maximum_pressures.append(maximum)
            pressure_centroids.append(_world_point(
                plane,
                centroid[0] + reconstructed[0],
                centroid[1] + reconstructed[1],
            ))
            centroid_errors.append(error)
            solver_evaluations.append(evaluations)
        except Exception as error:
            failures.append((index, identifiers[index], str(error)))

    valid = (
        not failures
        and len(ratios) == count
        and all(0.0 < value <= 1.0 + 1.0e-9 for value in ratios)
        and all(value >= -1.0e-12 for value in minimum_pressures)
        and all(value > 0.0 for value in maximum_pressures)
    )
    report = (
        f"stage=partial_contact_pressure; joints={count}; "
        f"partial_contact_joints={len(partial_ids)}; "
        f"partial_contact_joint_ids={partial_ids}; "
        f"contact_area_ratio_min_max="
        f"({min(ratios) if ratios else 0.0:.6g},"
        f"{max(ratios) if ratios else 0.0:.6g}); "
        f"redistributed_pressure_min_max_MPa="
        f"({min(minimum_pressures) if minimum_pressures else 0.0:.6g},"
        f"{max(maximum_pressures) if maximum_pressures else 0.0:.6g}); "
        f"max_pressure_centroid_error_m="
        f"{max(centroid_errors) if centroid_errors else 0.0:.6g}; "
        f"max_solver_evaluations="
        f"{max(solver_evaluations) if solver_evaluations else 0}; "
        f"failures={failures}; valid={valid}; "
        "pressure_model=compression_only_affine_partial_contact; "
        "stone_strength_crushing_friction_and_pin_capacity_not_checked"
    )
    return (
        ratios,
        minimum_pressures,
        maximum_pressures,
        pressure_centroids,
        partial_ids,
        valid,
        report,
    )


def _case_key(case_index, angle, identifier):
    return "case[{0}]/angle[{1:.6g}]/{2}".format(
        case_index, angle, identifier
    )


def create_directional_partial_contact_pressure(
    joint_profiles,
    joint_planes,
    joint_ids,
    case_angles,
    case_joint_ids,
    contact_points,
    contact_resultants,
    kern_utilisations,
):
    identifiers = [str(value) for value in _as_list(joint_ids)]
    try:
        angles = [float(value) for value in _as_list(case_angles)]
        utilisations = [float(value) for value in _as_list(kern_utilisations)]
    except (TypeError, ValueError):
        raise ValueError(
            "CaseAngles and KernUtilisations must contain numeric values."
        )
    row_ids = [str(value) for value in _as_list(case_joint_ids)]
    points = _as_list(contact_points)
    resultants = _as_list(contact_resultants)
    joint_count = len(identifiers)
    expected_rows = len(angles) * joint_count
    if (
        not joint_count
        or not angles
        or len(set(identifiers)) != joint_count
        or any(
            len(values) != expected_rows
            for values in (row_ids, points, resultants, utilisations)
        )
    ):
        raise ValueError(
            "Stage 07D directional inputs must contain one complete "
            "JointIDs-sized block for every CaseAngles item."
        )

    profiles = [_coerce(value, rg.Curve) for value in _as_list(joint_profiles)]
    planes = [_coerce(value, rg.Plane) for value in _as_list(joint_planes)]
    if (
        len(profiles) != joint_count
        or len(planes) != joint_count
        or any(value is None for value in profiles + planes)
    ):
        raise ValueError(
            "JointProfiles, JointPlanes and JointIDs must correspond one-to-one."
        )
    tolerance = _document_tolerance()
    prepared_sections = []
    for profile, plane in zip(profiles, planes):
        try:
            prepared_sections.append(
                _prepare_joint_section(profile, plane, tolerance)
            )
        except Exception:
            prepared_sections.append(None)
    warm_starts = [None] * joint_count
    solver_stats = {}

    ratios = []
    minimum_pressures = []
    maximum_pressures = []
    pressure_centroids = []
    partial_keys = []
    failures = []
    for case_index, angle in enumerate(angles):
        start = case_index * joint_count
        end = start + joint_count
        if row_ids[start:end] != identifiers:
            failures.append((case_index, angle, "case_joint_id_order_mismatch"))
            continue
        result = create_partial_contact_pressure(
            profiles,
            planes,
            points[start:end],
            resultants[start:end],
            utilisations[start:end],
            identifiers,
            prepared_sections,
            warm_starts,
            solver_stats,
        )
        if not result[5]:
            failures.append((case_index, angle, result[6]))
            continue
        ratios.extend(result[0])
        minimum_pressures.extend(result[1])
        maximum_pressures.extend(result[2])
        pressure_centroids.extend(result[3])
        partial_keys.extend(
            _case_key(case_index, angle, identifier)
            for identifier in result[4]
        )

    valid = (
        not failures
        and len(ratios)
        == len(minimum_pressures)
        == len(maximum_pressures)
        == len(pressure_centroids)
        == expected_rows
        and all(0.0 < value <= 1.0 + 1.0e-9 for value in ratios)
        and all(value >= -1.0e-12 for value in minimum_pressures)
    )
    report = (
        f"stage=directional_partial_contact_pressure; "
        f"angle_cases={len(angles)}; joints_per_case={joint_count}; "
        f"flattened_rows={len(ratios)}; "
        f"partial_contact_case_rows={len(partial_keys)}; "
        f"contact_area_ratio_min_max="
        f"({min(ratios) if ratios else 0.0:.6g},"
        f"{max(ratios) if ratios else 0.0:.6g}); "
        f"redistributed_pressure_min_max_MPa="
        f"({min(minimum_pressures) if minimum_pressures else 0.0:.6g},"
        f"{max(maximum_pressures) if maximum_pressures else 0.0:.6g}); "
        f"partial_solves={solver_stats.get('partial_solves', 0)}; "
        f"warm_start_attempts={solver_stats.get('warm_attempts', 0)}; "
        f"full_multistart_solves="
        f"{solver_stats.get('full_multistart_solves', 0)}; "
        f"case_failures={failures}; valid={valid}; flattening=case_major; "
        "pressure_model=compression_only_affine_partial_contact"
    )
    return (
        ratios,
        minimum_pressures,
        maximum_pressures,
        pressure_centroids,
        partial_keys,
        valid,
        report,
    )


try:
    _component_inputs = (
        JointProfiles,
        JointPlanes,
        JointIDs,
        CaseAngles,
        CaseJointIDs,
        ContactPoints,
        ContactResultants,
        KernUtilisations,
    )
except NameError:
    _component_inputs = None

if _component_inputs is not None:
    (
        ContactAreaRatios,
        MinPressures,
        MaxPressures,
        PressureCentroids,
        PartialContactCaseKeys,
        Valid,
        Report,
    ) = create_directional_partial_contact_pressure(*_component_inputs)
# ---------- end _07d_仅受压部分接触 ----------

# ---- group: 07E 滑移指标
_07e_滑移指标_备注 = Panel("""按方向计算滑移指标ηs=γs·T/(μ·N)。
μ=0.55、γs=1.5为研究场景，不是实测材料参数。
输出SlidingUtilisations与SlidingCaseKeys供07F使用。
07D峰值压力只作数据有效性检查和直接报告。
已去除5 MPa经验强度及承载通过/压碎判定。
任何无效方向都令整体无效，不输出删行后的伪完整结果。""")
_07e_滑移指标 = Python3Script(
    JointPlanes=_06_引导径向分块.JointPlanes,
    JointIDs=_07a_块重与接缝邻接.JointIDs,
    CaseAngles=_07b_全方向接缝合力.CaseAngles,
    CaseJointIDs=_07b_全方向接缝合力.CaseJointIDs,
    ContactResultants=_07b_全方向接缝合力.ContactResultants,
    MaxPressures=_07d_仅受压部分接触.MaxPressures,
    FrictionCoefficient=μ_摩擦系数,
    SlidingSafetyFactor=γs_滑移系数)  # -> out, SlidingUtilisations, SlidingCaseKeys, Valid, Report; inputs JointPlanes: list of Plane, JointIDs: list, CaseAngles: list, CaseJointIDs: list, ContactResultants: list of Vector3d, MaxPressures: list
# ---------- _07e_滑移指标: Python ----------
#! python 3
"""Stage 07E - directional sliding indicator, without contact-strength verdict.

Inputs: JointPlanes, JointIDs, CaseAngles, CaseJointIDs, ContactResultants,
MaxPressures (MPa, validity check/report only), FrictionCoefficient,
SlidingSafetyFactor. Lists are case-major in the exact JointIDs order.
Outputs: SlidingUtilisations, SlidingCaseKeys, Valid, Report.
eta_s = SlidingSafetyFactor*T/(FrictionCoefficient*N).
N is the positive projection magnitude supplied by Stage 07B, not a signed
tension check. Pressure is reported separately; no measured strength,
crushing assessment, connector quantity or structural safety is inferred.
"""
import math
import Rhino.Geometry as rg
UTILISATION_TOLERANCE=1.0e-9
NORMAL_FORCE_EPSILON=1.0e-8

def _as_list(value):
    if value is None:return []
    if isinstance(value,str):return [value]
    try:return list(value)
    except TypeError:return [value]

def _unwrap(value):
    return value.Value if hasattr(value,'Value') else value

def _positive(value,name):
    number=float(value)
    if not math.isfinite(number) or number<=0:raise ValueError(name+' must be finite and positive.')
    return number

def _case_key(index,angle,identifier):
    return 'case[{0}]/angle[{1:.6g}]/{2}'.format(index,angle,identifier)

def create_directional_sliding_indicator(joint_planes,joint_ids,case_angles,case_joint_ids,contact_resultants,max_pressures,friction_coefficient,sliding_safety_factor):
    planes=[_unwrap(x) for x in _as_list(joint_planes)]
    ids=[str(x) for x in _as_list(joint_ids)]
    angles=[float(x) for x in _as_list(case_angles)]
    row_ids=[str(x) for x in _as_list(case_joint_ids)]
    forces=[_unwrap(x) for x in _as_list(contact_resultants)]
    pressures=[float(x) for x in _as_list(max_pressures)]
    mu=_positive(friction_coefficient,'FrictionCoefficient')
    gamma=_positive(sliding_safety_factor,'SlidingSafetyFactor')
    n=len(ids); expected=n*len(angles)
    if not n or not angles or len(set(ids))!=n or len(planes)!=n or any(len(a)!=expected for a in [row_ids,forces,pressures]):
        raise ValueError('Directional inputs require a complete JointIDs-sized block per direction.')
    if any(not math.isfinite(a) for a in angles):raise ValueError('CaseAngles must be finite.')
    normals=[]
    for p in planes:
        if not isinstance(p,rg.Plane):raise ValueError('Invalid JointPlane.')
        normal=rg.Vector3d(p.Normal)
        if not normal.Unitize():raise ValueError('Invalid joint normal.')
        normals.append(normal)
    values=[];keys=[];failures=[]
    for case,angle in enumerate(angles):
        start=case*n
        if row_ids[start:start+n]!=ids:
            failures.append((case,angle,'case_joint_id_order_mismatch'));continue
        for j,identifier in enumerate(ids):
            i=start+j
            try:
                force=forces[i];p=pressures[i]
                if not isinstance(force,rg.Vector3d):raise ValueError('Invalid contact resultant.')
                if not math.isfinite(p) or p < -1e-12:raise ValueError('Peak pressure must be finite and non-negative.')
                N=rg.Vector3d.Multiply(force,normals[j])
                if not math.isfinite(N) or N<=NORMAL_FORCE_EPSILON:raise ValueError('Normal magnitude is below the admissible gate.')
                T=(force-normals[j]*N).Length
                if not math.isfinite(T):raise ValueError('Invalid tangential magnitude.')
                # Preserve the production operation order and screening tolerance.
                required_friction=gamma*T/N
                eta=required_friction/mu
                values.append(eta)
                if eta>1.0+UTILISATION_TOLERANCE:keys.append(_case_key(case,angle,identifier))
            except Exception as e:failures.append((case,identifier,str(e)))
    valid=not failures and len(values)==expected
    if not valid:
        # Never publish a silently filtered subset of directional results.
        values=[];keys=[]
    report=('stage=directional_sliding_indicator; angle_cases={0}; joints_per_case={1}; '
            'flattened_rows={2}; sliding_case_rows={3}; friction_coefficient={4}; '
            'prescribed_sliding_factor={5}; pressure_max_MPa={6}; failures={7}; valid={8}; '
            'N_is_projection_magnitude_not_signed_audit; pressure_assessed_separately; '
            'no_contact_strength_or_connector_capacity_verdict; research_scenario_only').format(
                len(angles),n,len(values),len(keys),mu,gamma,max(pressures) if pressures else None,failures,valid)
    return values,keys,valid,report

try:
    _component_inputs=(JointPlanes,JointIDs,CaseAngles,CaseJointIDs,ContactResultants,MaxPressures,FrictionCoefficient,SlidingSafetyFactor)
except NameError:_component_inputs=None
if _component_inputs is not None:
    SlidingUtilisations,SlidingCaseKeys,Valid,Report=create_directional_sliding_indicator(*_component_inputs)
# ---------- end _07e_滑移指标 ----------
# ---- group: 07F 滑移缺额包络
_07f_滑移缺额包络_备注 = Panel("""逐接缝计算D=max(0, γs·T－μ·N)，单位kN。
输出DeficitJointIDs、DeficitVectors、SlidingDeficits。
每个接缝保留最大D和该控制方向的配套状态。
各接缝控制方向不构成同一个全局荷载工况。
正D标记待审查界面，不是连接件需求、承载或结构风险。
这里是论文计算主流程终点；没有销栓数量或工程安全判断。""")
_07f_滑移缺额包络 = Python3Script(
    JointPlanes=_06_引导径向分块.JointPlanes,
    JointIDs=_07a_块重与接缝邻接.JointIDs,
    CaseAngles=_07b_全方向接缝合力.CaseAngles,
    CaseJointIDs=_07b_全方向接缝合力.CaseJointIDs,
    ContactResultants=_07b_全方向接缝合力.ContactResultants,
    PressureCentroids=_07d_仅受压部分接触.PressureCentroids,
    SlidingCaseKeys=_07e_滑移指标.SlidingCaseKeys,
    FrictionCoefficient=μ_摩擦系数,
    SlidingSafetyFactor=γs_滑移系数)  # -> out, DeficitJointIDs, DeficitVectors, SlidingDeficits, GoverningHorizontalAngles, GoverningNormalForces, GoverningTangentialForces, GoverningSlidingUtilisations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; inputs JointPlanes: list of Plane, JointIDs: list, CaseAngles: list, CaseJointIDs: list, ContactResultants: list of Vector3d, PressureCentroids: list of Point3d, SlidingCaseKeys: list
# ---------- _07f_滑移缺额包络: Python ----------
#! python 3
"""Stage 07F - per-joint sliding-deficit envelope (paper version).

Inputs: JointPlanes, JointIDs, CaseAngles, CaseJointIDs, ContactResultants,
PressureCentroids, SlidingCaseKeys, FrictionCoefficient, SlidingSafetyFactor.
Outputs: DeficitJointIDs, DeficitVectors, SlidingDeficits,
GoverningHorizontalAngles, GoverningNormalForces, GoverningTangentialForces,
GoverningSlidingUtilisations, GoverningPressureCentroids, Valid, Report.

D = max(0, SlidingSafetyFactor*T - FrictionCoefficient*N), in kN.
Each joint retains D and the paired quantities from its own governing case.
Different joints need not share a governing direction. Positive D identifies
an interface for review, not connector demand/capacity or structural risk.
The vector opposes the tangential resultant on the first adjacent block.
The numerical kernel and tie-breaking rules are retained from the verified
07F implementation. No connector sizing or contact-strength verdict is made.
"""

import math

import Rhino.Geometry as rg


DEMAND_TOLERANCE_KN = 1.0e-9


def _as_list(value):
    if value is None:
        return []
    if isinstance(value, str):
        return [value]
    try:
        return list(value)
    except TypeError:
        return [value]


def _coerce_plane(value):
    if isinstance(value, rg.Plane):
        return rg.Plane(value)
    if hasattr(value, "Value") and isinstance(value.Value, rg.Plane):
        return rg.Plane(value.Value)
    return None


def _coerce_vector(value):
    if isinstance(value, rg.Vector3d):
        return rg.Vector3d(value)
    if hasattr(value, "Value"):
        return _coerce_vector(value.Value)
    try:
        return rg.Vector3d(value)
    except Exception:
        return None


def _coerce_point(value):
    if isinstance(value, rg.Point3d):
        return rg.Point3d(value)
    if hasattr(value, "Value") and isinstance(value.Value, rg.Point3d):
        return rg.Point3d(value.Value)
    return None


def _positive_number(value, name):
    try:
        number = float(value)
    except (TypeError, ValueError):
        raise ValueError("{0} must be a number.".format(name))
    if not math.isfinite(number) or number <= 0.0:
        raise ValueError("{0} must be finite and greater than zero.".format(name))
    return number


def create_sliding_deficit(
    joint_planes,
    joint_ids,
    contact_resultants,
    sliding_joint_ids,
    friction_coefficient,
    sliding_safety_factor,
    _prepared_normals=None,
):
    planes = [_coerce_plane(value) for value in _as_list(joint_planes)]
    identifiers = [str(value) for value in _as_list(joint_ids)]
    resultants = [_coerce_vector(value) for value in _as_list(contact_resultants)]
    supplied_sliding_ids = [
        str(value) for value in _as_list(sliding_joint_ids)
    ]

    count = len(planes)
    if not count or not all(
        len(values) == count for values in (identifiers, resultants)
    ):
        raise ValueError("All Stage 07F joint inputs must correspond one-to-one.")
    if any(value is None for value in planes + resultants):
        raise ValueError("Stage 07F contains invalid Plane or Vector data.")
    if len(set(identifiers)) != count:
        raise ValueError("JointIDs must be unique.")
    if len(set(supplied_sliding_ids)) != len(supplied_sliding_ids):
        raise ValueError("SlidingJointIDs must be unique.")
    unknown_ids = [
        value for value in supplied_sliding_ids if value not in set(identifiers)
    ]
    if unknown_ids:
        raise ValueError(
            "SlidingJointIDs contains unknown IDs: {0}".format(unknown_ids)
        )
    if _prepared_normals is None:
        prepared_normals = [None] * count
    else:
        prepared_normals = list(_prepared_normals)
        if len(prepared_normals) != count:
            raise ValueError("Prepared Stage 07F normals must match JointIDs.")

    friction = _positive_number(friction_coefficient, "FrictionCoefficient")
    sliding_factor = _positive_number(
        sliding_safety_factor, "SlidingSafetyFactor"
    )

    deficit_ids = []
    demand_vectors = []
    demand_forces = []
    recomputed_sliding_ids = []
    normal_forces = []
    tangential_forces = []
    friction_resistances = []
    failures = []

    for index, (plane, resultant, prepared_normal) in enumerate(zip(
        planes, resultants, prepared_normals
    )):
        try:
            if prepared_normal is None:
                normal = rg.Vector3d(plane.Normal)
                if not normal.Unitize():
                    raise ValueError("JointPlane has an invalid normal.")
            else:
                normal = prepared_normal
            normal_force = rg.Vector3d.Multiply(resultant, normal)
            if not math.isfinite(normal_force) or normal_force <= 0.0:
                raise ValueError(
                    "ContactResultant has no positive compressive normal force."
                )
            tangential = resultant - normal * normal_force
            tangential_force = tangential.Length
            if not math.isfinite(tangential_force):
                raise ValueError("ContactResultant has an invalid tangent force.")

            friction_resistance = friction * normal_force
            demand = max(
                0.0,
                sliding_factor * tangential_force - friction_resistance,
            )
            normal_forces.append(normal_force)
            tangential_forces.append(tangential_force)
            friction_resistances.append(friction_resistance)
            if demand > DEMAND_TOLERANCE_KN:
                direction = rg.Vector3d(tangential)
                if not direction.Unitize():
                    raise ValueError(
                        "A nonzero sliding deficit has no valid resisting direction."
                    )
                identifier = identifiers[index]
                recomputed_sliding_ids.append(identifier)
                deficit_ids.append(identifier)
                demand_vectors.append(-direction * demand)
                demand_forces.append(demand)
        except Exception as error:
            failures.append((index, identifiers[index], str(error)))

    mapping_valid = recomputed_sliding_ids == supplied_sliding_ids
    if not mapping_valid:
        failures.append((
            "sliding_id_mismatch",
            "supplied={0}; recomputed={1}".format(
                supplied_sliding_ids, recomputed_sliding_ids
            ),
        ))
    valid = (
        not failures
        and mapping_valid
        and len(deficit_ids) == len(demand_vectors) == len(demand_forces)
    )
    report = (
        f"stage=deficit_demand; joints={count}; "
        "parameters_source=assumed_not_measured; "
        f"friction_coefficient={friction:.6g}; "
        f"sliding_safety_factor={sliding_factor:.6g}; "
        f"supplied_sliding_joints={len(supplied_sliding_ids)}; "
        f"deficit_joints={len(deficit_ids)}; deficit_joint_ids={deficit_ids}; "
        f"deficit_demand_force_min_max_kN="
        f"({min(demand_forces) if demand_forces else 0.0:.6g},"
        f"{max(demand_forces) if demand_forces else 0.0:.6g}); "
        f"normal_force_min_max_kN="
        f"({min(normal_forces) if normal_forces else 0.0:.6g},"
        f"{max(normal_forces) if normal_forces else 0.0:.6g}); "
        f"max_tangential_force_kN="
        f"{max(tangential_forces) if tangential_forces else 0.0:.6g}; "
        f"friction_resistance_min_max_kN="
        f"({min(friction_resistances) if friction_resistances else 0.0:.6g},"
        f"{max(friction_resistances) if friction_resistances else 0.0:.6g}); "
        f"mapping_valid={mapping_valid}; failures={failures}; valid={valid}; "
        "demand_model=max(0,safety_factor*tangent-friction*normal); "
        "deficit_vector_convention=resistance_on_first_block_opposes_tangent; "
        "pressure_is_assessed_separately; "
        "no_connector_capacity_assessed; input_load_case_not_independently_validated"
    )
    return deficit_ids, demand_vectors, demand_forces, valid, report


def _case_key(case_index, angle, identifier):
    return "case[{0}]/angle[{1:.6g}]/{2}".format(
        case_index, angle, identifier
    )


def create_directional_sliding_deficit_envelope(
    joint_planes,
    joint_ids,
    case_angles,
    case_joint_ids,
    contact_resultants,
    pressure_centroids,
    sliding_case_keys,
    friction_coefficient,
    sliding_safety_factor,
):
    planes = [_coerce_plane(value) for value in _as_list(joint_planes)]
    identifiers = [str(value) for value in _as_list(joint_ids)]
    try:
        angles = [float(value) for value in _as_list(case_angles)]
    except (TypeError, ValueError):
        raise ValueError("CaseAngles must contain numeric degree values.")
    row_ids = [str(value) for value in _as_list(case_joint_ids)]
    resultants = [_coerce_vector(value) for value in _as_list(contact_resultants)]
    centroids = [_coerce_point(value) for value in _as_list(pressure_centroids)]
    supplied_keys = [str(value) for value in _as_list(sliding_case_keys)]
    joint_count = len(identifiers)
    expected_rows = len(angles) * joint_count
    if (
        not joint_count
        or not angles
        or len(planes) != joint_count
        or len(set(identifiers)) != joint_count
        or len(row_ids) != expected_rows
        or len(resultants) != expected_rows
        or len(centroids) != expected_rows
        or any(value is None for value in planes + resultants + centroids)
    ):
        raise ValueError(
            "Stage 07F directional inputs must contain one complete "
            "JointIDs-sized block for every CaseAngles item."
        )
    if len(set(supplied_keys)) != len(supplied_keys):
        raise ValueError("SlidingCaseKeys must be unique.")
    identifier_indices = {
        identifier: index for index, identifier in enumerate(identifiers)
    }
    key_positions = {}
    for case_index, angle in enumerate(angles):
        for joint_index, identifier in enumerate(identifiers):
            key_positions[_case_key(case_index, angle, identifier)] = (
                case_index, joint_index
            )
    unknown_keys = [
        value for value in supplied_keys if value not in key_positions
    ]
    if unknown_keys:
        raise ValueError(
            "SlidingCaseKeys contains unknown case keys: {0}".format(
                unknown_keys
            )
        )

    friction = _positive_number(friction_coefficient, "FrictionCoefficient")
    sliding_factor = _positive_number(
        sliding_safety_factor, "SlidingSafetyFactor"
    )
    supplied_key_set = set(supplied_keys)
    sliding_indices_by_case = [set() for angle in angles]
    for key in supplied_key_set:
        case_index, joint_index = key_positions[key]
        sliding_indices_by_case[case_index].add(joint_index)
    prepared_normals = []
    for plane in planes:
        normal = rg.Vector3d(plane.Normal)
        if not normal.Unitize():
            raise ValueError("JointPlanes contains an invalid normal.")
        prepared_normals.append(normal)
    envelopes = {}
    failures = []
    total_deficit_case_rows = 0

    for case_index, angle in enumerate(angles):
        start = case_index * joint_count
        end = start + joint_count
        if row_ids[start:end] != identifiers:
            failures.append((case_index, angle, "case_joint_id_order_mismatch"))
            continue
        case_sliding_ids = [
            identifiers[joint_index]
            for joint_index in sorted(sliding_indices_by_case[case_index])
        ]
        result = create_sliding_deficit(
            planes,
            identifiers,
            resultants[start:end],
            case_sliding_ids,
            friction,
            sliding_factor,
            prepared_normals,
        )
        if not result[3]:
            failures.append((case_index, angle, result[4]))
            continue
        total_deficit_case_rows += len(result[0])
        for identifier, vector, demand in zip(
            result[0], result[1], result[2]
        ):
            joint_index = identifier_indices[identifier]
            plane = planes[joint_index]
            resultant = resultants[start + joint_index]
            normal = prepared_normals[joint_index]
            normal_force = rg.Vector3d.Multiply(resultant, normal)
            tangential_force = (
                resultant - normal * normal_force
            ).Length
            sliding_utilisation = (
                sliding_factor * tangential_force
                / (friction * normal_force)
            )
            candidate = {
                "case_index": case_index,
                "angle": angle,
                "vector": vector,
                "demand": demand,
                "normal": normal_force,
                "tangential": tangential_force,
                "sliding_utilisation": sliding_utilisation,
                "pressure_centroid": centroids[start + joint_index],
            }
            current = envelopes.get(identifier)
            if (
                current is None
                or demand > current["demand"] + DEMAND_TOLERANCE_KN
                or (
                    abs(demand - current["demand"]) <= DEMAND_TOLERANCE_KN
                    and angle < current["angle"]
                )
            ):
                envelopes[identifier] = candidate

    deficit_ids = [
        identifier for identifier in identifiers if identifier in envelopes
    ]
    demand_vectors = [envelopes[value]["vector"] for value in deficit_ids]
    demand_forces = [envelopes[value]["demand"] for value in deficit_ids]
    governing_angles = [envelopes[value]["angle"] for value in deficit_ids]
    governing_normals = [envelopes[value]["normal"] for value in deficit_ids]
    governing_tangentials = [
        envelopes[value]["tangential"] for value in deficit_ids
    ]
    governing_sliding_utilisations = [
        envelopes[value]["sliding_utilisation"] for value in deficit_ids
    ]
    governing_pressure_centroids = [
        envelopes[value]["pressure_centroid"] for value in deficit_ids
    ]
    one_to_one = (
        len(deficit_ids)
        == len(demand_vectors)
        == len(demand_forces)
        == len(governing_angles)
        == len(governing_normals)
        == len(governing_tangentials)
        == len(governing_sliding_utilisations)
        == len(governing_pressure_centroids)
    )
    valid = not failures and one_to_one
    report = (
        f"stage=directional_deficit_demand_envelope; angle_cases={len(angles)}; "
        f"joints_per_case={joint_count}; deficit_case_rows={total_deficit_case_rows}; "
        f"envelope_deficit_joints={len(deficit_ids)}; deficit_joint_ids={deficit_ids}; "
        f"deficit_demand_force_min_max_kN="
        f"({min(demand_forces) if demand_forces else 0.0:.6g},"
        f"{max(demand_forces) if demand_forces else 0.0:.6g}); "
        f"governing_angle_min_max_deg="
        f"({min(governing_angles) if governing_angles else 0.0:.6g},"
        f"{max(governing_angles) if governing_angles else 0.0:.6g}); "
        f"case_failures={failures}; one_to_one={one_to_one}; valid={valid}; "
        "envelope_model=max_per_joint_of_final_deficit_demand_across_angles; "
        "paired_state=angle_normal_tangent_vector_from_same_governing_case; "
        "per_joint_governing_angles_do_not_form_one_simultaneous_global_case; "
        "pressure_is_assessed_separately"
    )
    return (
        deficit_ids,
        demand_vectors,
        demand_forces,
        governing_angles,
        governing_normals,
        governing_tangentials,
        governing_sliding_utilisations,
        governing_pressure_centroids,
        valid,
        report,
    )


try:
    _component_inputs = (
        JointPlanes,
        JointIDs,
        CaseAngles,
        CaseJointIDs,
        ContactResultants,
        PressureCentroids,
        SlidingCaseKeys,
        FrictionCoefficient,
        SlidingSafetyFactor,
    )
except NameError:
    _component_inputs = None

if _component_inputs is not None:
    (
        DeficitJointIDs,
        DeficitVectors,
        SlidingDeficits,
        GoverningHorizontalAngles,
        GoverningNormalForces,
        GoverningTangentialForces,
        GoverningSlidingUtilisations,
        GoverningPressureCentroids,
        Valid,
        Report,
    ) = create_directional_sliding_deficit_envelope(*_component_inputs)
# ---------- end _07f_滑移缺额包络 ----------
_07f_当前运行报告 = Panel(_07f_滑移缺额包络.Report)

# ---- group: 显示输出｜不参与计算
仅显示_备注 = Panel("""保留块体与实际接缝轮廓预览。
颜色及透明显示不改变求解与数值结果。
已移除销栓数量/位置展示与探索域预览。""")
块体预览颜色 = ColourRGB(Alpha=255, Red=205, Green=205, Blue=205)
接缝预览颜色 = ColourRGB(Alpha=255, Red=35, Green=35, Blue=35)
块体预览 = CustomPreview(Geometry=_06_引导径向分块.Blocks, Material=块体预览颜色)
接缝轮廓预览 = CustomPreview(Geometry=_06_引导径向分块.JointProfiles, Material=接缝预览颜色)
